# Grasshopper definition Adaptive Timber Fabrication_Hildebrandt.gh (Grasshopper 1.0.7)
# plug-ins: Pufferfish, VirtualRobot.Grasshopper, Sandbox, HAL [Geometry Utilities], treesloth01, ClipperComponents

# ----
# Example
plane = Plane(flatten([PlaneXY(1838.046249, -723.6903798, 192.4932234), Plane(origin=(1838.046249, -723.6903798, 142.4932234), x=(0.999996994, -0.00047835411, -0.002404841666), y=(0, 0.9807851742, -0.195090856)), Plane(origin=(1837.99721, -727.5921852, 122.8775789), x=(0.999996994, -0.00047835411, -0.002404841666), y=(0, 0.9807851742, -0.195090856)), Plane(origin=(2091.996416, -727.5921852, 122.2425808), x=(0.999996994, -0.00047835411, -0.002404841666), y=(0, 0.9807851742, -0.195090856)), Plane(origin=(2091.992758, -720.2362936, 120.779408), x=(0.999996994, -0.00047835411, -0.002404841666), y=(0, 0.9807851742, -0.195090856)), Plane(origin=(1837.993552, -720.2362936, 121.414406), x=(0.999996994, -0.00047835411, -0.002404841666), y=(0, 0.9807851742, -0.195090856))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]))
plane_2 = Plane(flatten([PlaneXY(2064.045543, -64.71832196, 191.9285908), Plane(origin=(2064.045543, -64.71832196, 141.9285908), x=(0.999996994, 0.0004783541718, -0.00240484164), y=(0, 0.980785169, 0.1950908823)), Plane(origin=(2063.996504, -60.81651604, 122.3129464), x=(0.999996994, 0.0004783541718, -0.00240484164), y=(0, 0.980785169, 0.1950908823)), Plane(origin=(1809.997298, -60.81651604, 122.9479444), x=(0.999996994, 0.0004783541718, -0.00240484164), y=(0, 0.980785169, 0.1950908823)), Plane(origin=(1809.99364, -68.17240761, 121.4847714), x=(0.999996994, 0.0004783541718, -0.00240484164), y=(0, 0.980785169, 0.1950908823)), Plane(origin=(2063.992846, -68.17240761, 120.8497733), x=(0.999996994, 0.0004783541718, -0.00240484164), y=(0, 0.980785169, 0.1950908823))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]))
plane_3 = Plane(flatten([PlaneXY(2352.044642, -64.71832196, 191.2082215), Plane(origin=(2352.044642, -64.71832196, 141.2082215), x=(0.999996994, 0.0004783541718, -0.00240484164), y=(0, 0.980785169, 0.1950908823)), Plane(origin=(2351.995603, -60.81651604, 121.592577), x=(0.999996994, 0.0004783541718, -0.00240484164), y=(0, 0.980785169, 0.1950908823)), Plane(origin=(2097.996397, -60.81651604, 122.2275751), x=(0.999996994, 0.0004783541718, -0.00240484164), y=(0, 0.980785169, 0.1950908823)), Plane(origin=(2097.992739, -68.17240761, 120.764402), x=(0.999996994, 0.0004783541718, -0.00240484164), y=(0, 0.980785169, 0.1950908823)), Plane(origin=(2351.991945, -68.17240761, 120.129404), x=(0.999996994, 0.0004783541718, -0.00240484164), y=(0, 0.980785169, 0.1950908823))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]))
plane_4 = Plane(flatten([PlaneXY(2371.992293, 76.22299993, 170.3525099), Plane(origin=(2371.992293, 76.22299993, 120.3525099), x=(0.999996875, 0, -0.002499992124), y=(3.262438963e-11, 1, 1.30679458e-08)), Plane(origin=(2371.992293, 76.22299993, 120.3525099), x=(0.999996875, 0, -0.002499992124), y=(3.262438963e-11, 1, 1.30679458e-08)), Plane(origin=(2268.953615, 76.22299993, 120.6101066), x=(0.999996875, 0, -0.002499992124), y=(3.262438963e-11, 1, 1.30679458e-08)), Plane(origin=(2268.953615, 76.22299993, 120.6101066), x=(0.999996875, 0, -0.002499992124), y=(3.262438963e-11, 1, 1.30679458e-08)), Plane(origin=(2270.188223, 76.223, 120.4520971), x=(0.968394977, 3.227799724e-09, -0.249421668), y=(-3.11980136e-09, 1, 8.283151956e-10))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]))
plane_5 = Plane(flatten([PlaneXY(2079.035208, 76.22299993, 171.084681), Plane(origin=(2079.035208, 76.22299993, 121.084681), x=(0.999996875, 0, -0.002499992124), y=(3.262441017e-11, 1, 1.306795402e-08)), Plane(origin=(2079.035208, 76.22299993, 121.084681), x=(0.999996875, 0, -0.002499992124), y=(3.262441017e-11, 1, 1.306795402e-08)), Plane(origin=(1975.99653, 76.22299993, 121.3422777), x=(0.999996875, 0, -0.002499992124), y=(3.262441017e-11, 1, 1.306795402e-08)), Plane(origin=(1975.99653, 76.22299993, 121.3422777), x=(0.999996875, 0, -0.002499992124), y=(3.262441017e-11, 1, 1.306795402e-08)), Plane(origin=(1977.231138, 76.223, 121.1842682), x=(0.968394977, 3.227808517e-09, -0.249421668), y=(-3.119806952e-09, 1, 8.283287383e-10))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]))
plane_6 = Plane(flatten([PlaneXY(2246.995683, 247.902, 170.6650014), Plane(origin=(2246.995683, 247.902, 120.6650014), x=(0.999996875, 0, -0.002499992217), y=(-2.182339685e-11, 1, -8.735521913e-09)), Plane(origin=(2246.995683, 247.902, 120.6650014), x=(0.999996875, 0, -0.002499992217), y=(-2.182339685e-11, 1, -8.735521913e-09)), Plane(origin=(2102.993133, 247.902, 121.0250078), x=(0.999996875, 0, -0.002499992217), y=(-2.182339685e-11, 1, -8.735521913e-09)), Plane(origin=(2102.993133, 247.902, 121.0250078), x=(0.999996875, 0, -0.002499992217), y=(-2.182339685e-11, 1, -8.735521913e-09)), Plane(origin=(2105.753188, 247.902, 120.1859054), x=(0.8321764041, 0, -0.5545109849), y=(-1.198417527e-11, 1, -1.8467183e-11))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]))
plane_7 = Plane(flatten([PlaneXY(1958.996584, 249.902, 171.3851338), Plane(origin=(1958.996584, 249.902, 121.3851338), x=(0.999996875, 0, -0.002499992217), y=(-2.191400589e-11, 1, -8.735549942e-09)), Plane(origin=(1958.996584, 249.902, 121.3851338), x=(0.999996875, 0, -0.002499992217), y=(-2.191400589e-11, 1, -8.735549942e-09)), Plane(origin=(1814.994034, 249.902, 121.7451402), x=(0.999996875, 0, -0.002499992217), y=(-2.191400589e-11, 1, -8.735549942e-09)), Plane(origin=(1814.994034, 249.902, 121.7451402), x=(0.999996875, 0, -0.002499992217), y=(-2.191400589e-11, 1, -8.735549942e-09)), Plane(origin=(1817.754089, 249.902, 120.9060378), x=(0.8321764041, 0, -0.5545109849), y=(-1.203747501e-11, 1, -1.846645533e-11))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]))
plane_8 = Plane(flatten([PlaneXY(2371.992293, 349.6109999, 170.3525099), Plane(origin=(2371.992293, 349.6109999, 120.3525099), x=(0.999996875, 0, -0.002499992124), y=(3.262440906e-11, 1, 1.306795357e-08)), Plane(origin=(2371.992293, 349.6109999, 120.3525099), x=(0.999996875, 0, -0.002499992124), y=(3.262440906e-11, 1, 1.306795357e-08)), Plane(origin=(2268.953615, 349.6109999, 120.6101066), x=(0.999996875, 0, -0.002499992124), y=(3.262440906e-11, 1, 1.306795357e-08)), Plane(origin=(2268.953615, 349.6109999, 120.6101066), x=(0.999996875, 0, -0.002499992124), y=(3.262440906e-11, 1, 1.306795357e-08)), Plane(origin=(2270.188223, 349.611, 120.4520971), x=(0.968394977, 3.227799736e-09, -0.249421668), y=(-3.119800186e-09, 1, 8.283198043e-10))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]))
plane_9 = Plane(flatten([PlaneXY(2079.035206, 349.6109999, 171.0841093), Plane(origin=(2079.035206, 349.6109999, 121.0841093), x=(0.999996875, 0, -0.002499992124), y=(3.262438727e-11, 1, 1.306794486e-08)), Plane(origin=(2079.035206, 349.6109999, 121.0841093), x=(0.999996875, 0, -0.002499992124), y=(3.262438727e-11, 1, 1.306794486e-08)), Plane(origin=(1975.996528, 349.6109999, 121.341706), x=(0.999996875, 0, -0.002499992124), y=(3.262438727e-11, 1, 1.306794486e-08)), Plane(origin=(1975.996528, 349.6109999, 121.341706), x=(0.999996875, 0, -0.002499992124), y=(3.262438727e-11, 1, 1.306794486e-08)), Plane(origin=(1977.231137, 349.611, 121.1836965), x=(0.968394977, 3.227808517e-09, -0.249421668), y=(-3.119805795e-09, 1, 8.283332315e-10))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]))
plane_10 = Plane(flatten([PlaneXY(2123.045359, -723.6903791, 191.7807197), Plane(origin=(2123.045359, -723.6903791, 141.7807197), x=(0.999996994, -0.0004783541718, -0.00240484164), y=(0, 0.980785169, -0.1950908823)), Plane(origin=(2122.99632, -727.592185, 122.1650753), x=(0.999996994, -0.0004783541718, -0.00240484164), y=(0, 0.980785169, -0.1950908823)), Plane(origin=(2376.995525, -727.592185, 121.5300772), x=(0.999996994, -0.0004783541718, -0.00240484164), y=(0, 0.980785169, -0.1950908823)), Plane(origin=(2376.991867, -720.2362935, 120.0669042), x=(0.999996994, -0.0004783541718, -0.00240484164), y=(0, 0.980785169, -0.1950908823)), Plane(origin=(2122.992662, -720.2362935, 120.7019022), x=(0.999996994, -0.0004783541718, -0.00240484164), y=(0, 0.980785169, -0.1950908823))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]))
plane_11 = Plane(flatten([PlaneXY(2246.997683, 435.451, 170.6649964), Plane(origin=(2246.997683, 435.451, 120.6649964), x=(0.999996875, 0, -0.002499992217), y=(-2.172728861e-11, 1, -8.735514659e-09)), Plane(origin=(2246.997683, 435.451, 120.6649964), x=(0.999996875, 0, -0.002499992217), y=(-2.172728861e-11, 1, -8.735514659e-09)), Plane(origin=(2102.995133, 435.451, 121.0250028), x=(0.999996875, 0, -0.002499992217), y=(-2.172728861e-11, 1, -8.735514659e-09)), Plane(origin=(2102.995133, 435.451, 121.0250028), x=(0.999996875, 0, -0.002499992217), y=(-2.172728861e-11, 1, -8.735514659e-09)), Plane(origin=(2105.755188, 435.451, 120.1859004), x=(0.8321764041, 0, -0.5545109849), y=(-1.191498062e-11, 1, -1.851429347e-11))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]))
# internalized geometries and frames
plane_12 = Plane(flatten([PlaneXY(1958.996583, 435.451, 171.3849988), Plane(origin=(1958.996583, 435.451, 121.3849988), x=(0.999996875, 0, -0.002499992217), y=(-2.191756803e-11, 1, -8.735509299e-09)), Plane(origin=(1958.996583, 435.451, 121.3849988), x=(0.999996875, 0, -0.002499992217), y=(-2.191756803e-11, 1, -8.735509299e-09)), Plane(origin=(1814.994033, 435.451, 121.7450052), x=(0.999996875, 0, -0.002499992217), y=(-2.191756803e-11, 1, -8.735509299e-09)), Plane(origin=(1814.994033, 435.451, 121.7450052), x=(0.999996875, 0, -0.002499992217), y=(-2.191756803e-11, 1, -8.735509299e-09)), Plane(origin=(1817.754088, 435.451, 120.9059028), x=(0.8321764041, 0, -0.5545109849), y=(-1.202159138e-11, 1, -1.843776102e-11))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]))
merge = Merge(
    Data1=plane_10,
    Data2=plane,
    Data3=plane_2,
    Data4=plane_3,
    Data5=plane_4,
    Data6=plane_5,
    Data7=plane_6,
    Data8=plane_7,
    Data9=plane_8,
    Data10=plane_9,
    Data11=plane_11,
    Data12=plane_12)
geometry = Geometry([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])
# Fabrication
# Brief:
# This is a tool for programming toolpaths for 5-axis robotic milling
# of contour and channel cuts. Milling frames should be internalized
# one geometry at a time but can be combined into one toolpath.
# 
# Harrison Hildebrandt
# 06.2022
# Jump to Simulation
geometry_2 = Geometry(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)

# ----
# Section 1
# Sheet 1: rad ccw & tan in
plane_13 = Plane(flatten([PlaneXY(2123.045359, -723.6903791, 191.7807197), Plane(origin=(2123.045359, -723.6903791, 141.7807197), x=(0.999996994, -0.0004783541718, -0.00240484164), y=(0, 0.980785169, -0.1950908823)), Plane(origin=(2122.99632, -727.592185, 122.1650753), x=(0.999996994, -0.0004783541718, -0.00240484164), y=(0, 0.980785169, -0.1950908823)), Plane(origin=(2376.995525, -727.592185, 121.5300772), x=(0.999996994, -0.0004783541718, -0.00240484164), y=(0, 0.980785169, -0.1950908823)), Plane(origin=(2376.991867, -720.2362935, 120.0669042), x=(0.999996994, -0.0004783541718, -0.00240484164), y=(0, 0.980785169, -0.1950908823)), Plane(origin=(2122.992662, -720.2362935, 120.7019022), x=(0.999996994, -0.0004783541718, -0.00240484164), y=(0, 0.980785169, -0.1950908823))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]))  # disabled
plane_14 = Plane(flatten([PlaneXY(1838.046249, -723.6903798, 192.4932234), Plane(origin=(1838.046249, -723.6903798, 142.4932234), x=(0.999996994, -0.00047835411, -0.002404841666), y=(0, 0.9807851742, -0.195090856)), Plane(origin=(1837.99721, -727.5921852, 122.8775789), x=(0.999996994, -0.00047835411, -0.002404841666), y=(0, 0.9807851742, -0.195090856)), Plane(origin=(2091.996416, -727.5921852, 122.2425808), x=(0.999996994, -0.00047835411, -0.002404841666), y=(0, 0.9807851742, -0.195090856)), Plane(origin=(2091.992758, -720.2362936, 120.779408), x=(0.999996994, -0.00047835411, -0.002404841666), y=(0, 0.9807851742, -0.195090856)), Plane(origin=(1837.993552, -720.2362936, 121.414406), x=(0.999996994, -0.00047835411, -0.002404841666), y=(0, 0.9807851742, -0.195090856))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]))  # disabled
plane_15 = Plane(flatten([PlaneXY(2064.045543, -64.71832196, 191.9285908), Plane(origin=(2064.045543, -64.71832196, 141.9285908), x=(0.999996994, 0.0004783541718, -0.00240484164), y=(0, 0.980785169, 0.1950908823)), Plane(origin=(2063.996504, -60.81651604, 122.3129464), x=(0.999996994, 0.0004783541718, -0.00240484164), y=(0, 0.980785169, 0.1950908823)), Plane(origin=(1809.997298, -60.81651604, 122.9479444), x=(0.999996994, 0.0004783541718, -0.00240484164), y=(0, 0.980785169, 0.1950908823)), Plane(origin=(1809.99364, -68.17240761, 121.4847714), x=(0.999996994, 0.0004783541718, -0.00240484164), y=(0, 0.980785169, 0.1950908823)), Plane(origin=(2063.992846, -68.17240761, 120.8497733), x=(0.999996994, 0.0004783541718, -0.00240484164), y=(0, 0.980785169, 0.1950908823))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]))  # disabled
plane_16 = Plane(flatten([PlaneXY(2352.044642, -64.71832196, 191.2082215), Plane(origin=(2352.044642, -64.71832196, 141.2082215), x=(0.999996994, 0.0004783541718, -0.00240484164), y=(0, 0.980785169, 0.1950908823)), Plane(origin=(2351.995603, -60.81651604, 121.592577), x=(0.999996994, 0.0004783541718, -0.00240484164), y=(0, 0.980785169, 0.1950908823)), Plane(origin=(2097.996397, -60.81651604, 122.2275751), x=(0.999996994, 0.0004783541718, -0.00240484164), y=(0, 0.980785169, 0.1950908823)), Plane(origin=(2097.992739, -68.17240761, 120.764402), x=(0.999996994, 0.0004783541718, -0.00240484164), y=(0, 0.980785169, 0.1950908823)), Plane(origin=(2351.991945, -68.17240761, 120.129404), x=(0.999996994, 0.0004783541718, -0.00240484164), y=(0, 0.980785169, 0.1950908823))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]))  # disabled
plane_17 = Plane(flatten([PlaneXY(2371.992293, 76.22299993, 170.3525099), Plane(origin=(2371.992293, 76.22299993, 120.3525099), x=(0.999996875, 0, -0.002499992124), y=(3.262438963e-11, 1, 1.30679458e-08)), Plane(origin=(2371.992293, 76.22299993, 120.3525099), x=(0.999996875, 0, -0.002499992124), y=(3.262438963e-11, 1, 1.30679458e-08)), Plane(origin=(2268.953615, 76.22299993, 120.6101066), x=(0.999996875, 0, -0.002499992124), y=(3.262438963e-11, 1, 1.30679458e-08)), Plane(origin=(2268.953615, 76.22299993, 120.6101066), x=(0.999996875, 0, -0.002499992124), y=(3.262438963e-11, 1, 1.30679458e-08)), Plane(origin=(2270.188223, 76.223, 120.4520971), x=(0.968394977, 3.227799724e-09, -0.249421668), y=(-3.11980136e-09, 1, 8.283151956e-10))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]))  # disabled
plane_18 = Plane(flatten([PlaneXY(2079.035208, 76.22299993, 171.084681), Plane(origin=(2079.035208, 76.22299993, 121.084681), x=(0.999996875, 0, -0.002499992124), y=(3.262441017e-11, 1, 1.306795402e-08)), Plane(origin=(2079.035208, 76.22299993, 121.084681), x=(0.999996875, 0, -0.002499992124), y=(3.262441017e-11, 1, 1.306795402e-08)), Plane(origin=(1975.99653, 76.22299993, 121.3422777), x=(0.999996875, 0, -0.002499992124), y=(3.262441017e-11, 1, 1.306795402e-08)), Plane(origin=(1975.99653, 76.22299993, 121.3422777), x=(0.999996875, 0, -0.002499992124), y=(3.262441017e-11, 1, 1.306795402e-08)), Plane(origin=(1977.231138, 76.223, 121.1842682), x=(0.968394977, 3.227808517e-09, -0.249421668), y=(-3.119806952e-09, 1, 8.283287383e-10))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]))  # disabled
plane_19 = Plane(flatten([PlaneXY(2246.995683, 247.902, 170.6650014), Plane(origin=(2246.995683, 247.902, 120.6650014), x=(0.999996875, 0, -0.002499992217), y=(-2.182339685e-11, 1, -8.735521913e-09)), Plane(origin=(2246.995683, 247.902, 120.6650014), x=(0.999996875, 0, -0.002499992217), y=(-2.182339685e-11, 1, -8.735521913e-09)), Plane(origin=(2102.993133, 247.902, 121.0250078), x=(0.999996875, 0, -0.002499992217), y=(-2.182339685e-11, 1, -8.735521913e-09)), Plane(origin=(2102.993133, 247.902, 121.0250078), x=(0.999996875, 0, -0.002499992217), y=(-2.182339685e-11, 1, -8.735521913e-09)), Plane(origin=(2105.753188, 247.902, 120.1859054), x=(0.8321764041, 0, -0.5545109849), y=(-1.198417527e-11, 1, -1.8467183e-11))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]))  # disabled
plane_20 = Plane(flatten([PlaneXY(1958.996584, 249.902, 171.3851338), Plane(origin=(1958.996584, 249.902, 121.3851338), x=(0.999996875, 0, -0.002499992217), y=(-2.191400589e-11, 1, -8.735549942e-09)), Plane(origin=(1958.996584, 249.902, 121.3851338), x=(0.999996875, 0, -0.002499992217), y=(-2.191400589e-11, 1, -8.735549942e-09)), Plane(origin=(1814.994034, 249.902, 121.7451402), x=(0.999996875, 0, -0.002499992217), y=(-2.191400589e-11, 1, -8.735549942e-09)), Plane(origin=(1814.994034, 249.902, 121.7451402), x=(0.999996875, 0, -0.002499992217), y=(-2.191400589e-11, 1, -8.735549942e-09)), Plane(origin=(1817.754089, 249.902, 120.9060378), x=(0.8321764041, 0, -0.5545109849), y=(-1.203747501e-11, 1, -1.846645533e-11))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]))  # disabled
plane_21 = Plane(flatten([PlaneXY(2371.992293, 349.6109999, 170.3525099), Plane(origin=(2371.992293, 349.6109999, 120.3525099), x=(0.999996875, 0, -0.002499992124), y=(3.262440906e-11, 1, 1.306795357e-08)), Plane(origin=(2371.992293, 349.6109999, 120.3525099), x=(0.999996875, 0, -0.002499992124), y=(3.262440906e-11, 1, 1.306795357e-08)), Plane(origin=(2268.953615, 349.6109999, 120.6101066), x=(0.999996875, 0, -0.002499992124), y=(3.262440906e-11, 1, 1.306795357e-08)), Plane(origin=(2268.953615, 349.6109999, 120.6101066), x=(0.999996875, 0, -0.002499992124), y=(3.262440906e-11, 1, 1.306795357e-08)), Plane(origin=(2270.188223, 349.611, 120.4520971), x=(0.968394977, 3.227799736e-09, -0.249421668), y=(-3.119800186e-09, 1, 8.283198043e-10))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]))  # disabled
plane_22 = Plane(flatten([PlaneXY(2079.035206, 349.6109999, 171.0841093), Plane(origin=(2079.035206, 349.6109999, 121.0841093), x=(0.999996875, 0, -0.002499992124), y=(3.262438727e-11, 1, 1.306794486e-08)), Plane(origin=(2079.035206, 349.6109999, 121.0841093), x=(0.999996875, 0, -0.002499992124), y=(3.262438727e-11, 1, 1.306794486e-08)), Plane(origin=(1975.996528, 349.6109999, 121.341706), x=(0.999996875, 0, -0.002499992124), y=(3.262438727e-11, 1, 1.306794486e-08)), Plane(origin=(1975.996528, 349.6109999, 121.341706), x=(0.999996875, 0, -0.002499992124), y=(3.262438727e-11, 1, 1.306794486e-08)), Plane(origin=(1977.231137, 349.611, 121.1836965), x=(0.968394977, 3.227808517e-09, -0.249421668), y=(-3.119805795e-09, 1, 8.283332315e-10))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]))  # disabled
plane_23 = Plane(flatten([PlaneXY(2246.997683, 435.451, 170.6649964), Plane(origin=(2246.997683, 435.451, 120.6649964), x=(0.999996875, 0, -0.002499992217), y=(-2.172728861e-11, 1, -8.735514659e-09)), Plane(origin=(2246.997683, 435.451, 120.6649964), x=(0.999996875, 0, -0.002499992217), y=(-2.172728861e-11, 1, -8.735514659e-09)), Plane(origin=(2102.995133, 435.451, 121.0250028), x=(0.999996875, 0, -0.002499992217), y=(-2.172728861e-11, 1, -8.735514659e-09)), Plane(origin=(2102.995133, 435.451, 121.0250028), x=(0.999996875, 0, -0.002499992217), y=(-2.172728861e-11, 1, -8.735514659e-09)), Plane(origin=(2105.755188, 435.451, 120.1859004), x=(0.8321764041, 0, -0.5545109849), y=(-1.191498062e-11, 1, -1.851429347e-11))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]))  # disabled
# Section 2
plane_24 = Plane(flatten([PlaneXY(1958.996583, 435.451, 171.3849988), Plane(origin=(1958.996583, 435.451, 121.3849988), x=(0.999996875, 0, -0.002499992217), y=(-2.191756803e-11, 1, -8.735509299e-09)), Plane(origin=(1958.996583, 435.451, 121.3849988), x=(0.999996875, 0, -0.002499992217), y=(-2.191756803e-11, 1, -8.735509299e-09)), Plane(origin=(1814.994033, 435.451, 121.7450052), x=(0.999996875, 0, -0.002499992217), y=(-2.191756803e-11, 1, -8.735509299e-09)), Plane(origin=(1814.994033, 435.451, 121.7450052), x=(0.999996875, 0, -0.002499992217), y=(-2.191756803e-11, 1, -8.735509299e-09)), Plane(origin=(1817.754088, 435.451, 120.9059028), x=(0.8321764041, 0, -0.5545109849), y=(-1.202159138e-11, 1, -1.843776102e-11))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]))  # disabled
merge_2 = Merge(
    Data1=plane_13,
    Data2=plane_14,
    Data3=plane_15,
    Data4=plane_16,
    Data5=plane_17,
    Data6=plane_18,
    Data7=plane_19,
    Data8=plane_20,
    Data9=plane_21,
    Data10=plane_22,
    Data11=plane_23,
    Data12=plane_24)  # disabled

# ----
# Sheet 1: rad ccw & tan in
rotation_remap_domain_start = Slider(-60, range=-180..180)  # disabled
rotation_remap_domain_end = Slider(0, range=-180..180)  # disabled
plane_25 = Plane(flatten([PlaneXY(2123.019879, -723.7104633, 195.5781194), Plane(origin=(2123.019879, -723.7104633, 145.5781194), x=(0.9999994104, -0.0002106696172, -0.001065236045), y=(0, 0.980999488, -0.1940103206)), Plane(origin=(2122.998162, -727.5906674, 125.9581412), x=(0.9999994104, -0.0002106696172, -0.001065236045), y=(0, 0.980999488, -0.1940103206)), Plane(origin=(2376.998006, -727.5903577, 125.6769274), x=(0.9999994104, -0.0002106696172, -0.001065236045), y=(0, 0.980999488, -0.1940103206)), Plane(origin=(2376.996386, -720.2328613, 124.2218517), x=(0.9999994104, -0.0002106696172, -0.001065236045), y=(0, 0.980999488, -0.1940103206)), Plane(origin=(2122.996542, -720.233171, 124.5030655), x=(0.9999994104, -0.0002106696172, -0.001065236045), y=(0, 0.980999488, -0.1940103206))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]))  # disabled
plane_26 = Plane(flatten([PlaneXY(1838.020054, -723.7108107, 195.8936545), Plane(origin=(1838.020054, -723.7108107, 145.8936545), x=(0.9999994104, -0.0002106696172, -0.001065236045), y=(0, 0.980999488, -0.1940103206)), Plane(origin=(1837.998336, -727.5910149, 126.2736763), x=(0.9999994104, -0.0002106696172, -0.001065236045), y=(0, 0.980999488, -0.1940103206)), Plane(origin=(2091.998181, -727.5907052, 125.9924625), x=(0.9999994104, -0.0002106696172, -0.001065236045), y=(0, 0.980999488, -0.1940103206)), Plane(origin=(2091.996561, -720.2332088, 124.5373869), x=(0.9999994104, -0.0002106696172, -0.001065236045), y=(0, 0.980999488, -0.1940103206)), Plane(origin=(1837.996716, -720.2335184, 124.8186007), x=(0.9999994104, -0.0002106696172, -0.001065236045), y=(0, 0.980999488, -0.1940103206))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]))  # disabled
plane_27 = Plane(flatten([PlaneXY(2064.019916, -64.73888255, 196.3694405), Plane(origin=(2064.019916, -64.73888255, 146.3694405), x=(0.9999994104, 0.0002130150779, -0.001064769504), y=(0, 0.9805698397, 0.1961703073)), Plane(origin=(2063.998198, -60.81547872, 126.7580552), x=(0.9999994104, 0.0002130150779, -0.001064769504), y=(0, 0.9805698397, 0.1961703073)), Plane(origin=(1809.998354, -60.81578838, 127.039269), x=(0.9999994104, 0.0002130150779, -0.001064769504), y=(0, 0.9805698397, 0.1961703073)), Plane(origin=(1809.996734, -68.17006243, 125.5679934), x=(0.9999994104, 0.0002130150779, -0.001064769504), y=(0, 0.9805698397, 0.1961703073)), Plane(origin=(2063.996578, -68.16975277, 125.2867797), x=(0.9999994104, 0.0002130150779, -0.001064769504), y=(0, 0.9805698397, 0.1961703073))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]))  # disabled
plane_28 = Plane(flatten([PlaneXY(2352.019739, -64.73853127, 196.0502123), Plane(origin=(2352.019739, -64.73853127, 146.0502123), x=(0.9999994104, 0.0002130150779, -0.001064769504), y=(0, 0.9805698397, 0.1961703073)), Plane(origin=(2351.998021, -60.81512744, 126.4388271), x=(0.9999994104, 0.0002130150779, -0.001064769504), y=(0, 0.9805698397, 0.1961703073)), Plane(origin=(2097.998177, -60.8154371, 126.7200409), x=(0.9999994104, 0.0002130150779, -0.001064769504), y=(0, 0.9805698397, 0.1961703073)), Plane(origin=(2097.996557, -68.16971115, 125.2487653), x=(0.9999994104, 0.0002130150779, -0.001064769504), y=(0, 0.9805698397, 0.1961703073)), Plane(origin=(2351.996401, -68.16940149, 124.9675515), x=(0.9999994104, 0.0002130150779, -0.001064769504), y=(0, 0.9805698397, 0.1961703073))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]))  # disabled
plane_29 = Plane(flatten([PlaneXY(1964.996291, 435.4545289, 174.7236773), Plane(origin=(1964.996291, 435.4545289, 124.7236773), x=(0.9999993871, 1.219130819e-06, -0.001107140863), y=(-9.104166986e-12, 0.9999993937, 0.001101143511)), Plane(origin=(1964.996291, 435.4545289, 124.7236773), x=(0.9999993871, 1.219130819e-06, -0.001107140863), y=(-9.104166986e-12, 0.9999993937, 0.001101143511)), Plane(origin=(1814.994383, 435.4545289, 124.8897508), x=(0.9999993871, 1.219130819e-06, -0.001107140863), y=(-9.104166986e-12, 0.9999993937, 0.001101143511)), Plane(origin=(1814.994383, 435.4545289, 124.8897508), x=(0.9999993871, 1.219130819e-06, -0.001107140863), y=(-9.104166986e-12, 0.9999993937, 0.001101143511)), Plane(origin=(1816.927238, 435.4551703, 124.3050712), x=(0.832947949, 0.0006097713197, -0.553351012), y=(0, 0.9999993928, 0.001101960485))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]))  # disabled
plane_30 = Plane(flatten([PlaneXY(1964.996065, 249.9056412, 174.5194949), Plane(origin=(1964.996065, 249.9056412, 124.5194949), x=(0.9999993871, 1.219130819e-06, -0.001107140863), y=(-9.104166986e-12, 0.9999993937, 0.001101143511)), Plane(origin=(1964.996065, 249.9056412, 124.5194949), x=(0.9999993871, 1.219130819e-06, -0.001107140863), y=(-9.104166986e-12, 0.9999993937, 0.001101143511)), Plane(origin=(1814.995157, 249.9056412, 124.6855674), x=(0.9999993871, 1.219130819e-06, -0.001107140863), y=(-9.104166986e-12, 0.9999993937, 0.001101143511)), Plane(origin=(1814.995157, 249.9056412, 124.6855674), x=(0.9999993871, 1.219130819e-06, -0.001107140863), y=(-9.104166986e-12, 0.9999993937, 0.001101143511)), Plane(origin=(1816.928012, 249.9062827, 124.1008877), x=(0.832947949, 0.0006097713197, -0.553351012), y=(0, 0.9999993928, 0.001101960485))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]))  # disabled
plane_31 = Plane(flatten([PlaneXY(2252.995886, 247.9066426, 174.1983021), Plane(origin=(2252.995886, 247.9066426, 124.1983021), x=(0.9999993871, 1.219130819e-06, -0.001107140863), y=(-9.104166984e-12, 0.9999993937, 0.001101143511)), Plane(origin=(2252.995886, 247.9066426, 124.1983021), x=(0.9999993871, 1.219130819e-06, -0.001107140863), y=(-9.104166984e-12, 0.9999993937, 0.001101143511)), Plane(origin=(2102.994978, 247.9056426, 124.3643735), x=(0.9999993871, 1.219130819e-06, -0.001107140863), y=(-9.104166984e-12, 0.9999993937, 0.001101143511)), Plane(origin=(2102.994978, 247.9056426, 124.3643735), x=(0.9999993871, 1.219130819e-06, -0.001107140863), y=(-9.104166984e-12, 0.9999993937, 0.001101143511)), Plane(origin=(2104.927833, 247.906284, 123.7796938), x=(0.832947949, 0.0006097713197, -0.553351012), y=(0, 0.9999993928, 0.001101960485))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]))  # disabled
plane_32 = Plane(flatten([PlaneXY(2252.998115, 435.4545289, 174.4048185), Plane(origin=(2252.998115, 435.4545289, 124.4048185), x=(0.9999993871, 1.219130819e-06, -0.001107140863), y=(-9.104166986e-12, 0.9999993937, 0.001101143511)), Plane(origin=(2252.998115, 435.4545289, 124.4048185), x=(0.9999993871, 1.219130819e-06, -0.001107140863), y=(-9.104166986e-12, 0.9999993937, 0.001101143511)), Plane(origin=(2102.998207, 435.4545289, 124.5708898), x=(0.9999993871, 1.219130819e-06, -0.001107140863), y=(-9.104166986e-12, 0.9999993937, 0.001101143511)), Plane(origin=(2102.998207, 435.4545289, 124.5708898), x=(0.9999993871, 1.219130819e-06, -0.001107140863), y=(-9.104166986e-12, 0.9999993937, 0.001101143511)), Plane(origin=(2104.931061, 435.4552043, 123.9862102), x=(0.832947949, 0.0006033157994, -0.553351019), y=(0, 0.9999994056, 0.001090294262))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]))  # disabled
plane_33 = Plane(flatten([PlaneXY(2079.036783, 76.22674694, 174.2016323), Plane(origin=(2079.036783, 76.22674694, 124.2016323), x=(0.9999993871, 1.21913077e-06, -0.001107140879), y=(-9.247062887e-12, 0.9999993937, 0.001101143321)), Plane(origin=(2079.036783, 76.22674694, 124.2016323), x=(0.9999993871, 1.21913077e-06, -0.001107140879), y=(-9.247062887e-12, 0.9999993937, 0.001101143321)), Plane(origin=(1981.157843, 76.22674694, 124.3099983), x=(0.9999993871, 1.21913077e-06, -0.001107140879), y=(-9.247062887e-12, 0.9999993937, 0.001101143321)), Plane(origin=(1981.157843, 76.22674694, 124.3099983), x=(0.9999993871, 1.21913077e-06, -0.001107140879), y=(-9.247062887e-12, 0.9999993937, 0.001101143321)), Plane(origin=(1982.022222, 76.22686632, 124.2005956), x=(0.9687414447, 0.0002732427115, -0.2480724463), y=(0, 0.9999993934, 0.001101462697))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]))  # disabled
plane_34 = Plane(flatten([PlaneXY(2079.037116, 349.6145818, 174.5021019), Plane(origin=(2079.037116, 349.6145818, 124.5021019), x=(0.9999993871, 1.21913077e-06, -0.001107140879), y=(-9.247062888e-12, 0.9999993937, 0.001101143321)), Plane(origin=(2079.037116, 349.6145818, 124.5021019), x=(0.9999993871, 1.21913077e-06, -0.001107140879), y=(-9.247062888e-12, 0.9999993937, 0.001101143321)), Plane(origin=(1981.158176, 349.6145818, 124.6104679), x=(0.9999993871, 1.21913077e-06, -0.001107140879), y=(-9.247062888e-12, 0.9999993937, 0.001101143321)), Plane(origin=(1981.158176, 349.6145818, 124.6104679), x=(0.9999993871, 1.21913077e-06, -0.001107140879), y=(-9.247062888e-12, 0.9999993937, 0.001101143321)), Plane(origin=(1982.022555, 349.6147046, 124.5010652), x=(0.9687414447, 0.0002729960121, -0.2480724466), y=(0, 0.9999993945, 0.001100468232))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]))  # disabled
plane_35 = Plane(flatten([PlaneXY(2371.994604, 76.22674669, 173.8775078), Plane(origin=(2371.994604, 76.22674669, 123.8775078), x=(0.9999993871, 1.21913077e-06, -0.001107140879), y=(-9.247062888e-12, 0.9999993937, 0.001101143321)), Plane(origin=(2371.994604, 76.22674669, 123.8775078), x=(0.9999993871, 1.21913077e-06, -0.001107140879), y=(-9.247062888e-12, 0.9999993937, 0.001101143321)), Plane(origin=(2274.115664, 76.22674669, 123.9858738), x=(0.9999993871, 1.21913077e-06, -0.001107140879), y=(-9.247062888e-12, 0.9999993937, 0.001101143321)), Plane(origin=(2274.115664, 76.22674669, 123.9858738), x=(0.9999993871, 1.21913077e-06, -0.001107140879), y=(-9.247062888e-12, 0.9999993937, 0.001101143321)), Plane(origin=(2274.980043, 76.22686945, 123.8764711), x=(0.9687414447, 0.0002729960121, -0.2480724466), y=(0, 0.9999993945, 0.001100468232))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]))  # disabled
# Section 3
plane_36 = Plane(flatten([PlaneXY(2371.994937, 349.6155809, 174.1785502), Plane(origin=(2371.994937, 349.6155809, 124.1785502), x=(0.9999993871, 1.21913077e-06, -0.001107140879), y=(-9.247062887e-12, 0.9999993937, 0.001101143321)), Plane(origin=(2371.994937, 349.6155809, 124.1785502), x=(0.9999993871, 1.21913077e-06, -0.001107140879), y=(-9.247062887e-12, 0.9999993937, 0.001101143321)), Plane(origin=(2274.114997, 349.6155809, 124.2869173), x=(0.9999993871, 1.21913077e-06, -0.001107140879), y=(-9.247062887e-12, 0.9999993937, 0.001101143321)), Plane(origin=(2274.114997, 349.6155809, 124.2869173), x=(0.9999993871, 1.21913077e-06, -0.001107140879), y=(-9.247062887e-12, 0.9999993937, 0.001101143321)), Plane(origin=(2274.979376, 349.6157003, 124.1775146), x=(0.9687414447, 0.0002732427115, -0.2480724463), y=(0, 0.9999993934, 0.001101462697))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]))  # disabled
merge_3 = Merge(
    Data1=plane_25,
    Data2=plane_26,
    Data3=plane_27,
    Data4=plane_28,
    Data5=plane_29,
    Data6=plane_30,
    Data7=plane_31,
    Data8=plane_32,
    Data9=plane_33,
    Data10=plane_34,
    Data11=plane_35,
    Data12=plane_36)  # disabled

# ----
# Sheet 1: rad ccw & tan in
# Section 4
plane_37 = Plane(flatten([PlaneXY(2087.617778, 76.22674694, 174.1921319), Plane(origin=(2087.617778, 76.22674694, 124.1921319), x=(0.9999993871, 1.219130751e-06, -0.001107140877), y=(-9.230286805e-12, 0.9999993937, 0.001101143321)), Plane(origin=(2087.617778, 76.22674694, 124.1921319), x=(0.9999993871, 1.219130751e-06, -0.001107140877), y=(-9.230286805e-12, 0.9999993937, 0.001101143321)), Plane(origin=(1984.578841, 76.22674694, 124.3062108), x=(0.9999993871, 1.219130751e-06, -0.001107140877), y=(-9.230286805e-12, 0.9999993937, 0.001101143321)), Plane(origin=(1984.578841, 76.22674694, 124.3062108), x=(0.9999993871, 1.219130751e-06, -0.001107140877), y=(-9.230286805e-12, 0.9999993937, 0.001101143321)), Plane(origin=(1985.44322, 76.22686969, 124.196808), x=(0.9687414447, 0.0002729960112, -0.2480724466), y=(0, 0.9999993945, 0.001100468228))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]))  # disabled
rotation_remap_domain_start_2 = Slider(-60, range=-180..180)  # disabled
rotation_remap_domain_end_2 = Slider(0, range=-180..180)  # disabled
plane_38 = Plane(flatten([PlaneXY(2129.157662, -723.7104565, 195.5713298), Plane(origin=(2129.157662, -723.7104565, 145.5713298), x=(0.9999994104, -0.0002106695974, -0.001065236053), y=(0, 0.9809994918, -0.1940103016)), Plane(origin=(2129.135944, -727.5906603, 125.9513516), x=(0.9999994104, -0.0002106695974, -0.001065236053), y=(0, 0.9809994918, -0.1940103016)), Plane(origin=(2376.998006, -727.5903581, 125.6769332), x=(0.9999994104, -0.0002106695974, -0.001065236053), y=(0, 0.9809994918, -0.1940103016)), Plane(origin=(2376.996386, -720.2328617, 124.2218577), x=(0.9999994104, -0.0002106695974, -0.001065236053), y=(0, 0.9809994918, -0.1940103016)), Plane(origin=(2129.134324, -720.2331639, 124.4962761), x=(0.9999994104, -0.0002106695974, -0.001065236053), y=(0, 0.9809994918, -0.1940103016))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]))  # disabled
plane_39 = Plane(flatten([PlaneXY(1844.157836, -723.710804, 195.886865), Plane(origin=(1844.157836, -723.710804, 145.886865), x=(0.9999994104, -0.0002106695974, -0.001065236053), y=(0, 0.9809994918, -0.1940103016)), Plane(origin=(1844.136119, -727.5910077, 126.2668867), x=(0.9999994104, -0.0002106695974, -0.001065236053), y=(0, 0.9809994918, -0.1940103016)), Plane(origin=(2091.998181, -727.5907056, 125.9924683), x=(0.9999994104, -0.0002106695974, -0.001065236053), y=(0, 0.9809994918, -0.1940103016)), Plane(origin=(2091.996561, -720.2332091, 124.5373928), x=(0.9999994104, -0.0002106695974, -0.001065236053), y=(0, 0.9809994918, -0.1940103016)), Plane(origin=(1844.134499, -720.2335113, 124.8118112), x=(0.9999994104, -0.0002106695974, -0.001065236053), y=(0, 0.9809994918, -0.1940103016))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]))  # disabled
plane_40 = Plane(flatten([PlaneXY(2057.882133, -64.73888951, 196.3762182), Plane(origin=(2057.882133, -64.73888951, 146.3762182), x=(0.9999994104, 0.000213015058, -0.001064769512), y=(0, 0.9805698435, 0.1961702883)), Plane(origin=(2057.860415, -60.81548606, 126.7648329), x=(0.9999994104, 0.000213015058, -0.001064769512), y=(0, 0.9805698435, 0.1961702883)), Plane(origin=(1809.998354, -60.81578823, 127.0392512), x=(0.9999994104, 0.000213015058, -0.001064769512), y=(0, 0.9805698435, 0.1961702883)), Plane(origin=(1809.996734, -68.1700623, 125.5679758), x=(0.9999994104, 0.000213015058, -0.001064769512), y=(0, 0.9805698435, 0.1961702883)), Plane(origin=(2057.858796, -68.16976013, 125.2935574), x=(0.9999994104, 0.000213015058, -0.001064769512), y=(0, 0.9805698435, 0.1961702883))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]))  # disabled
plane_41 = Plane(flatten([PlaneXY(2345.881956, -64.73853799, 196.05699), Plane(origin=(2345.881956, -64.73853799, 146.05699), x=(0.9999994104, 0.000213015058, -0.001064769512), y=(0, 0.9805698435, 0.1961702883)), Plane(origin=(2345.860239, -60.81513454, 126.4456047), x=(0.9999994104, 0.000213015058, -0.001064769512), y=(0, 0.9805698435, 0.1961702883)), Plane(origin=(2097.998177, -60.81543671, 126.7200231), x=(0.9999994104, 0.000213015058, -0.001064769512), y=(0, 0.9805698435, 0.1961702883)), Plane(origin=(2097.996557, -68.16971079, 125.2487477), x=(0.9999994104, 0.000213015058, -0.001064769512), y=(0, 0.9805698435, 0.1961702883)), Plane(origin=(2345.858619, -68.16940861, 124.9743293), x=(0.9999994104, 0.000213015058, -0.001064769512), y=(0, 0.9805698435, 0.1961702883))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]))  # disabled
plane_42 = Plane(flatten([PlaneXY(1970.995061, 249.9056412, 174.5128532), Plane(origin=(1970.995061, 249.9056412, 124.5128532), x=(0.9999993871, 1.219130746e-06, -0.001107140836), y=(0, 0.9999993937, 0.001101151931)), Plane(origin=(1970.995061, 249.9056412, 124.5128532), x=(0.9999993871, 1.219130746e-06, -0.001107140836), y=(0, 0.9999993937, 0.001101151931)), Plane(origin=(1970.995269, 420.4545378, 124.7006533), x=(0.9999993871, 1.219130746e-06, -0.001107140836), y=(0, 0.9999993937, 0.001101151931)), Plane(origin=(1970.995269, 420.4545378, 124.7006533), x=(0.9999993871, 1.219130746e-06, -0.001107140836), y=(0, 0.9999993937, 0.001101151931)), Plane(origin=(1970.995269, 420.4545378, 124.7006533), x=(0.9999993871, 1.219130782e-06, -0.001107140861), y=(-9.068535888e-12, 0.9999993937, 0.00110114351))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]))  # disabled
plane_43 = Plane(flatten([PlaneXY(1970.994287, 435.4545289, 174.7170366), Plane(origin=(1970.994287, 435.4545289, 124.7170366), x=(0.9999993871, 1.219130746e-06, -0.001107140836), y=(0, 0.9999993937, 0.001101151931)), Plane(origin=(1970.994287, 435.4545289, 124.7170366), x=(0.9999993871, 1.219130746e-06, -0.001107140836), y=(0, 0.9999993937, 0.001101151931)), Plane(origin=(1970.994495, 606.0034255, 124.9048368), x=(0.9999993871, 1.219130746e-06, -0.001107140836), y=(0, 0.9999993937, 0.001101151931)), Plane(origin=(1970.994495, 606.0034255, 124.9048368), x=(0.9999993871, 1.219130746e-06, -0.001107140836), y=(0, 0.9999993937, 0.001101151931)), Plane(origin=(1970.994495, 606.0034255, 124.9048368), x=(0.9999993871, 1.219130782e-06, -0.001107140861), y=(-9.068535888e-12, 0.9999993937, 0.00110114351))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]))  # disabled
plane_44 = Plane(flatten([PlaneXY(2258.994882, 247.9066426, 174.1916604), Plane(origin=(2258.994882, 247.9066426, 124.1916604), x=(0.9999993871, 1.219130765e-06, -0.001107140836), y=(0, 0.9999993937, 0.001101151931)), Plane(origin=(2258.994882, 247.9066426, 124.1916604), x=(0.9999993871, 1.219130765e-06, -0.001107140836), y=(0, 0.9999993937, 0.001101151931)), Plane(origin=(2258.99509, 418.4545392, 124.3794594), x=(0.9999993871, 1.219130765e-06, -0.001107140836), y=(0, 0.9999993937, 0.001101151931)), Plane(origin=(2258.99509, 418.4545392, 124.3794594), x=(0.9999993871, 1.219130765e-06, -0.001107140836), y=(0, 0.9999993937, 0.001101151931)), Plane(origin=(2258.99509, 418.4545392, 124.3794594), x=(0.9999993871, 1.219130782e-06, -0.001107140861), y=(-9.068535888e-12, 0.9999993937, 0.00110114351))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]))  # disabled
plane_45 = Plane(flatten([PlaneXY(2258.998111, 435.4545289, 174.3981756), Plane(origin=(2258.998111, 435.4545289, 124.3981756), x=(0.9999993871, 1.219130765e-06, -0.001107140836), y=(0, 0.9999993937, 0.001101151931)), Plane(origin=(2258.998111, 435.4545289, 124.3981756), x=(0.9999993871, 1.219130765e-06, -0.001107140836), y=(0, 0.9999993937, 0.001101151931)), Plane(origin=(2258.996319, 606.0034255, 124.585978), x=(0.9999993871, 1.219130765e-06, -0.001107140836), y=(0, 0.9999993937, 0.001101151931)), Plane(origin=(2258.996319, 606.0034255, 124.585978), x=(0.9999993871, 1.219130765e-06, -0.001107140836), y=(0, 0.9999993937, 0.001101151931)), Plane(origin=(2258.996319, 606.0034255, 124.585978), x=(0.9999993871, 1.219130782e-06, -0.001107140861), y=(-9.068535888e-12, 0.9999993937, 0.00110114351))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]))  # disabled
plane_46 = Plane(flatten([PlaneXY(2371.994604, 76.22674669, 173.8775078), Plane(origin=(2371.994604, 76.22674669, 123.8775078), x=(0.9999993871, 1.219130751e-06, -0.001107140877), y=(-9.230286805e-12, 0.9999993937, 0.001101143321)), Plane(origin=(2371.994604, 76.22674669, 123.8775078), x=(0.9999993871, 1.219130751e-06, -0.001107140877), y=(-9.230286805e-12, 0.9999993937, 0.001101143321)), Plane(origin=(2268.955667, 76.22674669, 123.9915867), x=(0.9999993871, 1.219130751e-06, -0.001107140877), y=(-9.230286805e-12, 0.9999993937, 0.001101143321)), Plane(origin=(2268.955667, 76.22674669, 123.9915867), x=(0.9999993871, 1.219130751e-06, -0.001107140877), y=(-9.230286805e-12, 0.9999993937, 0.001101143321)), Plane(origin=(2269.820046, 76.22686945, 123.8821839), x=(0.9687414447, 0.0002729960121, -0.2480724466), y=(0, 0.9999993945, 0.001100468232))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]))  # disabled
plane_47 = Plane(flatten([PlaneXY(2371.994937, 349.6155809, 174.1785502), Plane(origin=(2371.994937, 349.6155809, 124.1785502), x=(0.9999993871, 1.219130751e-06, -0.001107140877), y=(-9.230286804e-12, 0.9999993937, 0.001101143321)), Plane(origin=(2371.994937, 349.6155809, 124.1785502), x=(0.9999993871, 1.219130751e-06, -0.001107140877), y=(-9.230286804e-12, 0.9999993937, 0.001101143321)), Plane(origin=(2268.955, 349.6155809, 124.2926302), x=(0.9999993871, 1.219130751e-06, -0.001107140877), y=(-9.230286804e-12, 0.9999993937, 0.001101143321)), Plane(origin=(2268.955, 349.6155809, 124.2926302), x=(0.9999993871, 1.219130751e-06, -0.001107140877), y=(-9.230286804e-12, 0.9999993937, 0.001101143321)), Plane(origin=(2269.819379, 349.6157003, 124.1832274), x=(0.9687414447, 0.0002732427115, -0.2480724463), y=(0, 0.9999993934, 0.001101462697))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]))  # disabled
plane_48 = Plane(flatten([PlaneXY(2087.61711, 349.6145818, 174.4926027), Plane(origin=(2087.61711, 349.6145818, 124.4926027), x=(0.9999993871, 1.219130751e-06, -0.001107140877), y=(-9.230286805e-12, 0.9999993937, 0.001101143321)), Plane(origin=(2087.61711, 349.6145818, 124.4926027), x=(0.9999993871, 1.219130751e-06, -0.001107140877), y=(-9.230286805e-12, 0.9999993937, 0.001101143321)), Plane(origin=(1984.578174, 349.6145818, 124.6066815), x=(0.9999993871, 1.219130751e-06, -0.001107140877), y=(-9.230286805e-12, 0.9999993937, 0.001101143321)), Plane(origin=(1984.578174, 349.6145818, 124.6066815), x=(0.9999993871, 1.219130751e-06, -0.001107140877), y=(-9.230286805e-12, 0.9999993937, 0.001101143321)), Plane(origin=(1985.442553, 349.6147012, 124.4972788), x=(0.9687414447, 0.0002732427115, -0.2480724463), y=(0, 0.9999993934, 0.001101462697))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]))  # disabled
merge_4 = Merge(
    Data1=plane_38,
    Data2=plane_39,
    Data3=plane_40,
    Data4=plane_41,
    Data5=plane_42,
    Data6=plane_43,
    Data7=plane_44,
    Data8=plane_45,
    Data9=plane_46,
    Data10=plane_47,
    Data11=plane_48,
    Data12=plane_37)  # disabled

# ----
# Sheet 1: rad ccw & tan in
plane_49 = Plane(flatten([PlaneXY(2136.030955, -734.8053496, 195.5514717), Plane(origin=(2136.030955, -734.8053496, 145.5514717), x=(0.9999994104, -0.0002106696119, -0.001065236047), y=(0, 0.980999489, -0.1940103155)), Plane(origin=(2136.009238, -738.6855536, 125.9314935), x=(0.9999994104, -0.0002106696119, -0.001065236047), y=(0, 0.980999489, -0.1940103155)), Plane(origin=(2376.998006, -738.6852598, 125.6646849), x=(0.9999994104, -0.0002106696119, -0.001065236047), y=(0, 0.980999489, -0.1940103155)), Plane(origin=(2376.996386, -731.3277711, 124.2096108), x=(0.9999994104, -0.0002106696119, -0.001065236047), y=(0, 0.980999489, -0.1940103155)), Plane(origin=(2136.007618, -731.3280649, 124.4764194), x=(0.9999994104, -0.0002106696119, -0.001065236047), y=(0, 0.980999489, -0.1940103155))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]))  # disabled
plane_50 = Plane(flatten([PlaneXY(2339.008662, -78.61319236, 196.0493368), Plane(origin=(2339.008662, -78.61319236, 146.0493368), x=(0.9999994104, 0.0002130150725, -0.001064769506), y=(0, 0.9805698407, 0.1961703022)), Plane(origin=(2338.986945, -74.68978863, 126.4379515), x=(0.9999994104, 0.0002130150725, -0.001064769506), y=(0, 0.9805698407, 0.1961703022)), Plane(origin=(2097.998177, -74.69008242, 126.7047602), x=(0.9999994104, 0.0002130150725, -0.001064769506), y=(0, 0.9805698407, 0.1961703022)), Plane(origin=(2097.996557, -82.04434881, 125.2334862), x=(0.9999994104, 0.0002130150725, -0.001064769506), y=(0, 0.9805698407, 0.1961703022)), Plane(origin=(2338.985325, -82.04405501, 124.9666775), x=(0.9999994104, 0.0002130150725, -0.001064769506), y=(0, 0.9805698407, 0.1961703022))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]))  # disabled
plane_51 = Plane(flatten([PlaneXY(1851.03113, -734.805697, 195.8670069), Plane(origin=(1851.03113, -734.805697, 145.8670069), x=(0.9999994104, -0.0002106696119, -0.001065236047), y=(0, 0.980999489, -0.1940103155)), Plane(origin=(1851.009413, -738.6859011, 126.2470287), x=(0.9999994104, -0.0002106696119, -0.001065236047), y=(0, 0.980999489, -0.1940103155)), Plane(origin=(2091.998181, -738.6856073, 125.98022), x=(0.9999994104, -0.0002106696119, -0.001065236047), y=(0, 0.980999489, -0.1940103155)), Plane(origin=(2091.996561, -731.3281185, 124.5251459), x=(0.9999994104, -0.0002106696119, -0.001065236047), y=(0, 0.980999489, -0.1940103155)), Plane(origin=(1851.007793, -731.3284123, 124.7919546), x=(0.9999994104, -0.0002106696119, -0.001065236047), y=(0, 0.980999489, -0.1940103155))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]))  # disabled
plane_52 = Plane(flatten([PlaneXY(2051.008839, -78.61354388, 196.3685649), Plane(origin=(2051.008839, -78.61354388, 146.3685649), x=(0.9999994104, 0.0002130150725, -0.001064769506), y=(0, 0.9805698407, 0.1961703022)), Plane(origin=(2050.987122, -74.69014015, 126.7571796), x=(0.9999994104, 0.0002130150725, -0.001064769506), y=(0, 0.9805698407, 0.1961703022)), Plane(origin=(1809.998354, -74.69043394, 127.0239883), x=(0.9999994104, 0.0002130150725, -0.001064769506), y=(0, 0.9805698407, 0.1961703022)), Plane(origin=(1809.996734, -82.04470033, 125.5527143), x=(0.9999994104, 0.0002130150725, -0.001064769506), y=(0, 0.9805698407, 0.1961703022)), Plane(origin=(2050.985502, -82.04440653, 125.2859057), x=(0.9999994104, 0.0002130150725, -0.001064769506), y=(0, 0.9805698407, 0.1961703022))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]))  # disabled
plane_53 = Plane(flatten([PlaneXY(2082.457781, 76.22674698, 174.1978448), Plane(origin=(2082.457781, 76.22674698, 124.1978448), x=(0.9999993871, 1.21913055e-06, -0.001107140883), y=(-9.79183832e-12, 0.9999993937, 0.001101142626)), Plane(origin=(2082.457781, 76.22674698, 124.1978448), x=(0.9999993871, 1.21913055e-06, -0.001107140883), y=(-9.79183832e-12, 0.9999993937, 0.001101142626)), Plane(origin=(1984.578841, 76.22674698, 124.3062108), x=(0.9999993871, 1.21913055e-06, -0.001107140883), y=(-9.79183832e-12, 0.9999993937, 0.001101142626)), Plane(origin=(1984.578841, 76.22674698, 124.3062108), x=(0.9999993871, 1.21913055e-06, -0.001107140883), y=(-9.79183832e-12, 0.9999993937, 0.001101142626)), Plane(origin=(1985.44322, 76.22686973, 124.196808), x=(0.9687414447, 0.0002729959278, -0.2480724466), y=(0, 0.9999993945, 0.001100467893))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]))  # disabled
plane_54 = Plane(flatten([PlaneXY(2082.458114, 349.6145819, 174.4983144), Plane(origin=(2082.458114, 349.6145819, 124.4983144), x=(0.9999993871, 1.21913055e-06, -0.001107140883), y=(-9.79183832e-12, 0.9999993937, 0.001101142626)), Plane(origin=(2082.458114, 349.6145819, 124.4983144), x=(0.9999993871, 1.21913055e-06, -0.001107140883), y=(-9.79183832e-12, 0.9999993937, 0.001101142626)), Plane(origin=(1984.578174, 349.6145819, 124.6066815), x=(0.9999993871, 1.21913055e-06, -0.001107140883), y=(-9.79183832e-12, 0.9999993937, 0.001101142626)), Plane(origin=(1984.578174, 349.6145819, 124.6066815), x=(0.9999993871, 1.21913055e-06, -0.001107140883), y=(-9.79183832e-12, 0.9999993937, 0.001101142626)), Plane(origin=(1985.442553, 349.6147012, 124.4972788), x=(0.9687414447, 0.0002732426282, -0.2480724463), y=(0, 0.9999993934, 0.001101462361))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]))  # disabled
plane_55 = Plane(flatten([PlaneXY(2366.834607, 76.22674673, 173.8832207), Plane(origin=(2366.834607, 76.22674673, 123.8832207), x=(0.9999993871, 1.21913055e-06, -0.001107140883), y=(-9.79183832e-12, 0.9999993937, 0.001101142626)), Plane(origin=(2366.834607, 76.22674673, 123.8832207), x=(0.9999993871, 1.21913055e-06, -0.001107140883), y=(-9.79183832e-12, 0.9999993937, 0.001101142626)), Plane(origin=(2268.955667, 76.22674673, 123.9915867), x=(0.9999993871, 1.21913055e-06, -0.001107140883), y=(-9.79183832e-12, 0.9999993937, 0.001101142626)), Plane(origin=(2268.955667, 76.22674673, 123.9915867), x=(0.9999993871, 1.21913055e-06, -0.001107140883), y=(-9.79183832e-12, 0.9999993937, 0.001101142626)), Plane(origin=(2269.820046, 76.22686949, 123.8821839), x=(0.9687414447, 0.0002729959288, -0.2480724466), y=(0, 0.9999993945, 0.001100467896))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]))  # disabled
plane_56 = Plane(flatten([PlaneXY(2366.83494, 349.615581, 174.1842631), Plane(origin=(2366.83494, 349.615581, 124.1842631), x=(0.9999993871, 1.21913055e-06, -0.001107140883), y=(-9.79183832e-12, 0.9999993937, 0.001101142626)), Plane(origin=(2366.83494, 349.615581, 124.1842631), x=(0.9999993871, 1.21913055e-06, -0.001107140883), y=(-9.79183832e-12, 0.9999993937, 0.001101142626)), Plane(origin=(2268.955, 349.615581, 124.2926302), x=(0.9999993871, 1.21913055e-06, -0.001107140883), y=(-9.79183832e-12, 0.9999993937, 0.001101142626)), Plane(origin=(2268.955, 349.615581, 124.2926302), x=(0.9999993871, 1.21913055e-06, -0.001107140883), y=(-9.79183832e-12, 0.9999993937, 0.001101142626)), Plane(origin=(2269.819379, 349.6157004, 124.1832274), x=(0.9687414447, 0.0002732426282, -0.2480724463), y=(0, 0.9999993934, 0.001101462361))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]))  # disabled
plane_57 = Plane(flatten([PlaneXY(1964.996063, 249.9056401, 174.5194967), Plane(origin=(1964.996063, 249.9056401, 124.5194967), x=(0.9999993871, 1.219111113e-06, -0.001107123013), y=(4.906240147e-11, 0.9999993937, 0.001101196003)), Plane(origin=(1964.996063, 249.9056401, 124.5194967), x=(0.9999993871, 1.219111113e-06, -0.001107123013), y=(4.906240147e-11, 0.9999993937, 0.001101196003)), Plane(origin=(1814.995155, 249.9056401, 124.6855665), x=(0.9999993871, 1.219111113e-06, -0.001107123013), y=(4.906240147e-11, 0.9999993937, 0.001101196003)), Plane(origin=(1814.995155, 249.9056401, 124.6855665), x=(0.9999993871, 1.219111113e-06, -0.001107123013), y=(4.906240147e-11, 0.9999993937, 0.001101196003)), Plane(origin=(1816.92801, 249.9062817, 124.1008868), x=(0.832947949, 0.0006097757085, -0.553351012), y=(0, 0.9999993928, 0.001101968416))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]))  # disabled
plane_58 = Plane(flatten([PlaneXY(1964.996289, 435.4545278, 174.7236791), Plane(origin=(1964.996289, 435.4545278, 124.7236791), x=(0.9999993871, 1.219111113e-06, -0.001107123013), y=(4.906240147e-11, 0.9999993937, 0.001101196003)), Plane(origin=(1964.996289, 435.4545278, 124.7236791), x=(0.9999993871, 1.219111113e-06, -0.001107123013), y=(4.906240147e-11, 0.9999993937, 0.001101196003)), Plane(origin=(1814.994381, 435.4545278, 124.88975), x=(0.9999993871, 1.219111113e-06, -0.001107123013), y=(4.906240147e-11, 0.9999993937, 0.001101196003)), Plane(origin=(1814.994381, 435.4545278, 124.88975), x=(0.9999993871, 1.219111113e-06, -0.001107123013), y=(4.906240147e-11, 0.9999993937, 0.001101196003)), Plane(origin=(1816.927236, 435.4551694, 124.3050703), x=(0.832947949, 0.0006097757085, -0.553351012), y=(0, 0.9999993928, 0.001101968416))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]))  # disabled
plane_59 = Plane(flatten([PlaneXY(2252.995884, 247.9066415, 174.1983039), Plane(origin=(2252.995884, 247.9066415, 124.1983039), x=(0.9999993871, 1.219111113e-06, -0.001107123013), y=(4.906240146e-11, 0.9999993937, 0.001101196003)), Plane(origin=(2252.995884, 247.9066415, 124.1983039), x=(0.9999993871, 1.219111113e-06, -0.001107123013), y=(4.906240146e-11, 0.9999993937, 0.001101196003)), Plane(origin=(2102.994976, 247.9056415, 124.3643726), x=(0.9999993871, 1.219111113e-06, -0.001107123013), y=(4.906240146e-11, 0.9999993937, 0.001101196003)), Plane(origin=(2102.994976, 247.9056415, 124.3643726), x=(0.9999993871, 1.219111113e-06, -0.001107123013), y=(4.906240146e-11, 0.9999993937, 0.001101196003)), Plane(origin=(2104.92783, 247.9062831, 123.7796929), x=(0.832947949, 0.0006097757085, -0.553351012), y=(0, 0.9999993928, 0.001101968416))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]))  # disabled
# Screw patterns
plane_60 = Plane(flatten([PlaneXY(2252.998112, 435.4545278, 174.4048203), Plane(origin=(2252.998112, 435.4545278, 124.4048203), x=(0.9999993871, 1.219111113e-06, -0.001107123013), y=(4.906240147e-11, 0.9999993937, 0.001101196003)), Plane(origin=(2252.998112, 435.4545278, 124.4048203), x=(0.9999993871, 1.219111113e-06, -0.001107123013), y=(4.906240147e-11, 0.9999993937, 0.001101196003)), Plane(origin=(2102.998204, 435.4545278, 124.5708889), x=(0.9999993871, 1.219111113e-06, -0.001107123013), y=(4.906240147e-11, 0.9999993937, 0.001101196003)), Plane(origin=(2102.998204, 435.4545278, 124.5708889), x=(0.9999993871, 1.219111113e-06, -0.001107123013), y=(4.906240147e-11, 0.9999993937, 0.001101196003)), Plane(origin=(2104.931059, 435.455192, 123.9862093), x=(0.832947949, 0.0006054720281, -0.5533510167), y=(0, 0.9999994014, 0.001094190934))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]))  # disabled
merge_5 = Merge(
    Data1=plane_49,
    Data2=plane_50,
    Data3=plane_51,
    Data4=plane_52,
    Data5=plane_53,
    Data6=plane_54,
    Data7=plane_55,
    Data8=plane_56,
    Data9=plane_57,
    Data10=plane_58,
    Data11=plane_59,
    Data12=plane_60)  # disabled

# ----
# Sheet 1
number_slider = Slider(6, range=0..20)  # disabled
# Circle 2
# Section 1
number_slider_2 = Slider(18, range=0..200)  # disabled
geometry_3 = Geometry([<curve referenced from the Rhino model> x28])  # disabled
curve = Curve()  # disabled
cluster = Cluster_2(geometry=geometry_3, factor=number_slider, curve=curve)  # -> screw_location, result; disabled
text_tag_3d = TextTag3D(Location=graft(cluster.screw_location), Text=cluster.result, Size=number_slider_2, Justification=2)  # disabled

# ---- group: 2_radial geo
geometry_4 = Geometry([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])  # disabled

# ---- group: 1_radial stock
# Sheet 1: radial
geometry_5 = Geometry(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)  # disabled

# ---- group: 1_radial geo
geometry_6 = Geometry([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])  # disabled

# ---- group: 2_radial stock
# Section 2
# Sheet 1: radial
geometry_7 = Geometry(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)  # disabled

# ---- group: 3_radial stock
# Section 3
# Sheet 1: radial
geometry_8 = Geometry(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)  # disabled

# ---- group: 3_radial geo
geometry_9 = Geometry([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])  # disabled

# ---- group: 4_radial stock
# Section 4
# Sheet 1: radial
geometry_10 = Geometry(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)  # disabled

# ---- group: 4_radial geo
# Variable Groove Depth calculator
# Groove
# Nesting and orienting to robo
# Only for pieces with 2 orthogonal parallel edges, and 2 angled parallel edges
# Orthogonal Edges
# Nesting and orienting to robo
# Only for pieces with 2 orthogonal parallel edges, and 2 angled parallel edges
# Orthogonal Edges
# Angled Edges
# upper and lower contour method
# Angled Edges
geometry_11 = Geometry([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])  # disabled

# ---- group: 1_rad ccw & tan in stock
geometry_12 = Geometry(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)  # disabled

# ---- group: 1_rad ccw & tan in geo
geometry_13 = Geometry([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])  # disabled

# ---- group: 2_rad ccw & tan in stock
geometry_14 = Geometry(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)  # disabled

# ---- group: 3_rad ccw & tan in stock
geometry_15 = Geometry(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)  # disabled

# ---- group: 3_rad ccw & tan in geo
geometry_16 = Geometry([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])  # disabled

# ---- group: 2_rad ccw & tan in
geometry_17 = Geometry([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])  # disabled

# ---- group: 4_rad ccw & tan in stock
geometry_18 = Geometry(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)  # disabled

# ---- group: 4_rad ccw & tan in geo
geometry_19 = Geometry([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])  # disabled

# ----
# Circle 1
rotation_remap_domain_start_3 = Slider(-60, range=-180..180)  # disabled
rotation_remap_domain_end_3 = Slider(0, range=-180..180)  # disabled
rotation_remap_domain_start_4 = Slider(-60, range=-180..180)  # disabled
rotation_remap_domain_end_4 = Slider(0, range=-180..180)  # disabled

# ----
# Sheet 2: rad cw & tan out
plane_61 = Plane(flatten([PlaneXY(2376.019724, -78.59648469, 196.0083734), Plane(origin=(2376.019724, -78.59648469, 146.0083734), x=(0.9999994104, 0.0002130150927, -0.001064769498), y=(0, 0.9805698369, 0.1961703215)), Plane(origin=(2375.998007, -74.67308058, 126.3969882), x=(0.9999994104, 0.0002130150927, -0.001064769498), y=(0, 0.9805698369, 0.1961703215)), Plane(origin=(2135.009239, -74.67337437, 126.6637969), x=(0.9999994104, 0.0002130150927, -0.001064769498), y=(0, 0.9805698369, 0.1961703215)), Plane(origin=(2135.007619, -82.02764937, 125.192521), x=(0.9999994104, 0.0002130150927, -0.001064769498), y=(0, 0.9805698369, 0.1961703215)), Plane(origin=(2375.996387, -82.02735557, 124.9257124), x=(0.9999994104, 0.0002130150927, -0.001064769498), y=(0, 0.9805698369, 0.1961703215))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]))  # disabled
plane_62 = Plane(flatten([PlaneXY(2097.019895, -734.8053913, 195.5946833), Plane(origin=(2097.019895, -734.8053913, 145.5946833), x=(0.9999994104, -0.000210669632, -0.001065236039), y=(0, 0.9809994852, -0.1940103348)), Plane(origin=(2096.998178, -738.6855957, 125.9747052), x=(0.9999994104, -0.000210669632, -0.001065236039), y=(0, 0.9809994852, -0.1940103348)), Plane(origin=(2337.986946, -738.6853019, 125.7078965), x=(0.9999994104, -0.000210669632, -0.001065236039), y=(0, 0.9809994852, -0.1940103348)), Plane(origin=(2337.985326, -731.3278046, 124.2528206), x=(0.9999994104, -0.000210669632, -0.001065236039), y=(0, 0.9809994852, -0.1940103348)), Plane(origin=(2096.996558, -731.3280984, 124.5196292), x=(0.9999994104, -0.000210669632, -0.001065236039), y=(0, 0.9809994852, -0.1940103348))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]))  # disabled
plane_63 = Plane(flatten([PlaneXY(2090.019899, -77.49421186, 196.3262298), Plane(origin=(2090.019899, -77.49421186, 146.3262298), x=(0.9999994104, 0.0002130150927, -0.001064769498), y=(0, 0.9805698369, 0.1961703215)), Plane(origin=(2089.998182, -73.57080774, 126.7148447), x=(0.9999994104, 0.0002130150927, -0.001064769498), y=(0, 0.9805698369, 0.1961703215)), Plane(origin=(1849.009414, -73.57110154, 126.9816533), x=(0.9999994104, 0.0002130150927, -0.001064769498), y=(0, 0.9805698369, 0.1961703215)), Plane(origin=(1849.007794, -80.92537653, 125.5103775), x=(0.9999994104, 0.0002130150927, -0.001064769498), y=(0, 0.9805698369, 0.1961703215)), Plane(origin=(2089.996562, -80.92508273, 125.2435688), x=(0.9999994104, 0.0002130150927, -0.001064769498), y=(0, 0.9805698369, 0.1961703215))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]))  # disabled
plane_64 = Plane(flatten([PlaneXY(1808.020072, -734.8057436, 195.914647), Plane(origin=(1808.020072, -734.8057436, 145.914647), x=(0.9999994104, -0.000210669632, -0.001065236039), y=(0, 0.9809994852, -0.1940103348)), Plane(origin=(1807.998355, -738.6859481, 126.2946689), x=(0.9999994104, -0.000210669632, -0.001065236039), y=(0, 0.9809994852, -0.1940103348)), Plane(origin=(2048.987123, -738.6856543, 126.0278602), x=(0.9999994104, -0.000210669632, -0.001065236039), y=(0, 0.9809994852, -0.1940103348)), Plane(origin=(2048.985503, -731.3281569, 124.5727843), x=(0.9999994104, -0.000210669632, -0.001065236039), y=(0, 0.9809994852, -0.1940103348)), Plane(origin=(1807.996735, -731.3284507, 124.8395929), x=(0.9999994104, -0.000210669632, -0.001065236039), y=(0, 0.9809994852, -0.1940103348))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]))  # disabled
plane_65 = Plane(flatten([PlaneXY(2084.994219, 435.4545278, 174.5917785), Plane(origin=(2084.994219, 435.4545278, 124.5917785), x=(0.9999993871, 1.219130776e-06, -0.001107140862), y=(-9.061279442e-12, 0.9999993937, 0.00110114351)), Plane(origin=(2084.994219, 435.4545278, 124.5917785), x=(0.9999993871, 1.219130776e-06, -0.001107140862), y=(-9.061279442e-12, 0.9999993937, 0.00110114351)), Plane(origin=(1934.154311, 435.4545278, 124.7587798), x=(0.9999993871, 1.219130776e-06, -0.001107140862), y=(-9.061279442e-12, 0.9999993937, 0.00110114351)), Plane(origin=(1934.154311, 435.4545278, 124.7587798), x=(0.9999993871, 1.219130776e-06, -0.001107140862), y=(-9.061279442e-12, 0.9999993937, 0.00110114351)), Plane(origin=(1935.01869, 435.4546472, 124.6493771), x=(0.9687414447, 0.0002732427304, -0.2480724463), y=(0, 0.9999993934, 0.001101462773))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]))  # disabled
plane_66 = Plane(flatten([PlaneXY(2084.99499, 247.9056418, 174.3849881), Plane(origin=(2084.99499, 247.9056418, 124.3849881), x=(0.9999993871, 1.219130776e-06, -0.001107140862), y=(-9.061279442e-12, 0.9999993937, 0.00110114351)), Plane(origin=(2084.99499, 247.9056418, 124.3849881), x=(0.9999993871, 1.219130776e-06, -0.001107140862), y=(-9.061279442e-12, 0.9999993937, 0.00110114351)), Plane(origin=(1934.155082, 247.9056418, 124.5519894), x=(0.9999993871, 1.219130776e-06, -0.001107140862), y=(-9.061279442e-12, 0.9999993937, 0.00110114351)), Plane(origin=(1934.155082, 247.9056418, 124.5519894), x=(0.9999993871, 1.219130776e-06, -0.001107140862), y=(-9.061279442e-12, 0.9999993937, 0.00110114351)), Plane(origin=(1935.019461, 247.9057663, 124.4425867), x=(0.9687414447, 0.0002728718633, -0.2480724468), y=(0, 0.999999395, 0.001099967779))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]))  # disabled
plane_67 = Plane(flatten([PlaneXY(2370.994814, 247.9066426, 174.0676605), Plane(origin=(2370.994814, 247.9066426, 124.0676605), x=(0.9999993871, 1.219130776e-06, -0.001107140862), y=(-9.061279442e-12, 0.9999993937, 0.00110114351)), Plane(origin=(2370.994814, 247.9066426, 124.0676605), x=(0.9999993871, 1.219130776e-06, -0.001107140862), y=(-9.061279442e-12, 0.9999993937, 0.00110114351)), Plane(origin=(2220.154906, 247.9066426, 124.2346618), x=(0.9999993871, 1.219130776e-06, -0.001107140862), y=(-9.061279442e-12, 0.9999993937, 0.00110114351)), Plane(origin=(2220.154906, 247.9066426, 124.2346618), x=(0.9999993871, 1.219130776e-06, -0.001107140862), y=(-9.061279442e-12, 0.9999993937, 0.00110114351)), Plane(origin=(2221.019285, 247.9067671, 124.1252591), x=(0.9687414447, 0.0002728718612, -0.2480724468), y=(0, 0.999999395, 0.00109996777))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]))  # disabled
plane_68 = Plane(flatten([PlaneXY(2370.994042, 435.4545289, 174.2741801), Plane(origin=(2370.994042, 435.4545289, 124.2741801), x=(0.9999993871, 1.219130776e-06, -0.001107140862), y=(-9.061279442e-12, 0.9999993937, 0.00110114351)), Plane(origin=(2370.994042, 435.4545289, 124.2741801), x=(0.9999993871, 1.219130776e-06, -0.001107140862), y=(-9.061279442e-12, 0.9999993937, 0.00110114351)), Plane(origin=(2220.154135, 435.4545289, 124.4411815), x=(0.9999993871, 1.219130776e-06, -0.001107140862), y=(-9.061279442e-12, 0.9999993937, 0.00110114351)), Plane(origin=(2220.154135, 435.4545289, 124.4411815), x=(0.9999993871, 1.219130776e-06, -0.001107140862), y=(-9.061279442e-12, 0.9999993937, 0.00110114351)), Plane(origin=(2221.018514, 435.4546483, 124.3317787), x=(0.9687414447, 0.0002732427304, -0.2480724463), y=(0, 0.9999993934, 0.001101462773))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]))  # disabled
plane_69 = Plane(flatten([PlaneXY(1921.296214, 349.6145804, 174.6780052), Plane(origin=(1921.296214, 349.6145804, 124.6780052), x=(0.9999993871, 1.219130751e-06, -0.001107140836), y=(0, 0.9999993937, 0.001101151855)), Plane(origin=(1921.296214, 349.6145804, 124.6780052), x=(0.9999993871, 1.219130751e-06, -0.001107140836), y=(0, 0.9999993937, 0.001101151855)), Plane(origin=(1921.296526, 606.003425, 124.9603281), x=(0.9999993871, 1.219130751e-06, -0.001107140836), y=(0, 0.9999993937, 0.001101151855)), Plane(origin=(1921.296526, 606.003425, 124.9603281), x=(0.9999993871, 1.219130751e-06, -0.001107140836), y=(0, 0.9999993937, 0.001101151855)), Plane(origin=(1921.296526, 606.003425, 124.9603281), x=(0.9999993871, 1.219130778e-06, -0.001107140878), y=(-9.256020695e-12, 0.9999993937, 0.001101143321))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]))  # disabled
plane_70 = Plane(flatten([PlaneXY(1921.296881, 76.22674598, 174.3771165), Plane(origin=(1921.296881, 76.22674598, 124.3771165), x=(0.9999993871, 1.219130751e-06, -0.001107140836), y=(0, 0.9999993937, 0.001101151855)), Plane(origin=(1921.296881, 76.22674598, 124.3771165), x=(0.9999993871, 1.219130751e-06, -0.001107140836), y=(0, 0.9999993937, 0.001101151855)), Plane(origin=(1921.295193, 332.6145905, 124.6594405), x=(0.9999993871, 1.219130751e-06, -0.001107140836), y=(0, 0.9999993937, 0.001101151855)), Plane(origin=(1921.295193, 332.6145905, 124.6594405), x=(0.9999993871, 1.219130751e-06, -0.001107140836), y=(0, 0.9999993937, 0.001101151855)), Plane(origin=(1921.295193, 332.6145906, 124.6594405), x=(0.9999993871, 1.219130778e-06, -0.001107140878), y=(-9.256020695e-12, 0.9999993937, 0.001101143321))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]))  # disabled
plane_71 = Plane(flatten([PlaneXY(2203.79604, 349.6155809, 174.3647704), Plane(origin=(2203.79604, 349.6155809, 124.3647704), x=(0.9999993871, 1.219130765e-06, -0.001107140836), y=(0, 0.9999993937, 0.001101151855)), Plane(origin=(2203.79604, 349.6155809, 124.3647704), x=(0.9999993871, 1.219130765e-06, -0.001107140836), y=(0, 0.9999993937, 0.001101151855)), Plane(origin=(2203.796353, 606.0034255, 124.6470922), x=(0.9999993871, 1.219130765e-06, -0.001107140836), y=(0, 0.9999993937, 0.001101151855)), Plane(origin=(2203.796353, 606.0034255, 124.6470922), x=(0.9999993871, 1.219130765e-06, -0.001107140836), y=(0, 0.9999993937, 0.001101151855)), Plane(origin=(2203.796353, 606.0034255, 124.6470922), x=(0.9999993871, 1.219130778e-06, -0.001107140878), y=(-9.256020695e-12, 0.9999993937, 0.001101143321))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]))  # disabled
plane_72 = Plane(flatten([PlaneXY(2203.796707, 76.22674666, 174.0637269), Plane(origin=(2203.796707, 76.22674666, 124.0637269), x=(0.9999993871, 1.219130765e-06, -0.001107140836), y=(0, 0.9999993937, 0.001101151855)), Plane(origin=(2203.796707, 76.22674666, 124.0637269), x=(0.9999993871, 1.219130765e-06, -0.001107140836), y=(0, 0.9999993937, 0.001101151855)), Plane(origin=(2203.796019, 332.6155912, 124.3460509), x=(0.9999993871, 1.219130765e-06, -0.001107140836), y=(0, 0.9999993937, 0.001101151855)), Plane(origin=(2203.796019, 332.6155912, 124.3460509), x=(0.9999993871, 1.219130765e-06, -0.001107140836), y=(0, 0.9999993937, 0.001101151855)), Plane(origin=(2203.796019, 332.6155913, 124.3460509), x=(0.9999993871, 1.219130778e-06, -0.001107140878), y=(-9.256020695e-12, 0.9999993937, 0.001101143321))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]))  # disabled
merge_6 = Merge(
    Data1=plane_61,
    Data2=plane_62,
    Data3=plane_63,
    Data4=plane_64,
    Data5=plane_65,
    Data6=plane_66,
    Data7=plane_67,
    Data8=plane_68,
    Data9=plane_69,
    Data10=plane_70,
    Data11=plane_71,
    Data12=plane_72)  # disabled

# ----
# Sheet 2: rad cw & tan out
rotation_remap_domain_start_5 = Slider(-60, range=-180..180)  # disabled
rotation_remap_domain_end_5 = Slider(0, range=-180..180)  # disabled
plane_73 = Plane(flatten([PlaneXY(2376.019724, -64.75536196, 196.0236196), Plane(origin=(2376.019724, -64.75536196, 146.0236196), x=(0.9999994104, 0.0002130154144, -0.001064771105), y=(0, 0.9805698368, 0.1961703217)), Plane(origin=(2375.998007, -60.83195784, 126.4122344), x=(0.9999994104, 0.0002130154144, -0.001064771105), y=(0, 0.9805698368, 0.1961703217)), Plane(origin=(2127.996526, -60.8322602, 126.6868075), x=(0.9999994104, 0.0002130154144, -0.001064771105), y=(0, 0.9805698368, 0.1961703217)), Plane(origin=(2127.994906, -68.18653419, 125.2155319), x=(0.9999994104, 0.0002130154144, -0.001064771105), y=(0, 0.9805698368, 0.1961703217)), Plane(origin=(2375.996387, -68.18623182, 124.9409587), x=(0.9999994104, 0.0002130154144, -0.001064771105), y=(0, 0.9805698368, 0.1961703217))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]))  # disabled
plane_74 = Plane(flatten([PlaneXY(2090.019899, -63.65308913, 196.341476), Plane(origin=(2090.019899, -63.65308913, 146.341476), x=(0.9999994104, 0.0002130154144, -0.001064771105), y=(0, 0.9805698368, 0.1961703217)), Plane(origin=(2089.998182, -59.729685, 126.7300908), x=(0.9999994104, 0.0002130154144, -0.001064771105), y=(0, 0.9805698368, 0.1961703217)), Plane(origin=(1841.996702, -59.72998737, 127.004664), x=(0.9999994104, 0.0002130154144, -0.001064771105), y=(0, 0.9805698368, 0.1961703217)), Plane(origin=(1841.995082, -67.08426135, 125.5333883), x=(0.9999994104, 0.0002130154144, -0.001064771105), y=(0, 0.9805698368, 0.1961703217)), Plane(origin=(2089.996562, -67.08395899, 125.2588152), x=(0.9999994104, 0.0002130154144, -0.001064771105), y=(0, 0.9805698368, 0.1961703217))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]))  # disabled
plane_75 = Plane(flatten([PlaneXY(1808.020072, -723.7108472, 195.9268697), Plane(origin=(1808.020072, -723.7108472, 145.9268697), x=(0.9999994104, -0.0002106696322, -0.001065236039), y=(0, 0.9809994852, -0.194010335)), Plane(origin=(1807.998355, -727.5910516, 126.3068916), x=(0.9999994104, -0.0002106696322, -0.001065236039), y=(0, 0.9809994852, -0.194010335)), Plane(origin=(2055.999835, -727.5907494, 126.0323189), x=(0.9999994104, -0.0002106696322, -0.001065236039), y=(0, 0.9809994852, -0.194010335)), Plane(origin=(2055.998215, -720.233253, 124.5772431), x=(0.9999994104, -0.0002106696322, -0.001065236039), y=(0, 0.9809994852, -0.194010335)), Plane(origin=(1807.996735, -720.2335553, 124.8518158), x=(0.9999994104, -0.0002106696322, -0.001065236039), y=(0, 0.9809994852, -0.194010335))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]))  # disabled
plane_76 = Plane(flatten([PlaneXY(2097.019895, -723.7104949, 195.606906), Plane(origin=(2097.019895, -723.7104949, 145.606906), x=(0.9999994104, -0.0002106696322, -0.001065236039), y=(0, 0.9809994852, -0.194010335)), Plane(origin=(2096.998178, -727.5906993, 125.9869279), x=(0.9999994104, -0.0002106696322, -0.001065236039), y=(0, 0.9809994852, -0.194010335)), Plane(origin=(2344.999658, -727.590397, 125.7123552), x=(0.9999994104, -0.0002106696322, -0.001065236039), y=(0, 0.9809994852, -0.194010335)), Plane(origin=(2344.998038, -720.2329007, 124.2572794), x=(0.9999994104, -0.0002106696322, -0.001065236039), y=(0, 0.9809994852, -0.194010335)), Plane(origin=(2096.996558, -720.233203, 124.5318521), x=(0.9999994104, -0.0002106696322, -0.001065236039), y=(0, 0.9809994852, -0.194010335))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]))  # disabled
plane_77 = Plane(flatten([PlaneXY(1915.770884, 76.22674598, 174.3832346), Plane(origin=(1915.770884, 76.22674598, 124.3832346), x=(0.9999993871, 1.219130752e-06, -0.001107140836), y=(0, 0.9999993937, 0.001101151855)), Plane(origin=(1915.770884, 76.22674598, 124.3832346), x=(0.9999993871, 1.219130752e-06, -0.001107140836), y=(0, 0.9999993937, 0.001101151855)), Plane(origin=(1915.771197, 332.6145905, 124.6655564), x=(0.9999993871, 1.219130752e-06, -0.001107140836), y=(0, 0.9999993937, 0.001101151855)), Plane(origin=(1915.771197, 332.6145905, 124.6655564), x=(0.9999993871, 1.219130752e-06, -0.001107140836), y=(0, 0.9999993937, 0.001101151855)), Plane(origin=(1915.771197, 332.6145906, 124.6655564), x=(0.9999993871, 1.219130798e-06, -0.001107140881), y=(-9.273103996e-12, 0.9999993937, 0.001101143321))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]))  # disabled
plane_78 = Plane(flatten([PlaneXY(1915.771217, 349.6145804, 174.6841222), Plane(origin=(1915.771217, 349.6145804, 124.6841222), x=(0.9999993871, 1.219130752e-06, -0.001107140836), y=(0, 0.9999993937, 0.001101151855)), Plane(origin=(1915.771217, 349.6145804, 124.6841222), x=(0.9999993871, 1.219130752e-06, -0.001107140836), y=(0, 0.9999993937, 0.001101151855)), Plane(origin=(1915.77153, 606.003425, 124.9664451), x=(0.9999993871, 1.219130752e-06, -0.001107140836), y=(0, 0.9999993937, 0.001101151855)), Plane(origin=(1915.77153, 606.003425, 124.9664451), x=(0.9999993871, 1.219130752e-06, -0.001107140836), y=(0, 0.9999993937, 0.001101151855)), Plane(origin=(1915.77153, 606.003425, 124.9664451), x=(0.9999993871, 1.219130798e-06, -0.001107140881), y=(-9.273103996e-12, 0.9999993937, 0.001101143321))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]))  # disabled
plane_79 = Plane(flatten([PlaneXY(2198.27071, 76.22674666, 174.069845), Plane(origin=(2198.27071, 76.22674666, 124.069845), x=(0.9999993871, 1.219130765e-06, -0.001107140836), y=(0, 0.9999993937, 0.001101151855)), Plane(origin=(2198.27071, 76.22674666, 124.069845), x=(0.9999993871, 1.219130765e-06, -0.001107140836), y=(0, 0.9999993937, 0.001101151855)), Plane(origin=(2198.271023, 332.6155912, 124.3521679), x=(0.9999993871, 1.219130765e-06, -0.001107140836), y=(0, 0.9999993937, 0.001101151855)), Plane(origin=(2198.271023, 332.6155912, 124.3521679), x=(0.9999993871, 1.219130765e-06, -0.001107140836), y=(0, 0.9999993937, 0.001101151855)), Plane(origin=(2198.271023, 332.6155913, 124.3521679), x=(0.9999993871, 1.219130798e-06, -0.001107140881), y=(-9.273103996e-12, 0.9999993937, 0.001101143321))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]))  # disabled
plane_80 = Plane(flatten([PlaneXY(2198.271044, 349.6155809, 174.3708874), Plane(origin=(2198.271044, 349.6155809, 124.3708874), x=(0.9999993871, 1.219130765e-06, -0.001107140836), y=(0, 0.9999993937, 0.001101151855)), Plane(origin=(2198.271044, 349.6155809, 124.3708874), x=(0.9999993871, 1.219130765e-06, -0.001107140836), y=(0, 0.9999993937, 0.001101151855)), Plane(origin=(2198.271356, 606.0034255, 124.6532092), x=(0.9999993871, 1.219130765e-06, -0.001107140836), y=(0, 0.9999993937, 0.001101151855)), Plane(origin=(2198.271356, 606.0034255, 124.6532092), x=(0.9999993871, 1.219130765e-06, -0.001107140836), y=(0, 0.9999993937, 0.001101151855)), Plane(origin=(2198.271356, 606.0034255, 124.6532092), x=(0.9999993871, 1.219130798e-06, -0.001107140881), y=(-9.273103996e-12, 0.9999993937, 0.001101143321))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]))  # disabled
plane_81 = Plane(flatten([PlaneXY(2079.834993, 247.9056419, 174.390701), Plane(origin=(2079.834993, 247.9056419, 124.390701), x=(0.9999993871, 1.219130568e-06, -0.001107140863), y=(-8.995962866e-12, 0.9999993937, 0.001101143381)), Plane(origin=(2079.834993, 247.9056419, 124.390701), x=(0.9999993871, 1.219130568e-06, -0.001107140863), y=(-8.995962866e-12, 0.9999993937, 0.001101143381)), Plane(origin=(1934.155082, 247.9056419, 124.5519894), x=(0.9999993871, 1.219130568e-06, -0.001107140863), y=(-8.995962866e-12, 0.9999993937, 0.001101143381)), Plane(origin=(1934.155082, 247.9056419, 124.5519894), x=(0.9999993871, 1.219130568e-06, -0.001107140863), y=(-8.995962866e-12, 0.9999993937, 0.001101143381)), Plane(origin=(1935.019461, 247.9057663, 124.4425867), x=(0.9687414447, 0.0002728718312, -0.2480724468), y=(0, 0.999999395, 0.001099967649))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]))  # disabled
plane_82 = Plane(flatten([PlaneXY(2079.835222, 435.4545279, 174.5974902), Plane(origin=(2079.835222, 435.4545279, 124.5974902), x=(0.9999993871, 1.219130568e-06, -0.001107140863), y=(-8.995962866e-12, 0.9999993937, 0.001101143381)), Plane(origin=(2079.835222, 435.4545279, 124.5974902), x=(0.9999993871, 1.219130568e-06, -0.001107140863), y=(-8.995962866e-12, 0.9999993937, 0.001101143381)), Plane(origin=(1934.154311, 435.4545279, 124.7587798), x=(0.9999993871, 1.219130568e-06, -0.001107140863), y=(-8.995962866e-12, 0.9999993937, 0.001101143381)), Plane(origin=(1934.154311, 435.4545279, 124.7587798), x=(0.9999993871, 1.219130568e-06, -0.001107140863), y=(-8.995962866e-12, 0.9999993937, 0.001101143381)), Plane(origin=(1935.01869, 435.4546472, 124.6493771), x=(0.9687414447, 0.0002732426982, -0.2480724463), y=(0, 0.9999993934, 0.001101462643))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]))  # disabled
plane_83 = Plane(flatten([PlaneXY(2365.834817, 247.9066426, 174.0733733), Plane(origin=(2365.834817, 247.9066426, 124.0733733), x=(0.9999993871, 1.219130568e-06, -0.001107140863), y=(-8.995962866e-12, 0.9999993937, 0.001101143381)), Plane(origin=(2365.834817, 247.9066426, 124.0733733), x=(0.9999993871, 1.219130568e-06, -0.001107140863), y=(-8.995962866e-12, 0.9999993937, 0.001101143381)), Plane(origin=(2220.154906, 247.9066426, 124.2346618), x=(0.9999993871, 1.219130568e-06, -0.001107140863), y=(-8.995962866e-12, 0.9999993937, 0.001101143381)), Plane(origin=(2220.154906, 247.9066426, 124.2346618), x=(0.9999993871, 1.219130568e-06, -0.001107140863), y=(-8.995962866e-12, 0.9999993937, 0.001101143381)), Plane(origin=(2221.019285, 247.9067671, 124.1252591), x=(0.9687414447, 0.000272871829, -0.2480724468), y=(0, 0.999999395, 0.001099967641))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]))  # disabled
plane_84 = Plane(flatten([PlaneXY(2365.835045, 435.4545289, 174.2798919), Plane(origin=(2365.835045, 435.4545289, 124.2798919), x=(0.9999993871, 1.219130568e-06, -0.001107140863), y=(-8.995962865e-12, 0.9999993937, 0.001101143381)), Plane(origin=(2365.835045, 435.4545289, 124.2798919), x=(0.9999993871, 1.219130568e-06, -0.001107140863), y=(-8.995962865e-12, 0.9999993937, 0.001101143381)), Plane(origin=(2220.154135, 435.4545289, 124.4411815), x=(0.9999993871, 1.219130568e-06, -0.001107140863), y=(-8.995962865e-12, 0.9999993937, 0.001101143381)), Plane(origin=(2220.154135, 435.4545289, 124.4411815), x=(0.9999993871, 1.219130568e-06, -0.001107140863), y=(-8.995962865e-12, 0.9999993937, 0.001101143381)), Plane(origin=(2221.018514, 435.4546483, 124.3317787), x=(0.9687414447, 0.0002732426982, -0.2480724463), y=(0, 0.9999993934, 0.001101462643))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]))  # disabled
merge_7 = Merge(
    Data1=plane_73,
    Data2=plane_74,
    Data3=plane_75,
    Data4=plane_76,
    Data5=plane_77,
    Data6=plane_78,
    Data7=plane_79,
    Data8=plane_80,
    Data9=plane_81,
    Data10=plane_82,
    Data11=plane_83,
    Data12=plane_84)  # disabled

# ----
# Sheet 2: rad cw & tan out
plane_85 = Plane(flatten([PlaneXY(1808.020072, -723.7108478, 195.92687), Plane(origin=(1808.020072, -723.7108478, 145.92687), x=(0.9999994104, -0.0002106699321, -0.001065237767), y=(0, 0.9809994925, -0.1940102979)), Plane(origin=(1807.998355, -727.5910514, 126.3068918), x=(0.9999994104, -0.0002106699321, -0.001065237767), y=(0, 0.9809994925, -0.1940102979)), Plane(origin=(2061.998199, -727.5907419, 126.0256775), x=(0.9999994104, -0.0002106699321, -0.001065237767), y=(0, 0.9809994925, -0.1940102979)), Plane(origin=(2061.996579, -720.2332455, 124.5706021), x=(0.9999994104, -0.0002106699321, -0.001065237767), y=(0, 0.9809994925, -0.1940102979)), Plane(origin=(1807.996735, -720.233555, 124.8518163), x=(0.9999994104, -0.0002106699321, -0.001065237767), y=(0, 0.9809994925, -0.1940102979))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]))  # disabled
plane_86 = Plane(flatten([PlaneXY(2097.019895, -723.7104954, 195.6069063), Plane(origin=(2097.019895, -723.7104954, 145.6069063), x=(0.9999994104, -0.0002106699321, -0.001065237767), y=(0, 0.9809994925, -0.1940102979)), Plane(origin=(2096.998178, -727.5906991, 125.9869281), x=(0.9999994104, -0.0002106699321, -0.001065237767), y=(0, 0.9809994925, -0.1940102979)), Plane(origin=(2350.998022, -727.5903895, 125.7057138), x=(0.9999994104, -0.0002106699321, -0.001065237767), y=(0, 0.9809994925, -0.1940102979)), Plane(origin=(2350.996402, -720.2328931, 124.2506384), x=(0.9999994104, -0.0002106699321, -0.001065237767), y=(0, 0.9809994925, -0.1940102979)), Plane(origin=(2096.996558, -720.2332027, 124.5318526), x=(0.9999994104, -0.0002106699321, -0.001065237767), y=(0, 0.9809994925, -0.1940102979))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]))  # disabled
plane_87 = Plane(flatten([PlaneXY(2090.019899, -63.65308857, 196.3414763), Plane(origin=(2090.019899, -63.65308857, 146.3414763), x=(0.9999994104, 0.0002130150547, -0.001064769517), y=(0, 0.9805698443, 0.1961702846)), Plane(origin=(2089.998182, -59.72968519, 126.730091), x=(0.9999994104, 0.0002130150547, -0.001064769517), y=(0, 0.9805698443, 0.1961702846)), Plane(origin=(1835.998338, -59.72999486, 127.0113047), x=(0.9999994104, 0.0002130150547, -0.001064769517), y=(0, 0.9805698443, 0.1961702846)), Plane(origin=(1835.996718, -67.08426891, 125.5400294), x=(0.9999994104, 0.0002130150547, -0.001064769517), y=(0, 0.9805698443, 0.1961702846)), Plane(origin=(2089.996562, -67.08395924, 125.2588156), x=(0.9999994104, 0.0002130150547, -0.001064769517), y=(0, 0.9805698443, 0.1961702846))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]))  # disabled
plane_88 = Plane(flatten([PlaneXY(2376.019724, -64.75536141, 196.0236199), Plane(origin=(2376.019724, -64.75536141, 146.0236199), x=(0.9999994104, 0.0002130150547, -0.001064769517), y=(0, 0.9805698443, 0.1961702846)), Plane(origin=(2375.998007, -60.83195803, 126.4122345), x=(0.9999994104, 0.0002130150547, -0.001064769517), y=(0, 0.9805698443, 0.1961702846)), Plane(origin=(2121.998162, -60.83226769, 126.6934483), x=(0.9999994104, 0.0002130150547, -0.001064769517), y=(0, 0.9805698443, 0.1961702846)), Plane(origin=(2121.996542, -68.18654174, 125.2221729), x=(0.9999994104, 0.0002130150547, -0.001064769517), y=(0, 0.9805698443, 0.1961702846)), Plane(origin=(2375.996387, -68.18623208, 124.9409592), x=(0.9999994104, 0.0002130150547, -0.001064769517), y=(0, 0.9805698443, 0.1961702846))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]))  # disabled
plane_89 = Plane(flatten([PlaneXY(1921.296881, 76.22674602, 174.3771166), Plane(origin=(1921.296881, 76.22674602, 124.3771166), x=(0.9999993871, 1.219130754e-06, -0.001107140836), y=(0, 0.9999993937, 0.001101151519)), Plane(origin=(1921.296881, 76.22674602, 124.3771166), x=(0.9999993871, 1.219130754e-06, -0.001107140836), y=(0, 0.9999993937, 0.001101151519)), Plane(origin=(1921.295193, 332.6145906, 124.6594405), x=(0.9999993871, 1.219130754e-06, -0.001107140836), y=(0, 0.9999993937, 0.001101151519)), Plane(origin=(1921.295193, 332.6145906, 124.6594405), x=(0.9999993871, 1.219130754e-06, -0.001107140836), y=(0, 0.9999993937, 0.001101151519)), Plane(origin=(1921.295193, 332.6145906, 124.6594405), x=(0.9999993871, 1.21913085e-06, -0.001107140882), y=(-1.009391961e-11, 0.9999993937, 0.001101142626))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]))  # disabled
plane_90 = Plane(flatten([PlaneXY(1921.296214, 349.6145804, 174.6780053), Plane(origin=(1921.296214, 349.6145804, 124.6780053), x=(0.9999993871, 1.219130761e-06, -0.001107140836), y=(0, 0.9999993937, 0.001101151519)), Plane(origin=(1921.296214, 349.6145804, 124.6780053), x=(0.9999993871, 1.219130761e-06, -0.001107140836), y=(0, 0.9999993937, 0.001101151519)), Plane(origin=(1921.296526, 606.003425, 124.9603281), x=(0.9999993871, 1.219130761e-06, -0.001107140836), y=(0, 0.9999993937, 0.001101151519)), Plane(origin=(1921.296526, 606.003425, 124.9603281), x=(0.9999993871, 1.219130761e-06, -0.001107140836), y=(0, 0.9999993937, 0.001101151519)), Plane(origin=(1921.296526, 606.003425, 124.9603281), x=(0.9999993871, 1.21913085e-06, -0.001107140882), y=(-1.009391961e-11, 0.9999993937, 0.001101142626))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]))  # disabled
plane_91 = Plane(flatten([PlaneXY(2203.796707, 76.2267467, 174.063727), Plane(origin=(2203.796707, 76.2267467, 124.063727), x=(0.9999993871, 1.219130754e-06, -0.001107140836), y=(0, 0.9999993937, 0.001101151519)), Plane(origin=(2203.796707, 76.2267467, 124.063727), x=(0.9999993871, 1.219130754e-06, -0.001107140836), y=(0, 0.9999993937, 0.001101151519)), Plane(origin=(2203.796019, 332.6155913, 124.3460509), x=(0.9999993871, 1.219130754e-06, -0.001107140836), y=(0, 0.9999993937, 0.001101151519)), Plane(origin=(2203.796019, 332.6155913, 124.3460509), x=(0.9999993871, 1.219130754e-06, -0.001107140836), y=(0, 0.9999993937, 0.001101151519)), Plane(origin=(2203.796019, 332.6155913, 124.3460509), x=(0.9999993871, 1.21913085e-06, -0.001107140882), y=(-1.009391961e-11, 0.9999993937, 0.001101142626))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]))  # disabled
plane_92 = Plane(flatten([PlaneXY(2203.79604, 349.615581, 174.3647705), Plane(origin=(2203.79604, 349.615581, 124.3647705), x=(0.9999993871, 1.219130754e-06, -0.001107140836), y=(0, 0.9999993937, 0.001101151519)), Plane(origin=(2203.79604, 349.615581, 124.3647705), x=(0.9999993871, 1.219130754e-06, -0.001107140836), y=(0, 0.9999993937, 0.001101151519)), Plane(origin=(2203.796353, 606.0034255, 124.6470922), x=(0.9999993871, 1.219130754e-06, -0.001107140836), y=(0, 0.9999993937, 0.001101151519)), Plane(origin=(2203.796353, 606.0034255, 124.6470922), x=(0.9999993871, 1.219130754e-06, -0.001107140836), y=(0, 0.9999993937, 0.001101151519)), Plane(origin=(2203.796353, 606.0034255, 124.6470922), x=(0.9999993871, 1.21913085e-06, -0.001107140882), y=(-1.009391961e-11, 0.9999993937, 0.001101142626))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]))  # disabled
plane_93 = Plane(flatten([PlaneXY(2084.99499, 247.9056419, 174.3849881), Plane(origin=(2084.99499, 247.9056419, 124.3849881), x=(0.9999993871, 1.219130523e-06, -0.001107140866), y=(-9.986840639e-12, 0.9999993937, 0.001101142442)), Plane(origin=(2084.99499, 247.9056419, 124.3849881), x=(0.9999993871, 1.219130523e-06, -0.001107140866), y=(-9.986840639e-12, 0.9999993937, 0.001101142442)), Plane(origin=(1934.155082, 247.9056419, 124.5519894), x=(0.9999993871, 1.219130523e-06, -0.001107140866), y=(-9.986840639e-12, 0.9999993937, 0.001101142442)), Plane(origin=(1934.155082, 247.9056419, 124.5519894), x=(0.9999993871, 1.219130523e-06, -0.001107140866), y=(-9.986840639e-12, 0.9999993937, 0.001101142442)), Plane(origin=(1935.019461, 247.9057664, 124.4425867), x=(0.9687414447, 0.0002728717382, -0.2480724468), y=(0, 0.999999395, 0.001099967274))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]))  # disabled
plane_94 = Plane(flatten([PlaneXY(2084.994219, 435.4545279, 174.5917785), Plane(origin=(2084.994219, 435.4545279, 124.5917785), x=(0.9999993871, 1.219130523e-06, -0.001107140866), y=(-9.986840639e-12, 0.9999993937, 0.001101142442)), Plane(origin=(2084.994219, 435.4545279, 124.5917785), x=(0.9999993871, 1.219130523e-06, -0.001107140866), y=(-9.986840639e-12, 0.9999993937, 0.001101142442)), Plane(origin=(1934.154311, 435.4545279, 124.7587798), x=(0.9999993871, 1.219130523e-06, -0.001107140866), y=(-9.986840639e-12, 0.9999993937, 0.001101142442)), Plane(origin=(1934.154311, 435.4545279, 124.7587798), x=(0.9999993871, 1.219130523e-06, -0.001107140866), y=(-9.986840639e-12, 0.9999993937, 0.001101142442)), Plane(origin=(1935.01869, 435.4546473, 124.6493771), x=(0.9687414447, 0.0002732426053, -0.2480724463), y=(0, 0.9999993934, 0.001101462269))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]))  # disabled
plane_95 = Plane(flatten([PlaneXY(2370.994814, 247.9066427, 174.0676605), Plane(origin=(2370.994814, 247.9066427, 124.0676605), x=(0.9999993871, 1.219130523e-06, -0.001107140866), y=(-9.986840639e-12, 0.9999993937, 0.001101142442)), Plane(origin=(2370.994814, 247.9066427, 124.0676605), x=(0.9999993871, 1.219130523e-06, -0.001107140866), y=(-9.986840639e-12, 0.9999993937, 0.001101142442)), Plane(origin=(2220.154906, 247.9066427, 124.2346618), x=(0.9999993871, 1.219130523e-06, -0.001107140866), y=(-9.986840639e-12, 0.9999993937, 0.001101142442)), Plane(origin=(2220.154906, 247.9066427, 124.2346618), x=(0.9999993871, 1.219130523e-06, -0.001107140866), y=(-9.986840639e-12, 0.9999993937, 0.001101142442)), Plane(origin=(2221.019285, 247.9067671, 124.1252591), x=(0.9687414447, 0.000272871736, -0.2480724468), y=(0, 0.999999395, 0.001099967266))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]))  # disabled
plane_96 = Plane(flatten([PlaneXY(2370.994042, 435.454529, 174.2741801), Plane(origin=(2370.994042, 435.454529, 124.2741801), x=(0.9999993871, 1.219130523e-06, -0.001107140866), y=(-9.98684064e-12, 0.9999993937, 0.001101142442)), Plane(origin=(2370.994042, 435.454529, 124.2741801), x=(0.9999993871, 1.219130523e-06, -0.001107140866), y=(-9.98684064e-12, 0.9999993937, 0.001101142442)), Plane(origin=(2220.154135, 435.454529, 124.4411815), x=(0.9999993871, 1.219130523e-06, -0.001107140866), y=(-9.98684064e-12, 0.9999993937, 0.001101142442)), Plane(origin=(2220.154135, 435.454529, 124.4411815), x=(0.9999993871, 1.219130523e-06, -0.001107140866), y=(-9.98684064e-12, 0.9999993937, 0.001101142442)), Plane(origin=(2221.018514, 435.4546483, 124.3317787), x=(0.9687414447, 0.0002732426053, -0.2480724463), y=(0, 0.9999993934, 0.001101462269))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]))  # disabled
merge_8 = Merge(
    Data1=plane_85,
    Data2=plane_86,
    Data3=plane_87,
    Data4=plane_88,
    Data5=plane_89,
    Data6=plane_90,
    Data7=plane_91,
    Data8=plane_92,
    Data9=plane_93,
    Data10=plane_94,
    Data11=plane_95,
    Data12=plane_96)  # disabled

# ----
# Sheet 2
number_slider_3 = Slider(6, range=0..20)  # disabled
number_slider_4 = Slider(18, range=0..200)  # disabled
geometry_20 = Geometry([<curve referenced from the Rhino model> x28])  # disabled
curve_2 = Curve()  # disabled
cluster_2 = Cluster_2(geometry=geometry_20, factor=number_slider_3, curve=curve_2)  # -> screw_location, result; disabled
text_tag_3d_2 = TextTag3D(Location=graft(cluster_2.screw_location), Text=cluster_2.result, Size=number_slider_4, Justification=2)  # disabled

# ----
# Sheet 2: rad cw & tan out
plane_97 = Plane(flatten([PlaneXY(2097.045439, -723.6903781, 191.8457331), Plane(origin=(2097.045439, -723.6903781, 141.8457331), x=(0.999996994, -0.00047835416, -0.002404841645), y=(0, 0.98078517, -0.1950908772)), Plane(origin=(2096.9964, -727.5921839, 122.2300887), x=(0.999996994, -0.00047835416, -0.002404841645), y=(0, 0.98078517, -0.1950908772)), Plane(origin=(2350.995606, -727.5921839, 121.5950906), x=(0.999996994, -0.00047835416, -0.002404841645), y=(0, 0.98078517, -0.1950908772)), Plane(origin=(2350.991949, -720.2362942, 120.131918), x=(0.999996994, -0.00047835416, -0.002404841645), y=(0, 0.98078517, -0.1950908772)), Plane(origin=(2096.992742, -720.2362942, 120.766916), x=(0.999996994, -0.00047835416, -0.002404841645), y=(0, 0.98078517, -0.1950908772))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]))  # disabled
plane_98 = Plane(flatten([PlaneXY(1808.046342, -723.690378, 192.5682297), Plane(origin=(1808.046342, -723.690378, 142.5682297), x=(0.999996994, -0.0004783541718, -0.00240484164), y=(0, 0.980785169, -0.1950908823)), Plane(origin=(1807.997303, -727.5921839, 122.9525853), x=(0.999996994, -0.0004783541718, -0.00240484164), y=(0, 0.980785169, -0.1950908823)), Plane(origin=(2061.99651, -727.5921839, 122.3175873), x=(0.999996994, -0.0004783541718, -0.00240484164), y=(0, 0.980785169, -0.1950908823)), Plane(origin=(2061.992852, -720.2362942, 120.8544146), x=(0.999996994, -0.0004783541718, -0.00240484164), y=(0, 0.980785169, -0.1950908823)), Plane(origin=(1807.993645, -720.2362942, 121.4894126), x=(0.999996994, -0.0004783541718, -0.00240484164), y=(0, 0.980785169, -0.1950908823))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]))  # disabled
plane_99 = Plane(flatten([PlaneXY(2376.044567, -64.73518307, 191.1482353), Plane(origin=(2376.044567, -64.73518307, 141.1482353), x=(0.999996994, 0.0004783541718, -0.00240484164), y=(0, 0.980785169, 0.1950908823)), Plane(origin=(2375.995528, -60.83337716, 121.5325909), x=(0.999996994, 0.0004783541718, -0.00240484164), y=(0, 0.980785169, 0.1950908823)), Plane(origin=(2121.996322, -60.83337716, 122.1675889), x=(0.999996994, 0.0004783541718, -0.00240484164), y=(0, 0.980785169, 0.1950908823)), Plane(origin=(2121.992664, -68.18926687, 120.7044162), x=(0.999996994, 0.0004783541718, -0.00240484164), y=(0, 0.980785169, 0.1950908823)), Plane(origin=(2375.99187, -68.18926687, 120.0694182), x=(0.999996994, 0.0004783541718, -0.00240484164), y=(0, 0.980785169, 0.1950908823))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]))  # disabled
plane_100 = Plane(flatten([PlaneXY(2090.045461, -63.6325609, 191.863233), Plane(origin=(2090.045461, -63.6325609, 141.863233), x=(0.999996994, 0.0004783541718, -0.00240484164), y=(0, 0.980785169, 0.1950908823)), Plane(origin=(2089.996422, -59.73075498, 122.2475886), x=(0.999996994, 0.0004783541718, -0.00240484164), y=(0, 0.980785169, 0.1950908823)), Plane(origin=(1835.997216, -59.73075498, 122.8825866), x=(0.999996994, 0.0004783541718, -0.00240484164), y=(0, 0.980785169, 0.1950908823)), Plane(origin=(1835.993558, -67.0866447, 121.419414), x=(0.999996994, 0.0004783541718, -0.00240484164), y=(0, 0.980785169, 0.1950908823)), Plane(origin=(2089.992764, -67.0866447, 120.784416), x=(0.999996994, 0.0004783541718, -0.00240484164), y=(0, 0.980785169, 0.1950908823))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]))  # disabled
plane_101 = Plane(flatten([PlaneXY(2203.794818, 76.22300004, 170.7730036), Plane(origin=(2203.794818, 76.22300004, 120.7730036), x=(0.999996875, 0, -0.002499992188), y=(0, 1, -3.110239047e-10)), Plane(origin=(2203.794818, 76.22300004, 120.7730036), x=(0.999996875, 0, -0.002499992188), y=(0, 1, -3.110239047e-10)), Plane(origin=(2203.794818, 332.611, 120.7730035), x=(0.999996875, 0, -0.002499992188), y=(0, 1, -3.110239047e-10)), Plane(origin=(2203.794818, 332.611, 120.7730035), x=(0.999996875, 0, -0.002499992188), y=(0, 1, -3.110239047e-10)), Plane(origin=(2203.794818, 332.611, 120.7730035), x=(0.999996875, 0, -0.002499992126), y=(3.185768151e-11, 1, 1.273192149e-08))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]))  # disabled
plane_102 = Plane(flatten([PlaneXY(1921.295703, 76.223, 171.4798733), Plane(origin=(1921.295703, 76.223, 121.4798733), x=(0.999996875, 0, -0.002499992188), y=(0, 1, 2.501559427e-11)), Plane(origin=(1921.295703, 76.223, 121.4798733), x=(0.999996875, 0, -0.002499992188), y=(0, 1, 2.501559427e-11)), Plane(origin=(1921.295703, 332.611, 121.4798733), x=(0.999996875, 0, -0.002499992188), y=(0, 1, 2.501559427e-11)), Plane(origin=(1921.295703, 332.611, 121.4798733), x=(0.999996875, 0, -0.002499992188), y=(0, 1, 2.501559427e-11)), Plane(origin=(1921.295703, 332.6109999, 121.4798733), x=(0.999996875, 0, -0.002499992126), y=(3.274922355e-11, 1, 1.306795471e-08))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]))  # disabled
plane_103 = Plane(flatten([PlaneXY(2370.992296, 247.902, 170.3550099), Plane(origin=(2370.992296, 247.902, 120.3550099), x=(0.999996875, 0, -0.00249999216), y=(2.183790173e-11, 1, 8.735160692e-09)), Plane(origin=(2370.992296, 247.902, 120.3550099), x=(0.999996875, 0, -0.00249999216), y=(2.183790173e-11, 1, 8.735160692e-09)), Plane(origin=(2214.992783, 247.902, 120.7450087), x=(0.999996875, 0, -0.00249999216), y=(2.183790173e-11, 1, 8.735160692e-09)), Plane(origin=(2214.992783, 247.902, 120.7450087), x=(0.999996875, 0, -0.00249999216), y=(2.183790173e-11, 1, 8.735160692e-09)), Plane(origin=(2216.227392, 247.902, 120.5869992), x=(0.9683949765, -2.157728896e-09, -0.2494216702), y=(2.095857752e-09, 1, -5.136313027e-10))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]))  # disabled
plane_104 = Plane(flatten([PlaneXY(2084.993191, 247.902, 171.0706937), Plane(origin=(2084.993191, 247.902, 121.0706937), x=(0.999996875, 0, -0.00249999216), y=(2.183791845e-11, 1, 8.735167381e-09)), Plane(origin=(2084.993191, 247.902, 121.0706937), x=(0.999996875, 0, -0.00249999216), y=(2.183791845e-11, 1, 8.735167381e-09)), Plane(origin=(1928.993679, 247.902, 121.4606925), x=(0.999996875, 0, -0.00249999216), y=(2.183791845e-11, 1, 8.735167381e-09)), Plane(origin=(1928.993679, 247.902, 121.4606925), x=(0.999996875, 0, -0.00249999216), y=(2.183791845e-11, 1, 8.735167381e-09)), Plane(origin=(1930.228287, 247.902, 121.302683), x=(0.9683949765, -2.15772205e-09, -0.2494216702), y=(2.095853921e-09, 1, -5.136187291e-10))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]))  # disabled
plane_105 = Plane(flatten([PlaneXY(2203.794818, 349.611, 170.7730036), Plane(origin=(2203.794818, 349.611, 120.7730036), x=(0.999996875, 0, -0.002499992188), y=(-1.022803889e-12, 1, -3.767581901e-10)), Plane(origin=(2203.794818, 349.611, 120.7730036), x=(0.999996875, 0, -0.002499992188), y=(-1.022803889e-12, 1, -3.767581901e-10)), Plane(origin=(2203.794818, 606, 120.7730035), x=(0.999996875, 0, -0.002499992188), y=(-1.022803889e-12, 1, -3.767581901e-10)), Plane(origin=(2203.794818, 606, 120.7730035), x=(0.999996875, 0, -0.002499992188), y=(-1.022803889e-12, 1, -3.767581901e-10)), Plane(origin=(2203.794818, 606, 120.7730035), x=(0.999996875, 0, -0.002499992126), y=(3.162948164e-11, 1, 1.266617675e-08))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]))  # disabled
plane_106 = Plane(flatten([PlaneXY(1921.295702, 349.611, 171.4797196), Plane(origin=(1921.295702, 349.611, 121.4797196), x=(0.999996875, 0, -0.002499992188), y=(0, 1, 2.504944213e-11)), Plane(origin=(1921.295702, 349.611, 121.4797196), x=(0.999996875, 0, -0.002499992188), y=(0, 1, 2.504944213e-11)), Plane(origin=(1921.295702, 606, 121.4797196), x=(0.999996875, 0, -0.002499992188), y=(0, 1, 2.504944213e-11)), Plane(origin=(1921.295702, 606, 121.4797196), x=(0.999996875, 0, -0.002499992188), y=(0, 1, 2.504944213e-11)), Plane(origin=(1921.295702, 605.9999999, 121.4797196), x=(0.999996875, 0, -0.002499992126), y=(3.262306819e-11, 1, 1.306798566e-08))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]))  # disabled
plane_107 = Plane(flatten([PlaneXY(2370.992296, 435.451, 170.3550099), Plane(origin=(2370.992296, 435.451, 120.3550099), x=(0.999996875, 0, -0.002499992161), y=(2.047773199e-11, 1, 8.191092798e-09)), Plane(origin=(2370.992296, 435.451, 120.3550099), x=(0.999996875, 0, -0.002499992161), y=(2.047773199e-11, 1, 8.191092798e-09)), Plane(origin=(2214.992783, 435.451, 120.7450087), x=(0.999996875, 0, -0.002499992161), y=(2.047773199e-11, 1, 8.191092798e-09)), Plane(origin=(2214.992783, 435.451, 120.7450087), x=(0.999996875, 0, -0.002499992161), y=(2.047773199e-11, 1, 8.191092798e-09)), Plane(origin=(2216.227392, 435.4510001, 120.5869992), x=(0.9683949765, -2.292116299e-09, -0.2494216702), y=(2.094498457e-09, 1, -1.05770487e-09))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]))  # disabled
plane_108 = Plane(flatten([PlaneXY(2084.993192, 435.451, 171.0709633), Plane(origin=(2084.993192, 435.451, 121.0709633), x=(0.999996875, 0, -0.00249999216), y=(2.183793184e-11, 1, 8.735172738e-09)), Plane(origin=(2084.993192, 435.451, 121.0709633), x=(0.999996875, 0, -0.00249999216), y=(2.183793184e-11, 1, 8.735172738e-09)), Plane(origin=(1928.99368, 435.451, 121.4609621), x=(0.999996875, 0, -0.00249999216), y=(2.183793184e-11, 1, 8.735172738e-09)), Plane(origin=(1928.99368, 435.451, 121.4609621), x=(0.999996875, 0, -0.00249999216), y=(2.183793184e-11, 1, 8.735172738e-09)), Plane(origin=(1930.228288, 435.451, 121.3029526), x=(0.9683949765, -2.157738136e-09, -0.2494216702), y=(2.095865649e-09, 1, -5.136376883e-10))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]))  # disabled
merge_9 = Merge(
    Data1=plane_97,
    Data2=plane_98,
    Data3=plane_99,
    Data4=plane_100,
    Data5=plane_101,
    Data6=plane_102,
    Data7=plane_103,
    Data8=plane_104,
    Data9=plane_105,
    Data10=plane_106,
    Data11=plane_107,
    Data12=plane_108)  # disabled

# ---- group: stock
geometry_21 = Geometry(geometry_2)

# ---- group: geo
geometry_22 = Geometry(geometry)

# ---- group: Frames
plane_109 = Plane(merge)

# ---- group: 2_tangent stock
# Sheet 2: tangent
geometry_23 = Geometry(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)  # disabled

# ---- group: 2_tangent geo
geometry_24 = Geometry([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])  # disabled

# ---- group: 3_tangent stock
# Sheet 2: tangent
geometry_25 = Geometry(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)  # disabled

# ---- group: 3_tangent geo
geometry_26 = Geometry([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])  # disabled

# ---- group: 2_rad cw & tan out stock
geometry_27 = Geometry(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)  # disabled

# ---- group: 2_rad cw & tan out geo
geometry_28 = Geometry([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])  # disabled

# ---- group: 3_rad cw & tan out stock
geometry_29 = Geometry(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)  # disabled

# ---- group: 3_rad cw & tan out geo
geometry_30 = Geometry([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])  # disabled

# ----
# order geometry
area = Area(Geometry=geometry_22)  # -> Area, Centroid
deconstruct = Deconstruct(Point=area.Centroid)  # -> XComponent, YComponent, ZComponent
construct_point = ConstructPoint(XCoordinate=deconstruct.XComponent, YCoordinate=deconstruct.YComponent, ZCoordinate=0)
sort_along_curve = SortAlongCurve(Points=construct_point, Curve=geometry_21)  # -> Points, Indices
sort_points = SortPoints(Points=construct_point)  # -> Points, Indices
list_item = ListItem(List=geometry_22, Index=sort_points.Indices, Wrap=True)

# ---- group: 1_tangent geo
geometry_31 = Geometry([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])  # disabled

# ---- group: 1_tangent stock
# Sheet 2: tangent
geometry_32 = Geometry(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)  # disabled

# ---- group: 4_tangent stock
# Sheet 2: tangent
geometry_33 = Geometry(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)  # disabled

# ---- group: 4_tangent geo
geometry_34 = Geometry([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])  # disabled

# ---- group: 1_rad cw & tan out geo
geometry_35 = Geometry([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])  # disabled

# ---- group: 1_rad cw & tan out stock
geometry_36 = Geometry(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)  # disabled

# ---- group: 4_rad cw & tan out stock
geometry_37 = Geometry(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)  # disabled

# ---- group: 4_rad cw & tan out geo
geometry_38 = Geometry([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])  # disabled

# ----
# Sheet 3: tan in & tan out
rotation_remap_domain_start_6 = Slider(-60, range=-180..180)  # disabled
rotation_remap_domain_end_6 = Slider(0, range=-180..180)  # disabled
plane_110 = Plane(flatten([PlaneXY(2370.996327, 127.6860643, 175.4347249), Plane(origin=(2370.996327, 127.6860643, 125.4347249), x=(0.9999993871, 1.219130738e-06, -0.001107140819), y=(9.468716721e-12, 0.9999993937, 0.001101160256)), Plane(origin=(2370.996327, 127.6860643, 125.4347249), x=(0.9999993871, 1.219130738e-06, -0.001107140819), y=(9.468716721e-12, 0.9999993937, 0.001101160256)), Plane(origin=(2126.996477, 127.6860643, 125.7048675), x=(0.9999993871, 1.219130738e-06, -0.001107140819), y=(9.468716721e-12, 0.9999993937, 0.001101160256)), Plane(origin=(2126.996477, 127.6860643, 125.7048675), x=(0.9999993871, 1.219130738e-06, -0.001107140819), y=(9.468716721e-12, 0.9999993937, 0.001101160256)), Plane(origin=(2130.64863, 127.6878225, 124.1138755), x=(0.6818007908, 0.0008041988199, -0.731537446), y=(0, 0.9999993957, 0.001099326273))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]))  # disabled
plane_111 = Plane(flatten([PlaneXY(2370.995889, -231.5407178, 175.0390519), Plane(origin=(2370.995889, -231.5407178, 125.0390519), x=(0.9999993871, 1.219130738e-06, -0.001107140819), y=(9.668666054e-12, 0.9999993937, 0.001101160437)), Plane(origin=(2370.995889, -231.5407178, 125.0390519), x=(0.9999993871, 1.219130738e-06, -0.001107140819), y=(9.668666054e-12, 0.9999993937, 0.001101160437)), Plane(origin=(2126.996039, -231.5407178, 125.3091946), x=(0.9999993871, 1.219130738e-06, -0.001107140819), y=(9.668666054e-12, 0.9999993937, 0.001101160437)), Plane(origin=(2126.996039, -231.5407178, 125.3091946), x=(0.9999993871, 1.219130738e-06, -0.001107140819), y=(9.668666054e-12, 0.9999993937, 0.001101160437)), Plane(origin=(2130.648192, -231.5389703, 123.7182026), x=(0.6818007908, 0.0008064900926, -0.7315374435), y=(0, 0.9999993923, 0.001102458404))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]))  # disabled
plane_112 = Plane(flatten([PlaneXY(2370.996451, -590.7685, 174.6435159), Plane(origin=(2370.996451, -590.7685, 124.6435159), x=(0.9999993871, 1.219130739e-06, -0.001107140819), y=(9.668681266e-12, 0.9999993937, 0.001101160437)), Plane(origin=(2370.996451, -590.7685, 124.6435159), x=(0.9999993871, 1.219130739e-06, -0.001107140819), y=(9.668681266e-12, 0.9999993937, 0.001101160437)), Plane(origin=(2126.996601, -590.7685, 124.9136586), x=(0.9999993871, 1.219130739e-06, -0.001107140819), y=(9.668681266e-12, 0.9999993937, 0.001101160437)), Plane(origin=(2126.996601, -590.7685, 124.9136586), x=(0.9999993871, 1.219130739e-06, -0.001107140819), y=(9.668681266e-12, 0.9999993937, 0.001101160437)), Plane(origin=(2130.648755, -590.7667418, 123.3226666), x=(0.6818007908, 0.0008041989522, -0.731537446), y=(0, 0.9999993957, 0.001099326454))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]))  # disabled
plane_113 = Plane(flatten([PlaneXY(2370.996014, -949.9962829, 174.2485874), Plane(origin=(2370.996014, -949.9962829, 124.2485874), x=(0.9999993871, 1.219130738e-06, -0.001107140819), y=(9.668668667e-12, 0.9999993937, 0.001101160437)), Plane(origin=(2370.996014, -949.9962829, 124.2485874), x=(0.9999993871, 1.219130738e-06, -0.001107140819), y=(9.668668667e-12, 0.9999993937, 0.001101160437)), Plane(origin=(2126.996164, -949.9962829, 124.5187301), x=(0.9999993871, 1.219130738e-06, -0.001107140819), y=(9.668668667e-12, 0.9999993937, 0.001101160437)), Plane(origin=(2126.996164, -949.9962829, 124.5187301), x=(0.9999993871, 1.219130738e-06, -0.001107140819), y=(9.668668667e-12, 0.9999993937, 0.001101160437)), Plane(origin=(2130.648317, -949.9945354, 122.927738), x=(0.6818007908, 0.0008064900926, -0.7315374435), y=(0, 0.9999993923, 0.001102458404))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]))  # disabled
plane_114 = Plane(flatten([PlaneXY(2058.996519, 127.6860637, 175.7807671), Plane(origin=(2058.996519, 127.6860637, 125.7807671), x=(0.9999993871, 1.219130792e-06, -0.001107140836), y=(0, 0.9999993937, 0.001101151517)), Plane(origin=(2058.996519, 127.6860637, 125.7807671), x=(0.9999993871, 1.219130792e-06, -0.001107140836), y=(0, 0.9999993937, 0.001101151517)), Plane(origin=(2058.995936, 469.9138562, 126.1576126), x=(0.9999993871, 1.219130792e-06, -0.001107140836), y=(0, 0.9999993937, 0.001101151517)), Plane(origin=(2058.995936, 469.9138562, 126.1576126), x=(0.9999993871, 1.219130792e-06, -0.001107140836), y=(0, 0.9999993937, 0.001101151517)), Plane(origin=(2058.995936, 469.9138562, 126.1576126), x=(0.9999993871, 1.219130774e-06, -0.001107140819), y=(9.442964337e-12, 0.9999993937, 0.001101160265))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]))  # disabled
plane_115 = Plane(flatten([PlaneXY(2058.996081, -231.5407181, 175.3848654), Plane(origin=(2058.996081, -231.5407181, 125.3848654), x=(0.9999993871, 1.219130755e-06, -0.001107140836), y=(0, 0.9999993937, 0.001101151689)), Plane(origin=(2058.996081, -231.5407181, 125.3848654), x=(0.9999993871, 1.219130755e-06, -0.001107140836), y=(0, 0.9999993937, 0.001101151689)), Plane(origin=(2058.996498, 110.6860744, 125.7617088), x=(0.9999993871, 1.219130755e-06, -0.001107140836), y=(0, 0.9999993937, 0.001101151689)), Plane(origin=(2058.996498, 110.6860744, 125.7617088), x=(0.9999993871, 1.219130755e-06, -0.001107140836), y=(0, 0.9999993937, 0.001101151689)), Plane(origin=(2058.996498, 110.6860743, 125.7617088), x=(0.9999993871, 1.219130725e-06, -0.001107140819), y=(9.682184404e-12, 0.9999993937, 0.001101160437))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]))  # disabled
plane_116 = Plane(flatten([PlaneXY(2058.996642, -590.7684993, 174.9883092), Plane(origin=(2058.996642, -590.7684993, 124.9883092), x=(0.9999993871, 1.21913075e-06, -0.001107140836), y=(0, 0.9999993937, 0.001101151689)), Plane(origin=(2058.996642, -590.7684993, 124.9883092), x=(0.9999993871, 1.21913075e-06, -0.001107140836), y=(0, 0.9999993937, 0.001101151689)), Plane(origin=(2058.996059, -248.5407067, 125.3651547), x=(0.9999993871, 1.21913075e-06, -0.001107140836), y=(0, 0.9999993937, 0.001101151689)), Plane(origin=(2058.996059, -248.5407067, 125.3651547), x=(0.9999993871, 1.21913075e-06, -0.001107140836), y=(0, 0.9999993937, 0.001101151689)), Plane(origin=(2058.996059, -248.5407068, 125.3651547), x=(0.9999993871, 1.219130736e-06, -0.001107140819), y=(9.671083472e-12, 0.9999993937, 0.001101160437))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]))  # disabled
plane_117 = Plane(flatten([PlaneXY(2058.996205, -949.996283, 174.5941607), Plane(origin=(2058.996205, -949.996283, 124.5941607), x=(0.9999993871, 1.219130698e-06, -0.001107140836), y=(0, 0.9999993937, 0.001101151555)), Plane(origin=(2058.996205, -949.996283, 124.5941607), x=(0.9999993871, 1.219130698e-06, -0.001107140836), y=(0, 0.9999993937, 0.001101151555)), Plane(origin=(2058.996623, -607.7684905, 124.9710052), x=(0.9999993871, 1.219130698e-06, -0.001107140836), y=(0, 0.9999993937, 0.001101151555)), Plane(origin=(2058.996623, -607.7684905, 124.9710052), x=(0.9999993871, 1.219130698e-06, -0.001107140836), y=(0, 0.9999993937, 0.001101151555)), Plane(origin=(2058.996623, -607.7684905, 124.9710052), x=(0.9999993871, 1.219130678e-06, -0.001107140819), y=(9.581269007e-12, 0.9999993937, 0.001101160303))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]))  # disabled
plane_118 = Plane()  # disabled
plane_119 = Plane()  # disabled
plane_120 = Plane()  # disabled
plane_121 = Plane()  # disabled
merge_10 = Merge(
    Data1=plane_110,
    Data2=plane_111,
    Data3=plane_112,
    Data4=plane_113,
    Data5=plane_114,
    Data6=plane_115,
    Data7=plane_116,
    Data8=plane_117,
    Data9=plane_118,
    Data10=plane_119,
    Data11=plane_120,
    Data12=plane_121)  # disabled

# ----
# Sheet 3: tan in & tan out
rotation_remap_domain_start_7 = Slider(-60, range=-180..180)  # disabled
rotation_remap_domain_end_7 = Slider(0, range=-180..180)  # disabled
plane_122 = Plane(flatten([PlaneXY(2370.994353, -949.9946312, 172.7485891), Plane(origin=(2370.994353, -949.9946312, 122.7485891), x=(0.9999993871, 1.219130763e-06, -0.001107140836), y=(0, 0.9999993937, 0.001101151817)), Plane(origin=(2370.994353, -949.9946312, 122.7485891), x=(0.9999993871, 1.219130763e-06, -0.001107140836), y=(0, 0.9999993937, 0.001101151817)), Plane(origin=(2370.994771, -607.7668387, 123.1254337), x=(0.9999993871, 1.219130763e-06, -0.001107140836), y=(0, 0.9999993937, 0.001101151817)), Plane(origin=(2370.994771, -607.7668387, 123.1254337), x=(0.9999993871, 1.219130763e-06, -0.001107140836), y=(0, 0.9999993937, 0.001101151817)), Plane(origin=(2370.994771, -607.7668386, 123.1254337), x=(0.9999993871, 1.219130784e-06, -0.001107140853), y=(-9.390643572e-12, 0.9999993937, 0.001101143229))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]))  # disabled
plane_123 = Plane(flatten([PlaneXY(2370.994791, -590.7668483, 173.1435177), Plane(origin=(2370.994791, -590.7668483, 123.1435177), x=(0.9999993871, 1.219130763e-06, -0.001107140836), y=(0, 0.9999993937, 0.001101151817)), Plane(origin=(2370.994791, -590.7668483, 123.1435177), x=(0.9999993871, 1.219130763e-06, -0.001107140836), y=(0, 0.9999993937, 0.001101151817)), Plane(origin=(2370.994208, -248.5390557, 123.5203634), x=(0.9999993871, 1.219130763e-06, -0.001107140836), y=(0, 0.9999993937, 0.001101151817)), Plane(origin=(2370.994208, -248.5390557, 123.5203634), x=(0.9999993871, 1.219130763e-06, -0.001107140836), y=(0, 0.9999993937, 0.001101151817)), Plane(origin=(2370.994208, -248.5390557, 123.5203634), x=(0.9999993871, 1.219130784e-06, -0.001107140853), y=(-9.390643572e-12, 0.9999993937, 0.001101143229))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]))  # disabled
plane_124 = Plane(flatten([PlaneXY(2370.994228, -231.539066, 173.5390537), Plane(origin=(2370.994228, -231.539066, 123.5390537), x=(0.9999993871, 1.219130763e-06, -0.001107140836), y=(0, 0.9999993937, 0.001101151817)), Plane(origin=(2370.994228, -231.539066, 123.5390537), x=(0.9999993871, 1.219130763e-06, -0.001107140836), y=(0, 0.9999993937, 0.001101151817)), Plane(origin=(2370.994646, 110.6877265, 123.9158971), x=(0.9999993871, 1.219130763e-06, -0.001107140836), y=(0, 0.9999993937, 0.001101151817)), Plane(origin=(2370.994646, 110.6877265, 123.9158971), x=(0.9999993871, 1.219130763e-06, -0.001107140836), y=(0, 0.9999993937, 0.001101151817)), Plane(origin=(2370.994646, 110.6877265, 123.9158971), x=(0.9999993871, 1.219130784e-06, -0.001107140853), y=(-9.390643572e-12, 0.9999993937, 0.001101143229))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]))  # disabled
plane_125 = Plane(flatten([PlaneXY(2370.994667, 127.6877161, 173.9347266), Plane(origin=(2370.994667, 127.6877161, 123.9347266), x=(0.9999993871, 1.219130763e-06, -0.001107140836), y=(0, 0.9999993937, 0.001101151817)), Plane(origin=(2370.994667, 127.6877161, 123.9347266), x=(0.9999993871, 1.219130763e-06, -0.001107140836), y=(0, 0.9999993937, 0.001101151817)), Plane(origin=(2370.994084, 469.9155086, 124.3115723), x=(0.9999993871, 1.219130763e-06, -0.001107140836), y=(0, 0.9999993937, 0.001101151817)), Plane(origin=(2370.994084, 469.9155086, 124.3115723), x=(0.9999993871, 1.219130763e-06, -0.001107140836), y=(0, 0.9999993937, 0.001101151817)), Plane(origin=(2370.994084, 469.9155086, 124.3115723), x=(0.9999993871, 1.219130784e-06, -0.001107140853), y=(-9.390643572e-12, 0.9999993937, 0.001101143229))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]))  # disabled
plane_126 = Plane(flatten([PlaneXY(2058.994545, -949.9946313, 173.0941626), Plane(origin=(2058.994545, -949.9946313, 123.0941626), x=(0.9999993871, 1.219130768e-06, -0.001107140853), y=(-9.375063381e-12, 0.9999993937, 0.001101143229)), Plane(origin=(2058.994545, -949.9946313, 123.0941626), x=(0.9999993871, 1.219130768e-06, -0.001107140853), y=(-9.375063381e-12, 0.9999993937, 0.001101143229)), Plane(origin=(1820.993691, -949.9956313, 123.3576624), x=(0.9999993871, 1.219130768e-06, -0.001107140853), y=(-9.375063381e-12, 0.9999993937, 0.001101143229)), Plane(origin=(1820.993691, -949.9956313, 123.3576624), x=(0.9999993871, 1.219130768e-06, -0.001107140853), y=(-9.375063381e-12, 0.9999993937, 0.001101143229)), Plane(origin=(1822.926545, -949.9949842, 122.7729827), x=(0.832947949, 0.0006086988888, -0.5533510132), y=(0, 0.999999395, 0.00110002242))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]))  # disabled
plane_127 = Plane(flatten([PlaneXY(2058.994981, -590.7668475, 173.488311), Plane(origin=(2058.994981, -590.7668475, 123.488311), x=(0.9999993871, 1.219130768e-06, -0.001107140853), y=(-9.375063382e-12, 0.9999993937, 0.001101143229)), Plane(origin=(2058.994981, -590.7668475, 123.488311), x=(0.9999993871, 1.219130768e-06, -0.001107140853), y=(-9.375063382e-12, 0.9999993937, 0.001101143229)), Plane(origin=(1820.993127, -590.7678475, 123.7518119), x=(0.9999993871, 1.219130768e-06, -0.001107140853), y=(-9.375063382e-12, 0.9999993937, 0.001101143229)), Plane(origin=(1820.993127, -590.7678475, 123.7518119), x=(0.9999993871, 1.219130768e-06, -0.001107140853), y=(-9.375063382e-12, 0.9999993937, 0.001101143229)), Plane(origin=(1822.925982, -590.7672061, 123.1671323), x=(0.832947949, 0.0006097712563, -0.553351012), y=(0, 0.9999993928, 0.00110196037))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]))  # disabled
plane_128 = Plane(flatten([PlaneXY(2058.99442, -231.5390664, 173.8848672), Plane(origin=(2058.99442, -231.5390664, 123.8848672), x=(0.9999993871, 1.219130768e-06, -0.001107140853), y=(-9.375063382e-12, 0.9999993937, 0.001101143229)), Plane(origin=(2058.99442, -231.5390664, 123.8848672), x=(0.9999993871, 1.219130768e-06, -0.001107140853), y=(-9.375063382e-12, 0.9999993937, 0.001101143229)), Plane(origin=(1820.993566, -231.5400664, 124.1483671), x=(0.9999993871, 1.219130768e-06, -0.001107140853), y=(-9.375063382e-12, 0.9999993937, 0.001101143229)), Plane(origin=(1820.993566, -231.5400664, 124.1483671), x=(0.9999993871, 1.219130768e-06, -0.001107140853), y=(-9.375063382e-12, 0.9999993937, 0.001101143229)), Plane(origin=(1822.926421, -231.5394193, 123.5636874), x=(0.832947949, 0.0006086988888, -0.5533510132), y=(0, 0.999999395, 0.00110002242))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]))  # disabled
plane_129 = Plane(flatten([PlaneXY(2058.994858, 127.6877154, 174.2807689), Plane(origin=(2058.994858, 127.6877154, 124.2807689), x=(0.9999993871, 1.219130768e-06, -0.001107140853), y=(-9.375063383e-12, 0.9999993937, 0.001101143229)), Plane(origin=(2058.994858, 127.6877154, 124.2807689), x=(0.9999993871, 1.219130768e-06, -0.001107140853), y=(-9.375063383e-12, 0.9999993937, 0.001101143229)), Plane(origin=(1820.993004, 127.6867154, 124.5442698), x=(0.9999993871, 1.219130768e-06, -0.001107140853), y=(-9.375063383e-12, 0.9999993937, 0.001101143229)), Plane(origin=(1820.993004, 127.6867154, 124.5442698), x=(0.9999993871, 1.219130768e-06, -0.001107140853), y=(-9.375063383e-12, 0.9999993937, 0.001101143229)), Plane(origin=(1822.925859, 127.6873569, 123.9595902), x=(0.832947949, 0.0006097712563, -0.553351012), y=(0, 0.9999993928, 0.00110196037))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]))  # disabled
plane_130 = Plane()  # disabled
plane_131 = Plane()  # disabled
plane_132 = Plane()  # disabled
plane_133 = Plane()  # disabled
merge_11 = Merge(
    Data1=plane_122,
    Data2=plane_123,
    Data3=plane_124,
    Data4=plane_125,
    Data5=plane_126,
    Data6=plane_127,
    Data7=plane_128,
    Data8=plane_129,
    Data9=plane_130,
    Data10=plane_131,
    Data11=plane_132,
    Data12=plane_133)  # disabled

# ----
# Sheet 3: tan in & tan out
plane_134 = Plane()  # disabled
plane_135 = Plane(flatten([PlaneXY(2370.994353, -949.9946312, 172.7485891), Plane(origin=(2370.994353, -949.9946312, 122.7485891), x=(0.9999993871, 1.219130743e-06, -0.001107140836), y=(0, 0.9999993937, 0.001101151817)), Plane(origin=(2370.994353, -949.9946312, 122.7485891), x=(0.9999993871, 1.219130743e-06, -0.001107140836), y=(0, 0.9999993937, 0.001101151817)), Plane(origin=(2370.994771, -607.7668387, 123.1254337), x=(0.9999993871, 1.219130743e-06, -0.001107140836), y=(0, 0.9999993937, 0.001101151817)), Plane(origin=(2370.994771, -607.7668387, 123.1254337), x=(0.9999993871, 1.219130743e-06, -0.001107140836), y=(0, 0.9999993937, 0.001101151817)), Plane(origin=(2370.994771, -607.7668386, 123.1254337), x=(0.9999993871, 1.21913077e-06, -0.001107140854), y=(-9.375089969e-12, 0.9999993937, 0.00110114323))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]))  # disabled
plane_136 = Plane(flatten([PlaneXY(2370.994791, -590.7668483, 173.1435177), Plane(origin=(2370.994791, -590.7668483, 123.1435177), x=(0.9999993871, 1.219130743e-06, -0.001107140836), y=(0, 0.9999993937, 0.001101151817)), Plane(origin=(2370.994791, -590.7668483, 123.1435177), x=(0.9999993871, 1.219130743e-06, -0.001107140836), y=(0, 0.9999993937, 0.001101151817)), Plane(origin=(2370.994208, -248.5390557, 123.5203634), x=(0.9999993871, 1.219130743e-06, -0.001107140836), y=(0, 0.9999993937, 0.001101151817)), Plane(origin=(2370.994208, -248.5390557, 123.5203634), x=(0.9999993871, 1.219130743e-06, -0.001107140836), y=(0, 0.9999993937, 0.001101151817)), Plane(origin=(2370.994208, -248.5390557, 123.5203634), x=(0.9999993871, 1.21913077e-06, -0.001107140854), y=(-9.37508998e-12, 0.9999993937, 0.00110114323))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]))  # disabled
plane_137 = Plane(flatten([PlaneXY(2370.994228, -231.539066, 173.5390537), Plane(origin=(2370.994228, -231.539066, 123.5390537), x=(0.9999993871, 1.219130743e-06, -0.001107140836), y=(0, 0.9999993937, 0.001101151817)), Plane(origin=(2370.994228, -231.539066, 123.5390537), x=(0.9999993871, 1.219130743e-06, -0.001107140836), y=(0, 0.9999993937, 0.001101151817)), Plane(origin=(2370.994646, 110.6877265, 123.9158971), x=(0.9999993871, 1.219130743e-06, -0.001107140836), y=(0, 0.9999993937, 0.001101151817)), Plane(origin=(2370.994646, 110.6877265, 123.9158971), x=(0.9999993871, 1.219130743e-06, -0.001107140836), y=(0, 0.9999993937, 0.001101151817)), Plane(origin=(2370.994646, 110.6877265, 123.9158971), x=(0.9999993871, 1.21913077e-06, -0.001107140854), y=(-9.375089969e-12, 0.9999993937, 0.00110114323))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]))  # disabled
plane_138 = Plane(flatten([PlaneXY(2370.994667, 127.6877161, 173.9347266), Plane(origin=(2370.994667, 127.6877161, 123.9347266), x=(0.9999993871, 1.219130743e-06, -0.001107140836), y=(0, 0.9999993937, 0.001101151817)), Plane(origin=(2370.994667, 127.6877161, 123.9347266), x=(0.9999993871, 1.219130743e-06, -0.001107140836), y=(0, 0.9999993937, 0.001101151817)), Plane(origin=(2370.994084, 469.9155086, 124.3115723), x=(0.9999993871, 1.219130743e-06, -0.001107140836), y=(0, 0.9999993937, 0.001101151817)), Plane(origin=(2370.994084, 469.9155086, 124.3115723), x=(0.9999993871, 1.219130743e-06, -0.001107140836), y=(0, 0.9999993937, 0.001101151817)), Plane(origin=(2370.994084, 469.9155086, 124.3115723), x=(0.9999993871, 1.21913077e-06, -0.001107140854), y=(-9.37508998e-12, 0.9999993937, 0.00110114323))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]))  # disabled
plane_139 = Plane(flatten([PlaneXY(2064.993541, -949.9946313, 173.0875208), Plane(origin=(2064.993541, -949.9946313, 123.0875208), x=(0.9999993871, 1.21913077e-06, -0.001107140853), y=(-9.499438324e-12, 0.9999993937, 0.001101143119)), Plane(origin=(2064.993541, -949.9946313, 123.0875208), x=(0.9999993871, 1.21913077e-06, -0.001107140853), y=(-9.499438324e-12, 0.9999993937, 0.001101143119)), Plane(origin=(1820.993691, -949.9956313, 123.3576624), x=(0.9999993871, 1.21913077e-06, -0.001107140853), y=(-9.499438324e-12, 0.9999993937, 0.001101143119)), Plane(origin=(1820.993691, -949.9956313, 123.3576624), x=(0.9999993871, 1.21913077e-06, -0.001107140853), y=(-9.499438324e-12, 0.9999993937, 0.001101143119)), Plane(origin=(1822.926545, -949.9949842, 122.7729827), x=(0.832947949, 0.0006086988274, -0.5533510132), y=(0, 0.999999395, 0.001100022309))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]))  # disabled
plane_140 = Plane(flatten([PlaneXY(2064.992977, -590.7668475, 173.4816703), Plane(origin=(2064.992977, -590.7668475, 123.4816703), x=(0.9999993871, 1.21913077e-06, -0.001107140853), y=(-9.499438324e-12, 0.9999993937, 0.001101143119)), Plane(origin=(2064.992977, -590.7668475, 123.4816703), x=(0.9999993871, 1.21913077e-06, -0.001107140853), y=(-9.499438324e-12, 0.9999993937, 0.001101143119)), Plane(origin=(1820.993127, -590.7678475, 123.7518119), x=(0.9999993871, 1.21913077e-06, -0.001107140853), y=(-9.499438324e-12, 0.9999993937, 0.001101143119)), Plane(origin=(1820.993127, -590.7678475, 123.7518119), x=(0.9999993871, 1.21913077e-06, -0.001107140853), y=(-9.499438324e-12, 0.9999993937, 0.001101143119)), Plane(origin=(1822.925982, -590.7672061, 123.1671323), x=(0.832947949, 0.0006097711949, -0.553351012), y=(0, 0.9999993928, 0.001101960259))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]))  # disabled
plane_141 = Plane(flatten([PlaneXY(2064.993416, -231.5390664, 173.8782255), Plane(origin=(2064.993416, -231.5390664, 123.8782255), x=(0.9999993871, 1.21913077e-06, -0.001107140853), y=(-9.499438319e-12, 0.9999993937, 0.001101143119)), Plane(origin=(2064.993416, -231.5390664, 123.8782255), x=(0.9999993871, 1.21913077e-06, -0.001107140853), y=(-9.499438319e-12, 0.9999993937, 0.001101143119)), Plane(origin=(1820.993566, -231.5400664, 124.1483671), x=(0.9999993871, 1.21913077e-06, -0.001107140853), y=(-9.499438319e-12, 0.9999993937, 0.001101143119)), Plane(origin=(1820.993566, -231.5400664, 124.1483671), x=(0.9999993871, 1.21913077e-06, -0.001107140853), y=(-9.499438319e-12, 0.9999993937, 0.001101143119)), Plane(origin=(1822.926421, -231.5394193, 123.5636874), x=(0.832947949, 0.0006086988274, -0.5533510132), y=(0, 0.999999395, 0.001100022309))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]))  # disabled
plane_142 = Plane(flatten([PlaneXY(2064.992855, 127.6877154, 174.2741282), Plane(origin=(2064.992855, 127.6877154, 124.2741282), x=(0.9999993871, 1.21913077e-06, -0.001107140853), y=(-9.499438314e-12, 0.9999993937, 0.001101143119)), Plane(origin=(2064.992855, 127.6877154, 124.2741282), x=(0.9999993871, 1.21913077e-06, -0.001107140853), y=(-9.499438314e-12, 0.9999993937, 0.001101143119)), Plane(origin=(1820.993004, 127.6867154, 124.5442698), x=(0.9999993871, 1.21913077e-06, -0.001107140853), y=(-9.499438314e-12, 0.9999993937, 0.001101143119)), Plane(origin=(1820.993004, 127.6867154, 124.5442698), x=(0.9999993871, 1.21913077e-06, -0.001107140853), y=(-9.499438314e-12, 0.9999993937, 0.001101143119)), Plane(origin=(1822.925859, 127.6873569, 123.9595902), x=(0.832947949, 0.0006097711949, -0.553351012), y=(0, 0.9999993928, 0.001101960259))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]))  # disabled
plane_143 = Plane()  # disabled
plane_144 = Plane()  # disabled
plane_145 = Plane()  # disabled
merge_12 = Merge(
    Data1=plane_135,
    Data2=plane_136,
    Data3=plane_137,
    Data4=plane_138,
    Data5=plane_139,
    Data6=plane_140,
    Data7=plane_141,
    Data8=plane_142,
    Data9=plane_143,
    Data10=plane_144,
    Data11=plane_145,
    Data12=plane_134)  # disabled

# ----
# Sheet 3: tan in & tan out
plane_146 = Plane(flatten([PlaneXY(2370.994353, -949.9946311, 172.7485892), Plane(origin=(2370.994353, -949.9946311, 122.7485892), x=(0.9999993871, 1.219130674e-06, -0.001107140836), y=(0, 0.9999993937, 0.001101151613)), Plane(origin=(2370.994353, -949.9946311, 122.7485892), x=(0.9999993871, 1.219130674e-06, -0.001107140836), y=(0, 0.9999993937, 0.001101151613)), Plane(origin=(2370.99477, -607.7668386, 123.1254336), x=(0.9999993871, 1.219130674e-06, -0.001107140836), y=(0, 0.9999993937, 0.001101151613)), Plane(origin=(2370.99477, -607.7668386, 123.1254336), x=(0.9999993871, 1.219130674e-06, -0.001107140836), y=(0, 0.9999993937, 0.001101151613)), Plane(origin=(2370.99477, -607.7668387, 123.1254336), x=(0.9999993871, 1.219130592e-06, -0.001107140785), y=(2.821454084e-11, 0.9999993937, 0.00110117709))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]))  # disabled
plane_147 = Plane(flatten([PlaneXY(2370.994791, -590.7668482, 173.1435177), Plane(origin=(2370.994791, -590.7668482, 123.1435177), x=(0.9999993871, 1.219130674e-06, -0.001107140836), y=(0, 0.9999993937, 0.001101151613)), Plane(origin=(2370.994791, -590.7668482, 123.1435177), x=(0.9999993871, 1.219130674e-06, -0.001107140836), y=(0, 0.9999993937, 0.001101151613)), Plane(origin=(2370.994208, -248.5390557, 123.5203633), x=(0.9999993871, 1.219130674e-06, -0.001107140836), y=(0, 0.9999993937, 0.001101151613)), Plane(origin=(2370.994208, -248.5390557, 123.5203633), x=(0.9999993871, 1.219130674e-06, -0.001107140836), y=(0, 0.9999993937, 0.001101151613)), Plane(origin=(2370.994208, -248.5390558, 123.5203633), x=(0.9999993871, 1.219130592e-06, -0.001107140785), y=(2.821454084e-11, 0.9999993937, 0.00110117709))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]))  # disabled
plane_148 = Plane(flatten([PlaneXY(2370.994228, -231.539066, 173.5390537), Plane(origin=(2370.994228, -231.539066, 123.5390537), x=(0.9999993871, 1.219130669e-06, -0.001107140836), y=(0, 0.9999993937, 0.001101151613)), Plane(origin=(2370.994228, -231.539066, 123.5390537), x=(0.9999993871, 1.219130669e-06, -0.001107140836), y=(0, 0.9999993937, 0.001101151613)), Plane(origin=(2370.994646, 110.6877265, 123.915897), x=(0.9999993871, 1.219130669e-06, -0.001107140836), y=(0, 0.9999993937, 0.001101151613)), Plane(origin=(2370.994646, 110.6877265, 123.915897), x=(0.9999993871, 1.219130669e-06, -0.001107140836), y=(0, 0.9999993937, 0.001101151613)), Plane(origin=(2370.994646, 110.6877264, 123.915897), x=(0.9999993871, 1.219130592e-06, -0.001107140785), y=(2.821454084e-11, 0.9999993937, 0.00110117709))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]))  # disabled
plane_149 = Plane(flatten([PlaneXY(2370.994666, 127.6877161, 173.9347266), Plane(origin=(2370.994666, 127.6877161, 123.9347266), x=(0.9999993871, 1.219130669e-06, -0.001107140836), y=(0, 0.9999993937, 0.001101151613)), Plane(origin=(2370.994666, 127.6877161, 123.9347266), x=(0.9999993871, 1.219130669e-06, -0.001107140836), y=(0, 0.9999993937, 0.001101151613)), Plane(origin=(2370.994084, 469.9155086, 124.3115722), x=(0.9999993871, 1.219130669e-06, -0.001107140836), y=(0, 0.9999993937, 0.001101151613)), Plane(origin=(2370.994084, 469.9155086, 124.3115722), x=(0.9999993871, 1.219130669e-06, -0.001107140836), y=(0, 0.9999993937, 0.001101151613)), Plane(origin=(2370.994084, 469.9155085, 124.3115722), x=(0.9999993871, 1.219130592e-06, -0.001107140785), y=(2.821454084e-11, 0.9999993937, 0.00110117709))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]))  # disabled
plane_150 = Plane(flatten([PlaneXY(2058.994545, -949.9946314, 173.0941627), Plane(origin=(2058.994545, -949.9946314, 123.0941627), x=(0.9999993871, 1.219130721e-06, -0.001107140786), y=(2.808640764e-11, 0.9999993937, 0.00110117709)), Plane(origin=(2058.994545, -949.9946314, 123.0941627), x=(0.9999993871, 1.219130721e-06, -0.001107140786), y=(2.808640764e-11, 0.9999993937, 0.00110117709)), Plane(origin=(1820.993691, -949.9956314, 123.3576625), x=(0.9999993871, 1.219130721e-06, -0.001107140786), y=(2.808640764e-11, 0.9999993937, 0.00110117709)), Plane(origin=(1820.993691, -949.9956314, 123.3576625), x=(0.9999993871, 1.219130721e-06, -0.001107140786), y=(2.808640764e-11, 0.9999993937, 0.00110117709)), Plane(origin=(1822.926545, -949.9949842, 122.7729828), x=(0.832947949, 0.0006086987762, -0.5533510132), y=(0, 0.999999395, 0.001100022216))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]))  # disabled
plane_151 = Plane(flatten([PlaneXY(2058.994981, -590.7668476, 173.4883111), Plane(origin=(2058.994981, -590.7668476, 123.4883111), x=(0.9999993871, 1.219130721e-06, -0.001107140786), y=(2.808640764e-11, 0.9999993937, 0.00110117709)), Plane(origin=(2058.994981, -590.7668476, 123.4883111), x=(0.9999993871, 1.219130721e-06, -0.001107140786), y=(2.808640764e-11, 0.9999993937, 0.00110117709)), Plane(origin=(1820.993127, -590.7678476, 123.751812), x=(0.9999993871, 1.219130721e-06, -0.001107140786), y=(2.808640764e-11, 0.9999993937, 0.00110117709)), Plane(origin=(1820.993127, -590.7678476, 123.751812), x=(0.9999993871, 1.219130721e-06, -0.001107140786), y=(2.808640764e-11, 0.9999993937, 0.00110117709)), Plane(origin=(1822.925982, -590.7672061, 123.1671323), x=(0.832947949, 0.0006097711437, -0.553351012), y=(0, 0.9999993928, 0.001101960167))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]))  # disabled
plane_152 = Plane(flatten([PlaneXY(2058.99442, -231.5390665, 173.8848673), Plane(origin=(2058.99442, -231.5390665, 123.8848673), x=(0.9999993871, 1.219130721e-06, -0.001107140786), y=(2.808640764e-11, 0.9999993937, 0.00110117709)), Plane(origin=(2058.99442, -231.5390665, 123.8848673), x=(0.9999993871, 1.219130721e-06, -0.001107140786), y=(2.808640764e-11, 0.9999993937, 0.00110117709)), Plane(origin=(1820.993566, -231.5400665, 124.1483671), x=(0.9999993871, 1.219130721e-06, -0.001107140786), y=(2.808640764e-11, 0.9999993937, 0.00110117709)), Plane(origin=(1820.993566, -231.5400665, 124.1483671), x=(0.9999993871, 1.219130721e-06, -0.001107140786), y=(2.808640764e-11, 0.9999993937, 0.00110117709)), Plane(origin=(1822.926421, -231.5394193, 123.5636875), x=(0.832947949, 0.0006086987762, -0.5533510132), y=(0, 0.999999395, 0.001100022216))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]))  # disabled
plane_153 = Plane()  # disabled
plane_154 = Plane()  # disabled
plane_155 = Plane()  # disabled
plane_156 = Plane()  # disabled
plane_157 = Plane()  # disabled
merge_13 = Merge(
    Data1=plane_146,
    Data2=plane_147,
    Data3=plane_148,
    Data4=plane_149,
    Data5=plane_150,
    Data6=plane_151,
    Data7=plane_152,
    Data8=plane_153,
    Data9=plane_154,
    Data10=plane_155,
    Data11=plane_156,
    Data12=plane_157)  # disabled

# ----
# Sheet 3
number_slider_5 = Slider(6, range=0..20)  # disabled
# Circle 3
# Section 1
number_slider_6 = Slider(18, range=0..200)  # disabled
geometry_39 = Geometry([<curve referenced from the Rhino model> x28])  # disabled
curve_3 = Curve()  # disabled
cluster_3 = Cluster_2(geometry=geometry_39, factor=number_slider_5, curve=curve_3)  # -> screw_location, result; disabled
text_tag_3d_3 = TextTag3D(Location=graft(cluster_3.screw_location), Text=cluster_3.result, Size=number_slider_6, Justification=2)  # disabled

# ---- group: 2_tan in & tan out stock
geometry_40 = Geometry(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)  # disabled

# ---- group: 2_tan in & tan out geo
geometry_41 = Geometry([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])  # disabled

# ---- group: 3_tan in & tan out stock
geometry_42 = Geometry(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)  # disabled

# ---- group: 3_tan in & tan out geo
geometry_43 = Geometry([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])  # disabled

# ---- group: 2_radial geo
geometry_44 = Geometry([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])  # disabled

# ---- group: 2_radial stock
# Section 2
# Sheet 1: radial
geometry_45 = Geometry(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)  # disabled

# ---- group: 1_radial stock
# Sheet 1: radial
geometry_46 = Geometry(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)  # disabled

# ---- group: 1_radial geo
geometry_47 = Geometry([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])  # disabled

# ---- group: 3_radial stock
# Section 3
# Sheet 1: radial
geometry_48 = Geometry(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)  # disabled

# ---- group: 3_radial geo
geometry_49 = Geometry([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])  # disabled

# ---- group: 4_radial stock
# Section 4
# Sheet 1: radial
geometry_50 = Geometry(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)  # disabled

# ---- group: 4_radial geo
geometry_51 = Geometry([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])  # disabled

# ---- group: 1_tan in & tan out stock
geometry_52 = Geometry(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)  # disabled

# ---- group: 1_tan in & tan out geo
geometry_53 = Geometry([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])  # disabled

# ---- group: 4_tan in & tan out stock
geometry_54 = Geometry(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)  # disabled

# ---- group: 4_tan in & tan out geo
geometry_55 = Geometry([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])  # disabled

# ---- group: stock
geometry_56 = Geometry(geometry_21)

# ---- group: ordered geo
geometry_57 = Geometry(list_item)

# ----
# fix invalid surfaces
brep = Brep(geometry_57)
deconstruct_brep = DeconstructBrep(Brep=brep)  # -> Faces, Edges, Vertices
null_item = NullItem(Item=deconstruct_brep.Faces)  # -> NullFlags, InvalidFlags, Description
dispatch = Dispatch(List=deconstruct_brep.Faces, DispatchPattern=null_item.InvalidFlags)  # -> ListA, ListB
deconstruct_brep_2 = DeconstructBrep(Brep=dispatch.ListA)  # -> Faces, simplify(Edges), Vertices
boundary_surfaces = BoundarySurfaces(Edges=deconstruct_brep_2.Edges)  # -> simplify(Surfaces)
shift_paths = ShiftPaths(Data=boundary_surfaces, Offset=-1)
weave = Weave(Pattern=null_item.InvalidFlags, Stream0=dispatch.ListB, Stream1=shift_paths, NullGaps=False)  # -> flatten(Weave)
brep_join = BrepJoin(Breps=weave)  # -> Breps, Closed

# ---- group: 2_tangent stock
# Sheet 2: tangent
geometry_58 = Geometry(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)  # disabled

# ---- group: 2_tangent geo
geometry_59 = Geometry([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])  # disabled

# ---- group: 3_tangent stock
# Sheet 2: tangent
geometry_60 = Geometry(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)  # disabled

# ---- group: 3_tangent geo
geometry_61 = Geometry([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])  # disabled

# ---- group: 1_tangent stock
# Sheet 2: tangent
geometry_62 = Geometry(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)  # disabled

# ---- group: 1_tangent geo
geometry_63 = Geometry([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])  # disabled

# ---- group: 4_tangent stock
# Sheet 2: tangent
geometry_64 = Geometry(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)  # disabled

# ---- group: 4_tangent geo
geometry_65 = Geometry([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])  # disabled

# ----
# internalize frames
plane_158 = Plane(flatten([PlaneXY(2063.279389, -958.0124357, 181.0804545), Plane(origin=(2063.279389, -958.0124357, 131.0804545), x=(0.9999993871, 1.21913077e-06, -0.001107140853), y=(-7.65780696e-12, 0.9999993937, 0.001101144782)), Plane(origin=(2063.279389, -958.0124357, 131.0804545), x=(0.9999993871, 1.21913077e-06, -0.001107140853), y=(-7.65780696e-12, 0.9999993937, 0.001101144782)), Plane(origin=(1819.279539, -958.0134357, 131.3505961), x=(0.9999993871, 1.21913077e-06, -0.001107140853), y=(-7.65780696e-12, 0.9999993937, 0.001101144782)), Plane(origin=(1819.279539, -958.0134357, 131.3505961), x=(0.9999993871, 1.21913077e-06, -0.001107140853), y=(-7.65780696e-12, 0.9999993937, 0.001101144782)), Plane(origin=(1821.212394, -958.0127886, 130.7659164), x=(0.832947949, 0.0006086997516, -0.5533510132), y=(0, 0.999999395, 0.001100023979))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]))
plane_159 = Plane(flatten([PlaneXY(2045.919874, -569.2946714, 181.5277114), Plane(origin=(2045.919874, -569.2946714, 131.5277114), x=(0.9999993871, 1.219130756e-06, -0.001107140836), y=(1.617398756e-12, 0.9999993937, 0.001101153164)), Plane(origin=(2045.919874, -569.2946714, 131.5277114), x=(0.9999993871, 1.219130756e-06, -0.001107140836), y=(1.617398756e-12, 0.9999993937, 0.001101153164)), Plane(origin=(2045.919291, -227.0668789, 131.9045575), x=(0.9999993871, 1.219130756e-06, -0.001107140836), y=(1.617398756e-12, 0.9999993937, 0.001101153164)), Plane(origin=(2045.919291, -227.0668789, 131.9045575), x=(0.9999993871, 1.219130756e-06, -0.001107140836), y=(1.617398756e-12, 0.9999993937, 0.001101153164)), Plane(origin=(2045.919291, -227.0668788, 131.9045575), x=(0.9999993871, 1.219130778e-06, -0.001107140854), y=(-7.891978882e-12, 0.9999993937, 0.001101144577))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]))
plane_160 = Plane(flatten([PlaneXY(2054.271367, -160.9249197, 181.9681424), Plane(origin=(2054.271367, -160.9249197, 131.9681424), x=(0.9999993871, 1.219130753e-06, -0.001107140836), y=(7.974755497e-12, 0.9999993937, 0.001101158903)), Plane(origin=(2054.271367, -160.9249197, 131.9681424), x=(0.9999993871, 1.219130753e-06, -0.001107140836), y=(7.974755497e-12, 0.9999993937, 0.001101158903)), Plane(origin=(2054.271679, 95.46292483, 132.250466), x=(0.9999993871, 1.219130753e-06, -0.001107140836), y=(7.974755497e-12, 0.9999993937, 0.001101158903)), Plane(origin=(2054.271679, 95.46292483, 132.250466), x=(0.9999993871, 1.219130753e-06, -0.001107140836), y=(7.974755497e-12, 0.9999993937, 0.001101158903)), Plane(origin=(2054.271679, 95.46292486, 132.250466), x=(0.9999993871, 1.219130798e-06, -0.001107140881), y=(-1.469886927e-12, 0.9999993937, 0.001101150369))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]))
plane_161 = Plane(flatten([PlaneXY(2161.441669, 141.3328979, 182.1823215), Plane(origin=(2161.441669, 141.3328979, 132.1823215), x=(0.9999993871, 1.219130756e-06, -0.001107140836), y=(1.156119919e-12, 0.9999993937, 0.001101152747)), Plane(origin=(2161.441669, 141.3328979, 132.1823215), x=(0.9999993871, 1.219130756e-06, -0.001107140836), y=(1.156119919e-12, 0.9999993937, 0.001101152747)), Plane(origin=(2161.441877, 311.8817945, 132.3701218), x=(0.9999993871, 1.219130756e-06, -0.001107140836), y=(1.156119919e-12, 0.9999993937, 0.001101152747)), Plane(origin=(2161.441877, 311.8817945, 132.3701218), x=(0.9999993871, 1.219130756e-06, -0.001107140836), y=(1.156119919e-12, 0.9999993937, 0.001101152747)), Plane(origin=(2161.441877, 311.8817945, 132.3701218), x=(0.9999993871, 1.219130782e-06, -0.001107140861), y=(-8.165327807e-12, 0.9999993937, 0.001101144326))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]))
plane_162 = Plane()
plane_163 = Plane()
plane_164 = Plane()
plane_165 = Plane()
plane_166 = Plane(flatten([PlaneXY(2085.453367, -731.7282144, 203.610892), Plane(origin=(2085.453367, -731.7282144, 153.610892), x=(0.9999994104, -0.0002106699374, -0.001065237765), y=(0, 0.9809994915, -0.1940103029)), Plane(origin=(2085.43165, -735.6084182, 133.9909138), x=(0.9999994104, -0.0002106699374, -0.001065237765), y=(0, 0.9809994915, -0.1940103029)), Plane(origin=(2339.431494, -735.6081086, 133.7096995), x=(0.9999994104, -0.0002106699374, -0.001065237765), y=(0, 0.9809994915, -0.1940103029)), Plane(origin=(2339.429874, -728.2506122, 132.254624), x=(0.9999994104, -0.0002106699374, -0.001065237765), y=(0, 0.9809994915, -0.1940103029)), Plane(origin=(2085.43003, -728.2509218, 132.5358382), x=(0.9999994104, -0.0002106699374, -0.001065237765), y=(0, 0.9809994915, -0.1940103029))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]))
plane_167 = Plane(flatten([PlaneXY(2381.51329, -69.87860414, 204.0119079), Plane(origin=(2381.51329, -69.87860414, 154.0119079), x=(0.9999994104, 0.0002130154196, -0.001064771102), y=(0, 0.9805698358, 0.1961703267)), Plane(origin=(2381.491573, -65.95519991, 134.4005228), x=(0.9999994104, 0.0002130154196, -0.001064771102), y=(0, 0.9805698358, 0.1961703267)), Plane(origin=(2133.490093, -65.95550228, 134.6750959), x=(0.9999994104, 0.0002130154196, -0.001064771102), y=(0, 0.9805698358, 0.1961703267)), Plane(origin=(2133.488473, -73.30977625, 133.2038202), x=(0.9999994104, 0.0002130154196, -0.001064771102), y=(0, 0.9805698358, 0.1961703267)), Plane(origin=(2381.489953, -73.30947389, 132.9292471), x=(0.9999994104, 0.0002130154196, -0.001064771102), y=(0, 0.9805698358, 0.1961703267))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]))
plane_168 = Plane(flatten([PlaneXY(1922.318447, -160.9249193, 182.1142332), Plane(origin=(1922.318447, -160.9249193, 132.1142332), x=(0.9999993871, 1.219130804e-06, -0.001107140877), y=(-4.359424173e-12, 0.9999993937, 0.001101147768)), Plane(origin=(1922.318447, -160.9249193, 132.1142332), x=(0.9999993871, 1.219130804e-06, -0.001107140877), y=(-4.359424173e-12, 0.9999993937, 0.001101147768)), Plane(origin=(1819.279511, -160.9249193, 132.228312), x=(0.9999993871, 1.219130804e-06, -0.001107140877), y=(-4.359424173e-12, 0.9999993937, 0.001101147768)), Plane(origin=(1819.279511, -160.9249193, 132.228312), x=(0.9999993871, 1.219130804e-06, -0.001107140877), y=(-4.359424173e-12, 0.9999993937, 0.001101147768)), Plane(origin=(1820.14389, -160.9247966, 132.1189093), x=(0.9687414447, 0.0002729971138, -0.2480724466), y=(0, 0.9999993945, 0.001100472673))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]))
plane_169 = Plane()
merge_14 = Merge(
    Data1=plane_158,
    Data2=plane_166,
    Data3=plane_159,
    Data4=plane_167,
    Data5=plane_160,
    Data6=plane_168,
    Data7=plane_161,
    Data8=plane_162,
    Data9=plane_163,
    Data10=plane_164,
    Data11=plane_165,
    Data12=plane_169)

# ----
# sort radially
geometry_66 = Geometry()  # disabled
volume = Volume(Geometry=geometry_66)  # -> Volume, Centroid; disabled
average = Average(Input=volume.Centroid)  # disabled
deconstruct_2 = Deconstruct(Point=average)  # -> XComponent, YComponent, ZComponent; disabled
construct_point_2 = ConstructPoint(XCoordinate=deconstruct_2.XComponent, YCoordinate=deconstruct_2.YComponent, ZCoordinate=0)  # disabled
xy_plane = XYPlane(Origin=construct_point_2)  # disabled
radial_sort = RadialSort(
    pt=volume.Centroid,
    pl=xy_plane,
    TooltipDescriptionOverride="Sorts projected points radially about a plane's z axiz",
    TooltipTextOverride="Radial Sort")  # -> A; inputs pt: list of Point3d, pl: Plane; disabled
# ---------- radial_sort: VB ----------
    Component.Params.Input(0).Name = "Points"
    Component.Params.Input(0).Description = "List of Points to be sorted about a plane"
    Component.Params.Input(1).Name = "Plane"
    Component.Params.Input(1).Description = "Plane to sort points about"
    
    Component.Params.Output(0).Name = "Indices"
    Component.Params.Output(0).Description = "A list of the sorted index values"
    
    Dim i As Integer
    Dim arrAngle As New list(Of Double)
    Dim arrIndex As New list(Of Integer)
    Dim arrAng() As Double
    Dim arrInd() As Integer

    For i = 0 To pt.count() - 1 Step 1
      arrAngle.add(vector3d.VectorAngle((pl.ClosestPoint(pt.item(i)) - pl.Origin), pl.XAxis, pl))
      arrIndex.add(i)
    Next
    arrAng = arrAngle.toarray()
    arrInd = arrIndex.toarray()

    array.Sort(arrAng, arrInd)

    A = arrInd
# ---------- end radial_sort ----------
list_item_2 = ListItem(List=geometry_66, Index=radial_sort, Wrap=True)  # disabled

# ----
# Settings
path_selection = ValueList({"Perimeter cut only": 0, "Interior cut only": 1, "Combined": 2, "Hole Pattern": 3}, selected="Perimeter cut only")
value_list = ValueList({"no adjust": 0, "adjust short sides": 1}, selected="adjust short sides")
tool_radius = Slider(5, range=0..20)
leads_and_links_clearance = Slider(20, range=0..500)
approach_and_retract_clearance = Slider(50, range=0..500)
rotate_all_planes = Slider(-69, range=-360..360)  # disabled
piece = Slider(0, range=0..25)

# ---- group: tool radius
number = Number(tool_radius)

# ---- group: rotation domain
rotation_remap_domain_start_8 = Slider(-150, range=-180..180)
rotation_remap_domain_end_8 = Slider(0, range=-180..180)

# ----
plane_170 = Plane(flatten(plane_109))

# ----
# rotate planes individually by coordinate remap
deconstruct_plane = DeconstructPlane(Plane=plane_170)  # -> Origin, XAxis, YAxis, ZAxis
deconstruct_3 = Deconstruct(Point=deconstruct_plane.Origin)  # -> XComponent, YComponent, ZComponent
construct_domain = ConstructDomain(DomainStart=rotation_remap_domain_start_8, DomainEnd=rotation_remap_domain_end_8)
bounds = Bounds(Numbers=deconstruct_3.XComponent)
remap_numbers = RemapNumbers(Value=deconstruct_3.XComponent, Source=bounds, Target=construct_domain)  # -> Mapped, Clipped
rotate_plane = RotatePlane(Plane=plane_170, Angle=degrees(remap_numbers.Mapped))

brep_2 = Brep(brep_join.Breps)
list_item_3 = ListItem(List=brep_2, Index=piece, Wrap=True)

# ----
# orient biggest face on bottom
merge_faces = MergeFaces(Brep=list_item_3)  # -> Breps, Before, After
deconstruct_brep_3 = DeconstructBrep(Brep=merge_faces.Breps)  # -> Faces, Edges, Vertices
area_2 = Area(Geometry=deconstruct_brep_3.Faces)  # -> Area, Centroid
sort_list = SortList(Keys=area_2.Area, ValuesValuesA=deconstruct_brep_3.Faces)  # -> Keys, reverse(ValuesValuesA)
list_item_4 = ListItem(List=sort_list.ValuesValuesA, Index=0, Wrap=True)
volume_2 = Volume(Geometry=merge_faces.Breps)  # -> Volume, Centroid
area_3 = Area(Geometry=list_item_4)  # -> Area, Centroid
evaluate_surface = EvaluateSurface(Surface=reparameterize(list_item_4), Point="{0.5, 0.5, 0}")  # -> Point, Normal, UDirection, VDirection, Frame
vector_2pt = Vector2Pt(PointA=area_3.Centroid, PointB=volume_2.Centroid, Unitize=False)  # -> Vector, Length
vector_display = VectorDisplay(Anchor=evaluate_surface.Point, Vector=evaluate_surface.Normal)
reverse = Reverse(Vector=evaluate_surface.Normal)
vector = Vector(evaluate_surface.Normal)
merge_15 = Merge(Data1=vector, Data2=reverse)  # -> flatten(Result)
list_item_5 = ListItem(List=merge_15, Index=0, Wrap=True)
list_item_6 = ListItem(List=merge_15, Index=-1, Wrap=True)
angle = Angle(VectorA=vector_2pt.Vector, VectorB=list_item_5)  # -> Angle, Reflex
angle_2 = Angle(VectorA=vector_2pt.Vector, VectorB=list_item_6)  # -> Angle, Reflex
merge_16 = Merge(Data1=angle.Angle, Data2=angle_2.Angle)  # -> flatten(Result)
sort_list_2 = SortList(Keys=merge_16, ValuesValuesA=merge_15)  # -> Keys, ValuesValuesA
list_item_7 = ListItem(List=sort_list_2.ValuesValuesA, Index=0, Wrap=True)
plane_normal = PlaneNormal(Origin=evaluate_surface.Point, ZAxis=list_item_7)

# ----
# final planes
plane_171 = Plane(flatten(rotate_plane))

# ---- group: GROOVE OFFSET PER SIDE!!!
number_slider_7 = Slider(0.75, range=0..10)

# ----
pline = PolyLine(Vertices=plane_171, Closed=False)

# ---- group: tool radius
number_2 = Number(tool_radius)

# ----
ee = PredefinedSpindleEndEffector()
custom_preview = CustomPreview(Geometry=pline, Material=ColourSwatch(SwatchColor=RGB(94, 255, 255)))
subtraction = Subtraction(A=number_2, B=number_slider_7)
kuka_kr_125_2 = PredefinedKUKAKR1252(RobRootFrame=PlaneXY(0, 0, 0), EndEffectorOptional=ee)
iframe = InterpolateFrames(Frames=flatten(plane_171), Length=Slider(0.127848, range=0..1), Step=10, Reset=Toggle(True))  # -> Frame, Percent, CurrentIndex
deconstruct_plane_2 = DeconstructPlane(Plane=plane_170)  # -> Origin, XAxis, YAxis, ZAxis
panel = Panel("0")
robot_ik = RobotInverseKinematics(
    Robot=kuka_kr_125_2,
    TargetTCPFrame=iframe.Frame,
    AxisToggles=[Toggle(False), Toggle(False), Toggle(False)],
    useColorPreview=True)  # -> PoseGeometry, AxisValues, AxisFrames
list_length = ListLength(List=deconstruct_plane_2.ZAxis)
length = Length(Curve=pline)

tool_no = Panel("1")
spindle_speed_rpm = Panel("10000")
feed_mm_min = Panel("3200")
nc_settings = NCSettings(Tool=tool_no, Speed=spindle_speed_rpm, Feed=feed_mm_min)

duplicate_data = DuplicateData(Data="G1", Number=list_length, Order=True)
division = Division(A=length, B=feed_mm_min)

# ----
# screw locations
deconstruct_brep_4 = DeconstructBrep(Brep=brep_2)  # -> Faces, Edges, Vertices
area_4 = Area(Geometry=geometry_56)  # -> Area, Centroid
area_5 = Area(Geometry=deconstruct_brep_4.Faces)  # -> Area, Centroid
deconstruct_4 = Deconstruct(Point=area_4.Centroid)  # -> XComponent, YComponent, ZComponent
deconstruct_5 = Deconstruct(Point=area_5.Centroid)  # -> XComponent, YComponent, ZComponent
equality_within_tolerance = EqualityWithinTolerance(FirstNumber=deconstruct_4.ZComponent, SecondNumber=deconstruct_5.ZComponent, Tolerance=0.01)  # -> Equality, Inequality
dispatch_2 = Dispatch(List=deconstruct_brep_4.Faces, DispatchPattern=equality_within_tolerance.Equality)  # -> flatten(ListA), ListB
area_6 = Area(Geometry=dispatch_2.ListA)  # -> Area, Centroid
construct_plane = ConstructPlane(Origin=area_6.Centroid, XAxis=Vector(1, 0, 0), YAxis=Vector(0, 1, 0))
bounding_rectangle = BoundingRectangle(Geometry=graft(dispatch_2.ListA), Plane=graft(construct_plane), Axis=0, Slide=0, Union=False)  # -> flatten(Bounding), flatten(DimensionX), DimensionY
larger_than = LargerThan(FirstNumber=bounding_rectangle.DimensionX, SecondNumber="170")  # -> LargerThan, OrEqualTo
dispatch_3 = Dispatch(List=dispatch_2.ListA, DispatchPattern=larger_than.LargerThan)  # -> ListA, ListB
geometry_67 = Geometry(simplify(dispatch_3.ListA))
geometry_68 = Geometry(simplify(dispatch_3.ListB))
explode = Explode(Curve=geometry_67, Recursive=True)  # -> Segments, Vertices
length_2 = Length(Curve=explode.Segments)
sort_list_3 = SortList(Keys=length_2, ValuesValuesA=explode.Segments)  # -> Keys, reverse(ValuesValuesA)
list_item_8 = ListItem(List=sort_list_3.ValuesValuesA, Index=0, Wrap=True)
list_item_9 = ListItem(List=sort_list_3.ValuesValuesA, Index=1, Wrap=True)
curve_middle = CurveMiddle(Curve=list_item_8)
curve_middle_2 = CurveMiddle(Curve=list_item_9)
line = Line(StartPoint=curve_middle, EndPoint=curve_middle_2)  # -> flatten(Line)
surface_split = SurfaceSplit(Surface=graft(geometry_67), Curves=graft(line))  # -> flatten(Fragments)
merge_17 = Merge(Data1=surface_split, Data2=geometry_68)
area_7 = Area(Geometry=merge_17)  # -> Area, Centroid
xy_plane_2 = XYPlane(Origin=area_7.Centroid)

_3x_contour = _3XContour(ToolRadius=0, Base=PlaneXY(0, 0, 0))  # -> Points, Vectors, Feed
estimated_mill_time_min = Panel(division)
nc_generation_robomove = NCGenerationRobomove(
    Points=deconstruct_plane_2.Origin,
    Vectors=deconstruct_plane_2.ZAxis,
    Rotation=remap_numbers.Mapped,
    Feed=duplicate_data,
    Settings=nc_settings)
panel_2 = Panel(nc_generation_robomove)

# ---- group: tool radius
number_3 = Number(tool_radius)

# ---- group: origin
construct_point_3 = ConstructPoint(
    XCoordinate=Slider(2393, range=-3000..3000),
    YCoordinate=Slider(-972, range=-3000..3000),
    ZCoordinate=Slider(127.2, range=-3000..3000))

# ---- group: x axis
construct_point_4 = ConstructPoint(
    XCoordinate=Slider(2393, range=-3000..3000),
    YCoordinate=Slider(590, range=-3000..3000),
    ZCoordinate=Slider(128.92, range=-3000..3000))

# ----
series = Series(Start="-1.5", Step="5", Count=expr("x", "2"))  # -> simplify(flatten(Series))

# ---- group: leads and links
number_4 = Number(leads_and_links_clearance)

# ---- group: approach and retract clearance
number_5 = Number(approach_and_retract_clearance)

number_6 = Number(approach_and_retract_clearance)

number_7 = Number(approach_and_retract_clearance)

# ----
# groove milling
boolean_toggle = BooleanToggle(False)

# ----
# orient to world X
X = UnitX(Factor=1)

# ----
# sort surfaces
# constant groove wall angles
# {0.119528,-0.973475,0.19509}
panel_3 = Panel("""constant groove angle
{-0.023776,0.193636,0.980785}""")  # disabled
vector_2 = Vector(Vector(-0.02377552925, 0.1936361467, 0.9807852807))  # disabled
vector_3 = Vector(Vector(0, -0.9807852807, 0.1950903204))  # disabled

# ----
# surface normal with edge direction method
panel_4 = Panel("2")
number_slider_8 = Slider(0, range=0..20)

# ----
# plane rotation
# orient towards robot
xy_plane_3 = XYPlane(Origin=Point(0, 0, 0))

# ----
# orient to robolab
number_slider_9 = Slider(-90, range=-360..360)
discontinuity = Discontinuity(Curve=geometry_56, Level=1)  # -> Points, Parameters
brep_3 = Brep(graft(list_item_3))
list_item_10 = ListItem(List=discontinuity.Points, Index=Slider(0, range=0..3), Wrap=True)
rotate = Rotate(Geometry=brep_3, Angle=degrees(number_slider_9), Plane=plane_normal)  # -> Geometry, Transform
xy_plane_4 = XYPlane(Origin=list_item_10)
rotate_2 = Rotate(Angle=degrees(number_slider_9), Plane=xy_plane_4)  # -> Geometry, Transform

# ----
# step downs
step_down_mm = Slider(0.4, range=0..10)
step_down_ratio = Slider(0.4, range=0..2)
multiplication = Multiplication(A=number_3, B="2")
multiplication_2 = Multiplication(A=multiplication, B=step_down_ratio)

# ---- group: y axis
number_slider_10 = Slider(2393, range=-3000..3000)

# ----
subtraction_2 = Subtraction(A=number_slider_10, B=Slider(560, range=0..1000))

# ---- group: y axis (continued)
construct_point_5 = ConstructPoint(XCoordinate=subtraction_2, YCoordinate=Slider(-972, range=-3000..3000), ZCoordinate=Slider(127.82, range=-3000..3000))

# ----
plane_3pt = Plane3Pt(PointA=construct_point_3, PointB=construct_point_4, PointC=construct_point_5)
orient = Orient(Geometry=geometry_56, Source=xy_plane_4, Target=plane_3pt)  # -> Geometry, Transform
orient_2 = Orient(Geometry=brep_3, Source=xy_plane_4, Target=plane_3pt)  # -> Geometry, Transform
orient_3 = Orient(Geometry=brep_2, Source=xy_plane_4, Target=plane_3pt)  # -> Geometry, Transform

panel_5 = Panel(subtraction_2)
orient_4 = Orient(Geometry=xy_plane_2, Source=xy_plane_4, Target=plane_3pt)  # -> Geometry, Transform

# ---- group: geo
geometry_69 = Geometry(orient_2.Geometry)

brep_4 = Brep(geometry_69)

# ---- group: origin
point = Point(plane_3pt)

# ---- group: all geo
geometry_70 = Geometry(orient_3.Geometry)

# ---- group: stock boundary
geometry_71 = Geometry(orient.Geometry)

# ---- group: screw frames
geometry_72 = Geometry(orient_4.Geometry)

# ----
bounding_box = BoundingBox(Content=brep_4, Plane=PlaneXY(0, 0, 0))  # -> Box, Box_2
deconstruct_brep_5 = DeconstructBrep(Brep=brep_4)  # -> Faces, Edges, Vertices
area_8 = Area(Geometry=deconstruct_brep_5.Faces)  # -> Area, Centroid
deconstruct_brep_6 = DeconstructBrep(Brep=bounding_box.Box)  # -> Faces, Edges, Vertices
deconstruct_6 = Deconstruct(Point=area_8.Centroid)  # -> XComponent, YComponent, ZComponent
area_9 = Area(Geometry=deconstruct_brep_5.Faces)  # -> Area, Centroid
sort_list_4 = SortList(Keys=deconstruct_6.ZComponent, ValuesValuesA=deconstruct_brep_5.Faces)  # -> Keys, ValuesValuesA
normal_comparator = NormalComparator(geometry=deconstruct_brep_5.Faces, vector=vector_2)  # disabled
cluster_4 = NormalComparator(geometry=deconstruct_brep_5.Faces, vector=vector_3)  # disabled
evaluate_surface_2 = EvaluateSurface(Surface=reparameterize(deconstruct_brep_5.Faces), Point="{0.5, 0.5, 0}")  # -> Point, Normal, UDirection, VDirection, Frame
sort_list_5 = SortList(Keys=area_9.Area, ValuesValuesA=deconstruct_brep_5.Faces)  # -> Keys, reverse(ValuesValuesA)
deconstruct_vector = DeconstructVector(Vector=evaluate_surface_2.Normal)  # -> XComponent, YComponent, ZComponent
geometry_73 = Geometry(normal_comparator)  # disabled
geometry_74 = Geometry(cluster_4)  # disabled
split_list = SplitList(List=sort_list_4.ValuesValuesA, Index="1")  # -> ListA, ListB
absolute = Absolute(Value=deconstruct_vector.ZComponent)
equality_within_tolerance_2 = EqualityWithinTolerance(FirstNumber=absolute, SecondNumber="1", Tolerance=0.001)  # -> Equality, Inequality
geometry_75 = Geometry(split_list.ListB)
geometry_76 = Geometry(split_list.ListA)
brep_edges = BrepEdges(Brep=geometry_76)  # -> Naked, Interior, NonManifold
dispatch_4 = Dispatch(List=deconstruct_brep_5.Faces, DispatchPattern=equality_within_tolerance_2.Inequality)  # -> ListA, ListB
area_10 = Area(Geometry=dispatch_4.ListA)  # -> Area, Centroid
join_curves = JoinCurves(Curves=brep_edges.Naked, Preserve=False)
cluster_5 = Cluster(crv=join_curves, srf=geometry_75)  # -> simplify(L)
area_11 = Area(Geometry=cluster_5)  # -> Area, Centroid
member_index = MemberIndex(Set=area_10.Centroid, Member=graft(area_11.Centroid))  # -> simplify(Index), Count
cull_index = CullIndex(List=dispatch_4.ListA, Indices=flatten(member_index.Index), Wrap=True)

# ---- group: horizontal surfaces
geometry_77 = Geometry(dispatch_4.ListB)

# ---- group: bottom contour
geometry_78 = Geometry(join_curves)

# ----
list_item_11 = ListItem(List=sort_list_4.ValuesValuesA, Index=0, Wrap=True)
cull_index_2 = CullIndex(List=area_10.Area, Indices=flatten(member_index.Index), Wrap=True)

sort_list_6 = SortList(Keys=cull_index_2, ValuesValuesA=cull_index)  # -> Keys, reverse(ValuesValuesA)
split_list_2 = SplitList(List=sort_list_6.ValuesValuesA, Index="3")  # -> ListA, ListB

# ---- group: groove surface
geometry_79 = Geometry(split_list_2.ListA)

# ---- group: horizontal surfaces
geometry_80 = Geometry(dispatch_4.ListB)

# ---- group: groove surface
geometry_81 = Geometry(split_list_2.ListA)

# ---- group: groove walls
geometry_82 = Geometry(split_list_2.ListB)

geometry_83 = Geometry(geometry_82)

# ---- group: perimeter surfaces
geometry_84 = Geometry(cluster_5)

geometry_85 = Geometry(geometry_84)

# ---- group: bottom contour
geometry_86 = Geometry(join_curves)

# ----
deconstruct_brep_7 = DeconstructBrep(Brep=geometry_79)  # -> Faces, simplify(Edges), Vertices
convex_hull = ConvexHull(Points=deconstruct_brep_7.Vertices, Plane=PlaneXY(0, 0, 0))  # -> Hull, HullZ, Indices
boundary_surfaces_2 = BoundarySurfaces(Edges=convex_hull.HullZ)  # -> simplify(Surfaces)

brep_edges_2 = BrepEdges(Brep=boundary_surfaces_2)  # -> simplify(Naked), Interior, NonManifold
length_3 = Length(Curve=brep_edges_2.Naked)
sort_list_7 = SortList(Keys=length_3, ValuesValuesA=brep_edges_2.Naked)  # -> Keys, ValuesValuesA
plane_172 = Plane(boundary_surfaces_2)
list_item_12 = ListItem(List=reverse(sort_list_7.ValuesValuesA), Index=0, Wrap=True)
list_item_13 = ListItem(List=flatten(sort_list_7.ValuesValuesA), Index=0, Wrap=True)
flip_curve = FlipCurve(Curve=list_item_12, Guide=list_item_13)  # -> Curve, Flag
flip_curve_2 = FlipCurve(Curve=flip_curve.Curve)  # -> Curve, Flag
stream_filter = StreamFilter(Gate=Toggle(True), Stream0=flip_curve.Curve, Stream1=flip_curve_2.Curve)
align_plane = AlignPlane(Plane=plane_172, Direction=stream_filter)  # -> Plane, Angle

bounding_rectangle_2 = BoundingRectangle(Geometry=boundary_surfaces_2, Plane=align_plane.Plane, Axis=0, Slide=0, Union=boolean_toggle)  # -> Bounding, DimensionX, DimensionY
brep_edges_3 = BrepEdges(Brep=bounding_rectangle_2.Bounding)  # -> simplify(Naked), Interior, NonManifold
length_4 = Length(Curve=brep_edges_3.Naked)
sort_list_8 = SortList(Keys=length_4, ValuesValuesA=brep_edges_3.Naked)  # -> Keys, ValuesValuesA
list_item_14 = ListItem(List=reverse(sort_list_8.ValuesValuesA), Index=0, Wrap=True)
list_item_15 = ListItem(List=reverse(sort_list_8.ValuesValuesA), Index=1, Wrap=True)
merge_18 = Merge(Data1=list_item_14, Data2=list_item_15)
curve_middle_3 = CurveMiddle(Curve=reparameterize(merge_18))
deconstruct_7 = Deconstruct(Point=curve_middle_3)  # -> XComponent, YComponent, ZComponent
sort_list_9 = SortList(Keys=deconstruct_7.ZComponent, ValuesValuesA=curve_middle_3)  # -> Keys, reverse(ValuesValuesA)
sort_list_10 = SortList(Keys=deconstruct_7.ZComponent, ValuesValuesA=merge_18)  # -> Keys, reverse(ValuesValuesA)
list_item_16 = ListItem(List=sort_list_9.ValuesValuesA, Index=0, Wrap=True)
list_item_17 = ListItem(List=sort_list_9.ValuesValuesA, Index=-1, Wrap=True)
list_item_18 = ListItem(List=sort_list_10.ValuesValuesA, Index=0, Wrap=True)
list_item_19 = ListItem(List=sort_list_10.ValuesValuesA, Index=-1, Wrap=True)
line_2 = Line(StartPoint=list_item_16, EndPoint=list_item_17)
vector_2pt_2 = Vector2Pt(PointA=list_item_16, PointB=list_item_17, Unitize=False)  # -> Vector, Length
amplitude = Amplitude(Vector=vector_2pt_2.Vector, Amplitude=subtraction)
reverse_2 = Reverse(Vector=amplitude)
move = Move(Geometry=list_item_18, Motion=amplitude)  # -> Geometry, Transform
move_2 = Move(Geometry=list_item_19, Motion=reverse_2)  # -> Geometry, Transform
merge_19 = Merge(Data1=move.Geometry, Data2=move_2.Geometry)
list_item_20 = ListItem(List=merge_19, Index=0, Wrap=True)
flip_curve_3 = FlipCurve(Curve=merge_19, Guide=list_item_20)  # -> Curve, Flag
dispatch_5 = Dispatch(List=flip_curve_3.Curve, DispatchPattern=[True, False])  # -> ListA, ListB
flip_curve_4 = FlipCurve(Curve=dispatch_5.ListB)  # -> Curve, Flag
weave_2 = Weave(Pattern=[0, 1], Stream0=dispatch_5.ListA, Stream1=flip_curve_4.Curve, NullGaps=False)
extend_curve = ExtendCurve(Curve=weave_2, Type=0, Start=expr("x * 2", number_2), End=expr("x *2", number_2))
evaluate_curve = EvaluateCurve(Curve=extend_curve, Parameter=".5")  # -> Point, Tangent, Angle
vector_display_2 = VectorDisplay(Anchor=evaluate_curve.Point, Vector=evaluate_curve.Tangent)
disc = Discontinuity(Curve=extend_curve, Level=1)  # -> Points, Parameters
plane_173 = Plane(bounding_rectangle_2.Bounding)
pshift = ShiftPaths(Data=disc.Points, Offset=-1)
evaluate_surface_3 = EvaluateSurface(Surface=reparameterize(plane_173), Point="{0.5, 0.5, 0}")  # -> Point, simplify(Normal), UDirection, VDirection, Frame
pline_2 = PolyLine(Vertices=pshift, Closed=False)
amplitude_2 = Amplitude(Vector=evaluate_surface_3.Normal, Amplitude=number_4)
discontinuity_2 = Discontinuity(Curve=pline_2, Level=1)  # -> simplify(Points), Parameters
end_points = EndPoints(Curve=pline_2)  # -> Start, End
move_3 = Move(Geometry=end_points.Start, Motion=amplitude_2)  # -> Geometry, Transform
move_4 = Move(Geometry=end_points.End, Motion=amplitude_2)  # -> Geometry, Transform
insert_items = InsertItems(List=discontinuity_2.Points, Item=move_3.Geometry, Indices=0, Wrap=True)
insert_items_2 = InsertItems(List=insert_items, Item=move_4.Geometry, Indices=-1, Wrap=True)  # -> simplify(List)
plane_origin = PlaneOrigin(Base=plane_173, Origin=insert_items_2)  # -> flatten(Plane)

plane_174 = Plane(flatten(plane_origin))

# ----
# start and end approach retract
list_item_21 = ListItem(List=plane_174, Index=0, Wrap=True)
list_item_22 = ListItem(List=plane_174, Index=-1, Wrap=True)
unit_z = UnitZ(Factor=number_5)
point_2 = Point(list_item_21)
point_3 = Point(list_item_22)
move_5 = Move(Geometry=point_2, Motion=unit_z)  # -> Geometry, Transform
move_6 = Move(Geometry=point_3, Motion=unit_z)  # -> Geometry, Transform
insert_items_3 = InsertItems(List=plane_174, Item=move_5.Geometry, Indices=0, Wrap=True)
insert_items_4 = InsertItems(List=insert_items_3, Item=move_6.Geometry, Indices=-1, Wrap=True)

deconstruct_brep_8 = DeconstructBrep(Brep=geometry_85)  # -> Faces, simplify(Edges), Vertices
polyline_offset = PolylineOffset(
    Polylines=geometry_78,
    Distance=number,
    Plane=Plane(origin=(0, 0, 0), x=(0, 0, 0), y=(0, 0, 0)),
    Tolerance=0.001,
    ClosedFillet=panel_4,
    OpenFillet=1,
    Miter=2)  # -> Contour, Holes
curve_middle_4 = CurveMiddle(Curve=reparameterize(deconstruct_brep_8.Edges))  # -> simplify(graft(Midpoint))
curve_4 = Curve(polyline_offset.Contour)
shift_paths_2 = ShiftPaths(Data=curve_middle_4, Offset=-1)
deconstruct_8 = Deconstruct(Point=shift_paths_2)  # -> XComponent, YComponent, simplify(ZComponent)
sort_list_11 = SortList(Keys=deconstruct_8.ZComponent, ValuesValuesA=deconstruct_brep_8.Edges)  # -> Keys, ValuesValuesA
list_item_23 = ListItem(List=sort_list_11.ValuesValuesA, Index=0, Wrap=True)  # -> flatten(Item)
curve_middle_5 = CurveMiddle(Curve=reparameterize(list_item_23))
point_4 = Point(point)

discontinuity_3 = Discontinuity(Curve=curve_4, Level=1)  # -> Points, Parameters
polyline = PolyLine(Vertices=discontinuity_3.Points, Closed=True)

explode_2 = Explode(Curve=polyline, Recursive=True)  # -> reparameterize(flatten(Segments)), Vertices
curve_middle_6 = CurveMiddle(Curve=reparameterize(explode_2.Segments))  # -> graft(Midpoint)
closest_point = ClosestPoint(Point=curve_middle_6, Cloud=curve_middle_5)  # -> ClosestPoint, simplify(CPIndex), Distance
list_item_24 = ListItem(List=geometry_85, Index=closest_point.CPIndex, Wrap=True)  # -> flatten(Item)
geometry_87 = Geometry(flatten(list_item_24))
geometry_88 = Geometry(flatten(explode_2.Segments))
join_curves_2 = JoinCurves(Curves=geometry_88, Preserve=False)
curve_middle_7 = CurveMiddle(Curve=geometry_88)
sort_along_curve_2 = SortAlongCurve(Points=curve_middle_7, Curve=join_curves_2)  # -> Points, Indices
list_item_25 = ListItem(List=geometry_87, Index=sort_along_curve_2.Indices, Wrap=True)
list_item_26 = ListItem(List=geometry_88, Index=sort_along_curve_2.Indices, Wrap=True)
end_points_2 = EndPoints(Curve=list_item_26)  # -> Start, End
closest_point_2 = ClosestPoint(Point=point_4, Cloud=end_points_2.Start)  # -> ClosestPoint, CPIndex, Distance
shift_list = ShiftList(List=list_item_25, Shift=closest_point_2.CPIndex, Wrap=True)
shift_list_2 = ShiftList(List=list_item_26, Shift=closest_point_2.CPIndex, Wrap=True)
geometry_89 = Geometry(simplify(graft(shift_list)))
geometry_90 = Geometry(simplify(graft(shift_list_2)))
evaluate_surface_4 = EvaluateSurface(Surface=reparameterize(geometry_89), Point="{0.5, 0.5, 0}")  # -> Point, Normal, UDirection, VDirection, Frame
extend_curve_2 = ExtendCurve(Curve=geometry_90, Type=0, Start=number_slider_8, End=number_slider_8)
evaluate_curve_2 = EvaluateCurve(Curve=reparameterize(geometry_90), Parameter=["0", "1"])  # -> Point, Tangent, Angle

length_5 = Length(Curve=geometry_90)
smaller_than = SmallerThan(FirstNumber=length_5, SecondNumber="15")  # -> SmallerThan, OrEqualTo

dispatch_6 = Dispatch(List=evaluate_surface_4.Normal, DispatchPattern=smaller_than.SmallerThan)  # -> ListA, ListB
deconstruct_vector_2 = DeconstructVector(Vector=dispatch_6.ListA)  # -> XComponent, YComponent, ZComponent
vector_xyz = VectorXYZ(XComponent=deconstruct_vector_2.XComponent, YComponent=deconstruct_vector_2.YComponent, ZComponent="0")  # -> Vector, Length
weave_3 = Weave(Pattern=smaller_than.SmallerThan, Stream0=dispatch_6.ListB, Stream1=vector_xyz.Vector, NullGaps=False)
stream_filter_2 = StreamFilter(Gate=value_list, Stream0=evaluate_surface_4.Normal, Stream1=weave_3)
construct_plane_2 = ConstructPlane(Origin=evaluate_curve_2.Point, XAxis=stream_filter_2, YAxis=evaluate_curve_2.Tangent)

deconstruct_plane_3 = DeconstructPlane(Plane=construct_plane_2)  # -> Origin, XAxis, YAxis, ZAxis
deconstruct_vector_3 = DeconstructVector(Vector=deconstruct_plane_3.ZAxis)  # -> XComponent, YComponent, ZComponent
smaller_than_2 = SmallerThan(FirstNumber=deconstruct_vector_3.ZComponent, SecondNumber="0")  # -> SmallerThan, OrEqualTo
dispatch_7 = Dispatch(List=construct_plane_2, DispatchPattern=smaller_than_2.SmallerThan)  # -> ListA, ListB
flip_plane = FlipPlane(Plane=dispatch_7.ListA, ReverseX=Toggle(False), ReverseY=Toggle(False), SwapAxes=Toggle(True))
weave_4 = Weave(Pattern=smaller_than_2.SmallerThan, Stream0=dispatch_7.ListB, Stream1=flip_plane, NullGaps=False)

box_dimensions = BoxDimensions(Box=bounding_box.Box)  # -> XDimension, YDimension, ZDimension
list_item_27 = ListItem(List=weave_4, Index=0, Wrap=True)
list_item_28 = ListItem(List=weave_4, Index=-1, Wrap=True)
deconstruct_plane_4 = DeconstructPlane(Plane=list_item_27)  # -> Origin, XAxis, YAxis, ZAxis
amplitude_3 = Amplitude(Vector=deconstruct_plane_4.ZAxis, Amplitude=series)  # -> simplify(Vector)
move_7 = Move(Geometry=list_item_27, Motion=amplitude_3)  # -> Geometry, Transform
move_8 = Move(Geometry=list_item_28, Motion=amplitude_3)  # -> Geometry, Transform
flip_matrix = FlipMatrix(Data=move_7.Geometry)
flip_matrix_2 = FlipMatrix(Data=move_8.Geometry)
division_2 = Division(A=box_dimensions.ZDimension, B=multiplication_2)
round = Round(Number=division_2)  # -> Nearest, Floor, Ceiling
weave_5 = Weave(Pattern=[0, 1], Stream0=flip_matrix, Stream1=flip_matrix_2, NullGaps=False)
division_3 = Division(A=box_dimensions.ZDimension, B=round.Ceiling)
tree_statistics = TreeStatistics(Tree=weave_5)  # -> Paths, Length, Count
flip_matrix_3 = FlipMatrix(Data=weave_5)
series_2 = Series(Start=0, Step=division_3, Count=expr("x", round.Ceiling))  # -> simplify(flatten(Series))
replace_paths = ReplacePaths(Data=weave_5, Search=tree_statistics.Paths, Replace=reverse(tree_statistics.Paths))

shift_paths_3 = ShiftPaths(Data=move_7.Geometry, Offset=-1)
shift_paths_4 = ShiftPaths(Data=move_8.Geometry, Offset=-1)

# ----
# extend outside of material
plane_175 = Plane(flatten(replace_paths))
list_item_29 = ListItem(List=plane_175, Index="0", Wrap=True)
polyline_2 = PolyLine(Vertices=plane_175, Closed=False)
deconstruct_plane_5 = DeconstructPlane(Plane=list_item_29)  # -> Origin, XAxis, YAxis, ZAxis
cull_index_3 = CullIndex(List=plane_175, Indices="0", Wrap=True)
extend_curve_3 = ExtendCurve(Curve=polyline_2, Type=0, Start=expr("x * 2", number_2), End=expr("x *2", number_2))
list_item_30 = ListItem(List=plane_175, Index="-1", Wrap=True)
deconstruct_plane_6 = DeconstructPlane(Plane=list_item_30)  # -> Origin, XAxis, YAxis, ZAxis
negative = Negative(Value=deconstruct_plane_5.YAxis)
multiplication_3 = Multiplication(A=tool_radius, B="0")
cull_index_4 = CullIndex(List=cull_index_3, Indices="-1", Wrap=True)
discontinuity_4 = Discontinuity(Curve=extend_curve_3, Level=1)  # -> Points, Parameters
amplitude_4 = Amplitude(Vector=negative, Amplitude=multiplication_3)
amplitude_5 = Amplitude(Vector=deconstruct_plane_6.YAxis, Amplitude=multiplication_3)
move_9 = Move(Geometry=list_item_29, Motion=amplitude_4)  # -> Geometry, Transform
move_10 = Move(Geometry=list_item_30, Motion=amplitude_5)  # -> Geometry, Transform
plane_origin_2 = PlaneOrigin(Base=plane_175, Origin=flatten(discontinuity_4.Points))
insert_items_5 = InsertItems(List=cull_index_4, Item=move_9.Geometry, Indices="0", Wrap=True)
insert_items_6 = InsertItems(List=insert_items_5, Item=move_10.Geometry, Indices="-1", Wrap=True)

deconstruct_plane_7 = DeconstructPlane(Plane=construct_plane_2)  # -> Origin, XAxis, YAxis, ZAxis
deconstruct_vector_4 = DeconstructVector(Vector=deconstruct_plane_7.YAxis)  # -> XComponent, YComponent, ZComponent
smaller_than_3 = SmallerThan(FirstNumber=deconstruct_vector_4.ZComponent, SecondNumber="0")  # -> SmallerThan, OrEqualTo
dispatch_8 = Dispatch(List=construct_plane_2, DispatchPattern=smaller_than_3.SmallerThan)  # -> ListA, ListB
flip_plane_2 = FlipPlane(Plane=dispatch_8.ListA, ReverseX=Toggle(False), ReverseY=Toggle(True), SwapAxes=Toggle(False))

rotate_3 = Rotate(Geometry=dispatch_8.ListA, Angle=degrees("90"), Plane=dispatch_8.ListA)  # -> Geometry, Transform

weave_6 = Weave(Pattern=smaller_than_3.SmallerThan, Stream0=dispatch_8.ListB, Stream1=rotate_3.Geometry, NullGaps=False)

# ----
# leads and links
partition_list = PartitionList(List=insert_items_6, Size=2)
list_item_31 = ListItem(List=partition_list, Index=0, Wrap=True)
list_item_32 = ListItem(List=partition_list, Index=-1, Wrap=True)
deconstruct_plane_8 = DeconstructPlane(Plane=list_item_32)  # -> Origin, XAxis, YAxis, ZAxis

# ---- group: leads and links
number_8 = Number("0")

# ----
amplitude_6 = Amplitude(Vector=deconstruct_plane_8.ZAxis, Amplitude=number_8)
move_11 = Move(Geometry=list_item_31, Motion=graft(amplitude_6))  # -> Geometry, Transform
move_12 = Move(Geometry=list_item_32, Motion=graft(amplitude_6))  # -> Geometry, Transform
insert_items_7 = InsertItems(List=partition_list, Item=move_11.Geometry, Indices=0, Wrap=True)
insert_items_8 = InsertItems(List=insert_items_7, Item=move_12.Geometry, Indices=-1, Wrap=True)  # -> flatten(List)

plane_176 = Plane(flatten(insert_items_8))

# ----
# start and end approach retract
list_item_33 = ListItem(List=plane_176, Index=0, Wrap=True)
list_item_34 = ListItem(List=plane_176, Index=-1, Wrap=True)
unit_z_2 = UnitZ(Factor=number_7)
point_5 = Point(list_item_33)
point_6 = Point(list_item_34)
move_13 = Move(Geometry=point_5, Motion=unit_z_2)  # -> Geometry, Transform
move_14 = Move(Geometry=point_6, Motion=unit_z_2)  # -> Geometry, Transform
insert_items_9 = InsertItems(List=plane_176, Item=move_13.Geometry, Indices=0, Wrap=True)
insert_items_10 = InsertItems(List=insert_items_9, Item=move_14.Geometry, Indices=-1, Wrap=True)

# ----
# leads and links - screw pattern
panel_6 = Panel("-1")
unit_z_3 = UnitZ(Factor=Slider(20, range=0..200))

unit_z_4 = UnitZ(Factor=panel_6)
move_15 = Move(Geometry=flatten(geometry_72), Motion=unit_z_4)  # -> Geometry, Transform

move_16 = Move(Geometry=flatten(move_15.Geometry), Motion=graft(unit_z_3))  # -> Geometry, Transform
insert_items_11 = InsertItems(List=graft(move_15.Geometry), Item=graft(move_16.Geometry), Indices=0, Wrap=True)
insert_items_12 = InsertItems(List=insert_items_11, Item=graft(move_16.Geometry), Indices=-1, Wrap=True)

plane_177 = Plane(flatten(insert_items_12))

# ----
# start and end approach retract
list_item_35 = ListItem(List=plane_177, Index=0, Wrap=True)
list_item_36 = ListItem(List=plane_177, Index=-1, Wrap=True)
unit_z_5 = UnitZ(Factor=number_6)
point_7 = Point(list_item_35)
point_8 = Point(list_item_36)
move_17 = Move(Geometry=point_7, Motion=unit_z_5)  # -> Geometry, Transform
move_18 = Move(Geometry=point_8, Motion=unit_z_5)  # -> Geometry, Transform
insert_items_13 = InsertItems(List=plane_177, Item=move_17.Geometry, Indices=0, Wrap=True)
insert_items_14 = InsertItems(List=insert_items_13, Item=move_18.Geometry, Indices=-1, Wrap=True)

# ----
# combine sections
insert_items_15 = InsertItems(List=insert_items_4, Item=insert_items_10, Indices=-1, Wrap=True)
stream_filter_3 = StreamFilter(Gate=path_selection, Stream0=insert_items_10, Stream1=insert_items_4, Stream2=insert_items_15, Stream3=insert_items_14)

plane_178 = Plane(flatten(stream_filter_3))

plane_179 = Plane(flatten(plane_178))
align_plane_2 = AlignPlane(Plane=plane_179, Direction=X)  # -> Plane, Angle

plane_180 = Plane(flatten(align_plane_2.Plane))

vector_2pt_3 = Vector2Pt(PointA=plane_180, PointB=xy_plane_3, Unitize=False)  # -> Vector, Length
align_plane_3 = AlignPlane(Plane=plane_180, Direction=vector_2pt_3.Vector)  # -> Plane, Angle

# ----
# rotate all planes
rotate_plane_2 = RotatePlane(Plane=flatten(align_plane_3.Plane), Angle=degrees(rotate_all_planes))

# ==== cluster NormalComparator
geometry = ClusterInput()
geometry_2 = Geometry(geometry)
evaluate_surface = EvaluateSurface(Surface=reparameterize(geometry_2), Point="{0.5, 0.5, 0}")  # -> Point, Normal, UDirection, VDirection, Frame
vector = ClusterInput()
vector_2 = Vector(evaluate_surface.Normal)
vector_3 = Vector(vector)
unit_vector = UnitVector(Vector=vector_2)
unit_vector_2 = UnitVector(Vector=vector_3)
deconstruct_vector = DeconstructVector(Vector=unit_vector)  # -> XComponent, YComponent, ZComponent
deconstruct_vector_2 = DeconstructVector(Vector=unit_vector_2)  # -> XComponent, YComponent, ZComponent
absolute = Absolute(Value=deconstruct_vector.XComponent)
absolute_2 = Absolute(Value=deconstruct_vector.YComponent)
absolute_3 = Absolute(Value=deconstruct_vector.ZComponent)
absolute_4 = Absolute(Value=deconstruct_vector_2.XComponent)
absolute_5 = Absolute(Value=deconstruct_vector_2.YComponent)
absolute_6 = Absolute(Value=deconstruct_vector_2.ZComponent)
vector_xyz = VectorXYZ(XComponent=absolute, YComponent=absolute_2, ZComponent=absolute_3)  # -> flatten(Vector), Length
vector_xyz_2 = VectorXYZ(XComponent=absolute_4, YComponent=absolute_5, ZComponent=absolute_6)  # -> flatten(Vector), Length
member_index = MemberIndex(Set=vector_xyz.Vector, Member=vector_xyz_2.Vector)  # -> Index, Count
list_item = ListItem(List=geometry_2, Index=member_index.Index, Wrap=True)
i = ClusterOutput(list_item)

# ==== cluster Cluster
crv = ClusterInput()
srf = ClusterInput()
crv_2 = Curve(crv)
srf_2 = Surface(srf)

edges = BrepEdges(Brep=srf_2)  # -> Naked, Interior, NonManifold
ccx = CurveCurve(CurveA=crv_2, CurveB=edges.Naked)  # -> Points, ParamsA, ParamsB
pshift = ShiftPaths(Data=ccx.Points, Offset=-1)
tstat = TreeStatistics(Tree=pshift)  # -> Paths, Length, Count
cull = CullPattern(List=srf_2, CullPattern=tstat.Length)

L = ClusterOutput(cull)

# ==== cluster Cluster_2
curve = ClusterInput()
factor = ClusterInput()
unit_z = UnitZ(Factor=factor)
geometry = ClusterInput()
discontinuity = Discontinuity(Curve=curve, Level=1)  # -> Points, Parameters
sort_along_curve = SortAlongCurve(Points=discontinuity.Points, Curve=curve)  # -> Points, Indices
move = Move(Geometry=geometry, Motion=unit_z)  # -> Geometry, Transform
list_item = ListItem(List=sort_along_curve.Points, Index=0, Wrap=True)
deconstruct_brep = DeconstructBrep(Brep=move.Geometry)  # -> Faces, Edges, Vertices
shift_paths = ShiftPaths(data=deconstruct_brep.Faces)
area = Area(Geometry=shift_paths)  # -> Area, Centroid
deconstruct = Deconstruct(Point=list_item)  # -> XComponent, YComponent, ZComponent
deconstruct_2 = Deconstruct(Point=area.Centroid)  # -> XComponent, YComponent, ZComponent
round_to_decimal_place = RoundToDecimalPlace(NumberX=deconstruct_2.ZComponent, DecimalPlace=Slider(2, range=0..3), RoundType=0)  # -> Rounded, Difference
sort_list = SortList(Keys=round_to_decimal_place.Rounded, ValuesValuesA=area.Centroid)  # -> reverse(Keys), reverse(ValuesValuesA)
list_item_2 = ListItem(List=sort_list.Keys, Index=0, Wrap=True)
panel = Panel(deconstruct.XComponent)
panel_2 = Panel(shift_paths)
member_index = MemberIndex(Set=sort_list.Keys, Member=list_item_2)  # -> Index, Count
list_item_3 = ListItem(List=sort_list.ValuesValuesA, Index=member_index.Index, Wrap=True)
deconstruct_3 = Deconstruct(Point=list_item_3)  # -> XComponent, YComponent, ZComponent
absolute = Absolute(Value=deconstruct.YComponent)
absolute_2 = Absolute(Value=deconstruct_3.YComponent)
number_slider = Slider(0, range=0..3)
subtraction = Subtraction(A=deconstruct_3.XComponent, B=deconstruct.XComponent)
subtraction_2 = Subtraction(A=absolute, B=absolute_2)
round_to_decimal_place_2 = RoundToDecimalPlace(NumberX=subtraction, DecimalPlace=number_slider, RoundType=0)  # -> Rounded, Difference
round_to_decimal_place_3 = RoundToDecimalPlace(NumberX=subtraction_2, DecimalPlace=number_slider, RoundType=0)  # -> Rounded, Difference
concatenate = Concatenate(Fragment_A="(", Fragment_B=round_to_decimal_place_2.Rounded, A=",", B=round_to_decimal_place_3.Rounded, C=")")
insert_items = InsertItems(List=concatenate, Item="(0,0)", Indices=0, Wrap=True)  # -> graft(List)
screw_location = ClusterOutput(list_item_3)
result = ClusterOutput(concatenate)

# ==== cluster ShiftPaths: Shift -1 in all data tree paths
data = ClusterInput()  # Data to modify
data_2 = Data(simplify(data))
path_mapper = PathMapper(
    data_2,
    source=["{A}", "{A;B}", "{A;B;C}", "{A;B;C;D}", "{A;B;C;D;E}", "{A;B;C;D;E;F}", "{A;B;C;D;E;F;G}", "{A;B;C;D;E;F;G;H}", "{A;B;C;D;E;F;G;H;I}", "{A;B;C;D;E;F;G;H;I;K}"],
    target=["{0}", "{A}", "{A;B}", "{A;B;C}", "{A;B;C;D}", "{A;B;C;D;E}", "{A;B;C;D;E;F}", "{A;B;C;D;E;F;G}", "{A;B;C;D;E;F;G;H}", "{A;B;C;D;E;F;G;H;I}"])
data_3 = Data(path_mapper)
data_4 = ClusterOutput(data_3)  # Shifted data
