# Grasshopper definition Reciprocal Frame Fabrication_Hildebrandt.gh (Grasshopper 1.0.7)
# plug-ins: NGon, Heteroptera, VirtualRobot.Grasshopper, HAL [Geometry Utilities], Sandbox, Human

position = Slider(0, range=0..0.999)

pieces_milled_at_once = Slider(10, range=0..10)
group_number = Slider(5, range=0..25)

material_to_leave_in_rough = Slider(1, range=0..60)
breaththrough_depth = Slider(2, range=0..60)
tool_diameter = Slider(18, range=0..60)

# ---- group: MEMBER DIMENSIONS (SQUARE)
# Jump to Simulation
member_dimensions = Slider(30, range=0..30)

# ----
member_spacing = Slider(250, range=0..1000)
flip_tool_entrance_direction = BooleanToggle(False)

y_adjustment = Slider(-50, range=-2000..2000)
x_adjustment = Slider(800, range=-2000..2000)

stock_length = Slider(864, range=0..1000)
stock_width = Slider(60, range=0..1000)
stock_height = Slider(60, range=0..1000)

toolpath = ValueList({"NOTCH": 0, "ENDS": 1}, selected="NOTCH")
show_geometry = BooleanToggle(True)
show_fixture = BooleanToggle(True)
show_stock = BooleanToggle(False)
list = ValueList({"SIDE 1": 0, "SIDE 2": 1}, selected="SIDE 2")

# ----
# Surface Generation
number_slider = Slider(6.5, range=0.1..10)
# Reciprocal Frame Fabrication
# Brief:
# This is a tool for generating reciprocal frame geometries
# and programming toolpaths for robotic milling of
# the 5-axis lap joints of its members. Includes
# flip cuts and mounting fixture.
# 
# Harrison Hildebrandt
# 06.2022
number_slider_2 = Slider(1000, range=500..1500)
multiplication = Multiplication(A=number_slider_2, B=2)
multiplication_2 = Multiplication(A=number_slider_2, B=number_slider)
vec = VectorXYZ(XComponent=0, YComponent=number_slider_2, ZComponent=Slider(1000, range=500..1500))  # -> Vector, Length
vec_2 = VectorXYZ(XComponent=0, YComponent=multiplication, ZComponent=0)  # -> Vector, Length
pt = Point(Point(-539.5456413, 2269.674182, 0))
move = Move(Geometry=pt, Motion=vec.Vector)  # -> Geometry, Transform
move_2 = Move(Geometry=pt, Motion=vec_2.Vector)  # -> Geometry, Transform
number_slider_3 = Slider(0, range=0..1000)
number_slider_4 = Slider(300, range=0..1000)
arc = Arc3Pt(PointA=pt, PointB=move.Geometry, PointC=move_2.Geometry)  # -> Arc, Plane, Radius
ln = Line(StartPoint=pt, EndPoint=move_2.Geometry)
midpt = CurveMiddle(Curve=ln)
scale = Scale(Geometry=arc.Arc, Center=midpt, Factor=Slider(0.85, range=0..1))  # -> Geometry, Transform
scale_2 = Scale(Geometry=arc.Arc, Center=midpt, Factor=Slider(1.5, range=0..2))  # -> Geometry, Transform
vec_3 = VectorXYZ(XComponent=multiplication_2, YComponent=0, ZComponent=Slider(350, range=0..1000))  # -> Vector, Length
X = UnitX(Factor=Slider(1348, range=500..1500))
move_3 = Move(Geometry=scale_2.Geometry, Motion=vec_3.Vector)  # -> Geometry, Transform
ext = ExtendCurve(Curve=arc.Arc, Type=2, Start=expr("-x", number_slider_3), End=expr("-x", number_slider_3))
ext_2 = ExtendCurve(Curve=move_3.Geometry, Type=2, Start=expr("-x", number_slider_4), End=expr("-x", number_slider_4))
move_4 = Move(Geometry=scale.Geometry, Motion=X)  # -> Geometry, Transform
curvepoint = PointOnCurve(ext, parameter=0)
curvepoint_2 = PointOnCurve(ext, parameter=0.5)
curvepoint_3 = PointOnCurve(ext, parameter=1)
curvepoint_4 = PointOnCurve(move_4.Geometry, parameter=0)
curvepoint_5 = PointOnCurve(move_4.Geometry, parameter=0.5)
curvepoint_6 = PointOnCurve(move_4.Geometry, parameter=1)
curvepoint_7 = PointOnCurve(ext_2, parameter=0)
curvepoint_8 = PointOnCurve(ext_2, parameter=0.5)
curvepoint_9 = PointOnCurve(ext_2, parameter=1)
Z = UnitZ(Factor=Slider(-350, range=-500..200))
Z_2 = UnitZ(Factor=Slider(-200, range=-500..200))
move_5 = Move(Geometry=curvepoint_2, Motion=Z)  # -> Geometry, Transform
move_6 = Move(Geometry=curvepoint_5, Motion=Z_2)  # -> Geometry, Transform
intcrv = Interpolate(Vertices=[curvepoint, curvepoint_4, curvepoint_7], Degree=3, Periodic=False, KnotStyle=1)  # -> Curve, Length, Domain
intcrv_2 = Interpolate(Vertices=[curvepoint_2, curvepoint_5, curvepoint_8], Degree=3, Periodic=False, KnotStyle=1)  # -> Curve, Length, Domain
intcrv_3 = Interpolate(Vertices=[curvepoint_3, curvepoint_6, curvepoint_9], Degree=3, Periodic=False, KnotStyle=1)  # -> Curve, Length, Domain
arc_2 = Arc3Pt(PointA=curvepoint, PointB=move_5.Geometry, PointC=curvepoint_3)  # -> Arc, Plane, Radius
arc_3 = Arc3Pt(PointA=curvepoint_4, PointB=move_6.Geometry, PointC=curvepoint_6)  # -> Arc, Plane, Radius
netsurf = NetworkSurface(CurvesU=[intcrv.Curve, intcrv_2.Curve, intcrv_3.Curve], CurvesV=[arc_2.Arc, arc_3.Arc, ext_2], Continuity=2)

# ---- group: MEMBERS PER GROUP
num = Number(pieces_milled_at_once)

# ---- group: X ADJUSTMENT
num_2 = Number(x_adjustment)

# ---- group: Y ADJUSTMENT
num_3 = Number(y_adjustment)

# ---- group: FINISH PASS / TOOL DEPTH
num_4 = Number(tool_diameter)

# ---- group: MATERIAL TO LEAVE
num_5 = Number(material_to_leave_in_rough)

# ---- group: TOOL DIAMETER
num_6 = Number(tool_diameter)

# ----
# Simulation
num_7 = Number(position)

# ----
# Feeds and Speeds
tool_no = Panel("1")
spindle_speed_rpm = Panel("1000")
feed_mm_min = Panel("2000")
nc_settings = NCSettings(Tool=tool_no, Speed=spindle_speed_rpm, Feed=feed_mm_min)

# ---- group: GROUP NUMBER
num_8 = Number(group_number)

num_9 = Number(group_number)

num_10 = Number(group_number)

# ---- group: PERMANENT REGISTRAION BLOCKS
geometry = Geometry([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])

# ----
custom_preview = CustomPreview(Geometry=geometry, Material=ColourSwatch(SwatchColor=RGB(236, 213, 167)))

# ---- group: SETTINGS
data = Data(nc_settings)

# ---- group: MEMBER WIDTH
num_11 = Number(member_dimensions)

# ---- group: FLIP SIDE
num_12 = Number(list)

# ---- group: BREAKTHROUGH DEPTH
num_13 = Number(breaththrough_depth)

# ---- group: MOUNTING FIXTURE MESH
geometry_2 = Geometry([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])

# ---- group: REGISTRATION BLOCKS
geometry_3 = Geometry([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])

# ---- group: MOUNTING FIXTURE
geometry_4 = Geometry(geometry_2)

# ---- group: REFERENCE POINT
point = Point(Point(-30.19168191, -430.2608681, -60))

# ---- group: CORNER OF SETUP
geo = Geometry(point)

# ---- group: FLIP SIDE
num_14 = Number(list)

# ---- group: SURFACE
geo_2 = Geometry(netsurf)

# Turn solvers to true
geo_3 = Geometry(geo_2)

geo_4 = Geometry(geo_3)

# ----
# Mesh Subdivide And Planarize
number_slider_5 = Slider(11, range=0..100)
hexdivide = HexDivide(
    Surface=geo_4,
    U=number_slider_5,
    V=Slider(14, range=0..100),
    Parameter=Slider(0.34, range=0..1),
    Boundary=0,
    Swap=True,
    Rebuild=-1,
    Quadrangulate=False,
    Divisions=True,
    Explode=False)  # -> Mesh, DistA, DistB

# ---- group: MEMBER WIDTH
num_15 = Number(member_dimensions)

# ---- group: SETTINGS
data_2 = Data(data)

# ----
# KUKA
number_slider_6 = Slider(0.0006, range=0.0001..0.1)
ee = PredefinedSpindleEndEffector()
kuka_kr_125_2 = PredefinedKUKAKR1252(RobRootFrame=PlaneXY(0, 0, 0), EndEffectorOptional=ee)

# ---- group: FINISH PASS
# Finish Pass
panel = Panel("2")
division = Division(A=num_4, B=panel)

# ----
# Toolpath Generation (Milling Notch)
md_slider = MDSlider(
    SliderMode=0,
    slider_value=Point(0.5016155243, 0.5043478012, 0.5),
    x_domain=Domain(0, 1),
    y_domain=Domain(0, 1),
    z_domain=Domain(0, 1))
panel_2 = Panel(tool_diameter)
division_2 = Division(A=panel_2, B="2")
panel_3 = Panel(division_2)
panel_4 = Panel(division_2)
panel_5 = Panel(division_2)
series = Series(Start=0, Step=panel_5, Count=Slider(5, range=0..10))

# ----
# Orient Geometry to Workspace
panel_6 = Panel("976.06")
panel_7 = Panel("135.86")
addition = Addition(A=panel_6, B=num_2)
addition_2 = Addition(A="-1406.37", B=num_3)
pt_2 = ConstructPoint(XCoordinate=addition, YCoordinate=addition_2, ZCoordinate="52")
sframe = SetFrame(XYZLocation=pt_2, ABCOrientation="0,0,0")
num_16 = Number(stock_length)
num_17 = Number(stock_width)
num_18 = Number(stock_height)

# ----
# Add leads and links
xy = XYPlane(Origin=Point(0, 0, 0))
pln = Plane(xy)

# ----
# Roughing Pass
panel_8 = Panel("2")
addition_3 = Addition(A=division, B=num_5)
division_3 = Division(A=num_6, B=panel_8)

# ---- group: TOOL RADIUS
num_19 = Number(division_3)

num_20 = Number(num_19)

num_21 = Number(num_19)

# ----
# Geometry Rotate Orientation
panel_9 = Panel("0")
multiplication_3 = Multiplication(A="180", B=Toggle(True))
x_adjustment_2 = Slider(80, range=0..150)
ghpython_script = GhPythonScript(x=group_number)  # -> a
# ---------- ghpython_script: Python ----------
if x > 0:
    a = 1
else:
    a = 0
# ---------- end ghpython_script ----------
unit_x = UnitX(Factor=x_adjustment_2)
negative = Negative(Value=unit_x)

# ----
# Orient and Align
panel_10 = Panel("Closed Brep")
md_slider_2 = MDSlider(
    SliderMode=0,
    slider_value=Point(0.5016155243, 0.5043478012, 0.5),
    x_domain=Domain(0, 1),
    y_domain=Domain(0, 1),
    z_domain=Domain(0, 1))

# ----
# Selecting Cutting Face
panel_11 = Panel("0")

# ---- group: TOOLPATH
swatch = ColourSwatch(SwatchColor=RGB(0, 255, 255))

# ----
# Surface Selection (Member Ends)
panel_12 = Panel("""1
3""")

# ----
# Label Data
panel_13 = Panel("{")

# ----
# Reciprocal to Elements
number_slider_7 = Slider(-65, range=-94..30)

division_4 = Division(A=num_11, B="2")

# ----
# Geometry Grouping
unit_y = UnitY(Factor=1)

recipricalextend = RecipricalExtend(Mesh=hexdivide.Mesh, Angle=Slider(0.13, range=0..6), Scale=number_slider_7, NormalType=True, Height=division_4)  # -> Axes, Faces, LineP, EndP, simplify(Nei)
polylinemove = PolylineMove(Curve=recipricalextend.Faces, Distance=num_11)  # -> graft(A), graft(B)
pca = PCA(G=[polylinemove.A, polylinemove.B], I="0")  # -> A, C
plate = Plate(TopPlines=graft(polylinemove.A), BotPlines=graft(polylinemove.B), Display_Area=True, OutputPlanesAndOutlines=False)  # -> Model, reverse(Elements)

# ----
# Regular Rectangle Sections
# *Adapted from petrasvestartas' example files for nGon
number_slider_8 = Slider(0, range=0..1)
toggle = BooleanToggle(True)

tileaa_crosslap = TileAA_CrossLap(JointID=-1, Angle=number_slider_8, Type=0, Extend0=Slider(0, range=0..1), Extend1=1, Extend2=0, Scale=1.1)  # -> T, A, B, M, F

solver = Solver(
    Elements=plate.Elements,
    Groups=False,
    Merge=invert(toggle),
    Tiles=tileaa_crosslap.T,
    Display_Area=True,
    Display_Axes=True,
    Display_Base_Plane=False,
    Display_ID=False,
    Display_Joints=True,
    Display_Planes=False,
    Display_Volume=True,
    IDScale="10",
    OutputPlanesAndOutlines=True,
    PlaneScale="10",
    TileScaleZ="1.02")  # -> Elements, Model, Geo, Cut
solver_2 = Solver(
    Elements=plate.Elements,
    Groups=False,
    Merge=toggle,
    Tiles=tileaa_crosslap.T,
    Display_Area=True,
    Display_Axes=True,
    Display_Base_Plane=False,
    Display_ID=False,
    Display_Joints=True,
    Display_Planes=False,
    Display_Volume=True,
    IDScale="10",
    OutputPlanesAndOutlines=True,
    PlaneScale="10",
    TileScaleZ="1.02")  # -> Elements, Model, Geo, Cut
loftholes = LoftHoles(Polylines0=solver_2.Geo)  # -> Mesh, Mesh_2
loftholes_2 = LoftHoles(Polylines0=solver.Geo)  # -> Mesh, Mesh_2

# ----
# SCALE GEOMETRY
number_slider_9 = Slider(2, range=1..5)
scale_3 = Scale(Geometry=loftholes.Mesh, Center=Point(0, 0, 0), Factor=number_slider_9)  # -> Geometry, Transform
scale_4 = Scale(Geometry=loftholes_2.Mesh, Center=Point(0, 0, 0), Factor=number_slider_9)  # -> Geometry, Transform
multiplication_4 = Multiplication(A=num_15, B=number_slider_9)

# ---- group: SCALED MEMBERS - MESH
mesh = Mesh(scale_3.Geometry)

# ---- group: MEMBERS - MESH
mesh_2 = Mesh(mesh)

# ---- group: MEMBER WIDTH
num_22 = Number(multiplication_4)

num_23 = Number(num_22)

num_24 = Number(num_22)

# ---- group: SCALED BLANKS - MESH
mesh_3 = Mesh(scale_4.Geometry)

# ---- group: BLANKS - MESH
mesh_4 = Mesh(mesh_3)

# ----
faceb = FaceBoundaries(Mesh=mesh)
faceb_2 = FaceBoundaries(Mesh=mesh_3)
boundary = BoundarySurfaces(Edges=faceb)
boundary_2 = BoundarySurfaces(Edges=faceb_2)
join = BrepJoin(Breps=boundary)  # -> flatten(Breps), Closed
join_2 = BrepJoin(Breps=boundary_2)  # -> Breps, Closed
debrep = DeconstructBrep(Brep=join_2.Breps)  # -> Faces, Edges, Vertices
panel_14 = Panel(join.Breps)
group = Group(Objects=debrep.Faces)  # -> flatten(Group)
tmatch = MatchText(Text=panel_10, Pattern=panel_14, Case=True)
dispatch = Dispatch(List=join.Breps, DispatchPattern=tmatch)  # -> ListA, ListB
dispatch_2 = Dispatch(List=group, DispatchPattern=tmatch)  # -> ListA, ListB
volume = Volume(Geometry=dispatch.ListA)  # -> Volume, Centroid
sort = SortList(Keys=volume.Volume, ValuesA=dispatch.ListA)  # -> Keys, ValuesA
sort_2 = SortList(Keys=volume.Volume, ValuesA=dispatch_2.ListA)  # -> Keys, ValuesA
ungroup = Ungroup(Group=sort_2.ValuesA)
item = ListItem(List=ungroup, Index="5", Wrap=True)  # -> simplify(Item)
item_2 = ListItem(List=ungroup, Index=0, Wrap=True)  # -> flatten(Item)
evalsrf = EvaluateSurface(Surface=reparameterize(item), Point=md_slider_2)  # -> Point, Normal, UDirection, VDirection, Frame
lng = ListLength(List=item_2)
deplane = DeconstructPlane(Plane=evalsrf.Frame)  # -> simplify(Origin), simplify(XAxis), simplify(YAxis), ZAxis
series_2 = Series(Start=0, Step=member_spacing, Count=lng)
pt_3 = ConstructPoint(XCoordinate=0, YCoordinate=series_2, ZCoordinate=0)
pl = ConstructPlane(Origin=flatten(deplane.Origin), XAxis=expr("-x", flatten(deplane.XAxis)), YAxis=flatten(deplane.YAxis))
xy_2 = XYPlane(Origin=pt_3)

center = Center(Geometric=mesh)  # -> Center, Dimension
tstat = TreeStatistics(Tree=center.Center)  # -> Paths, Length, Count
flatten = FlattenTree(Tree=center.Center, Path="{0}")
rep = ReplaceText(Text=tstat.Paths, Find=panel_13, Replace="No.", RecursiveReplace=False)
rep_2 = ReplaceText(Text=rep, Find="}", Replace=" ", RecursiveReplace=False)
dispatch_3 = Dispatch(List=flatten, DispatchPattern=tmatch)  # -> ListA, ListB
dispatch_4 = Dispatch(List=rep_2, DispatchPattern=tmatch)  # -> ListA, ListB
sort_3 = SortList(Keys=volume.Volume, ValuesA=dispatch_3.ListA)  # -> Keys, ValuesA
sort_4 = SortList(Keys=volume.Volume, ValuesA=dispatch_4.ListA)  # -> Keys, ValuesA
orient = Orient(Geometry=flatten(sort_3.ValuesA), Source=flatten(pl), Target=flatten(xy_2))  # -> Geometry, Transform

# ----
# Label Grouping
pt_4 = Point(orient.Geometry)
txt = Text(sort_4.ValuesA)
partition = PartitionList(List=flatten(pt_4), Size=num)
partition_2 = PartitionList(List=flatten(txt), Size=num)
flip = FlipMatrix(Data=partition)
flip_2 = FlipMatrix(Data=partition_2)
item_3 = ListItem(List=flip, Index=num_8, Wrap=True)  # -> simplify(Item)
item_4 = ListItem(List=flip_2, Index=num_9, Wrap=True)  # -> simplify(Item)
pt_5 = Point(flatten(item_3))
txt_2 = Text(flatten(item_4))

# ---- group: Label Location
pt_6 = Point(pt_5)

# ---- group: Text Information
txt_3 = Text(txt_2)

# ---- group: Members
orient_2 = Orient(Geometry=flatten(sort.ValuesA), Source=flatten(pl), Target=flatten(xy_2))  # -> Geometry, Transform

# ---- group: ORIENTED GEOMETRY
geo_5 = Geometry(orient_2.Geometry)

# ---- group: GEOMETRIES
geo_6 = Geometry(geo_5)

# ----
partition_3 = PartitionList(List=flatten(geo_6), Size=num)
flip_3 = FlipMatrix(Data=partition_3)
item_5 = ListItem(List=flip_3, Index=num_10, Wrap=True)  # -> simplify(Item)
geo_7 = Geometry(flatten(item_5))
bbox = BoundingBox(Content=flatten(geo_7), Plane=PlaneXY(0, 0, 0), UnionBox=True)  # -> Box, Box_2
boxprop = BoxProperties(Box=bbox.Box)  # -> Center, Diagonal, Area, Volume, Degeneracy
deplane_2 = DeconstructPlane(Plane=boxprop.Center)  # -> Origin, XAxis, YAxis, ZAxis
debrep_2 = DeconstructBrep(Brep=bbox.Box)  # -> simplify(Faces), Edges, Vertices
line = LineSDL(Start=boxprop.Center, Direction=unit_y, Length=1)
item_6 = ListItem(List=debrep_2.Vertices, Index=Slider(0, range=0..5), Wrap=True)
rotax = RotateAxis(Geometry=item_5, Angle=degrees("-180"), Axis=line)  # -> Geometry, Transform
filter = StreamFilter(Gate=num_12, Stream0=item_5, Stream1=rotax.Geometry)

# ---- group: GEOMETRY
geo_8 = Geometry(filter)

# ----
geo_9 = Geometry(geo_8)
debrep_3 = DeconstructBrep(Brep=geo_9)  # -> Faces, Edges, Vertices
devec = DeconstructVector(Vector=debrep_3.Faces)  # -> XComponent, YComponent, ZComponent
larger = LargerThan(FirstNumber=devec.ZComponent, SecondNumber=panel_9)  # -> LargerThan, OrEqualTo
dispatch_5 = Dispatch(List=debrep_3.Faces, DispatchPattern=larger.LargerThan)  # -> ListA, ListB
devec_2 = DeconstructVector(Vector=dispatch_5.ListA)  # -> XComponent, YComponent, ZComponent
larger_2 = LargerThan(FirstNumber=devec_2.ZComponent, SecondNumber="0.5")  # -> LargerThan, OrEqualTo
equals = Equality(FirstNumber=devec_2.ZComponent, SecondNumber="1")  # -> Equality, Inequality
and = GateAnd(A=larger_2.LargerThan, B=equals.Inequality)
dispatch_6 = Dispatch(List=dispatch_5.ListA, DispatchPattern=and)  # -> ListA, ListB
area = Area(Geometry=geo_9)  # -> Area, Centroid
area_2 = Area(Geometry=dispatch_6.ListA)  # -> Area, Centroid
pdecon = Deconstruct(Point=area_2.Centroid)  # -> XComponent, YComponent, ZComponent
ma = MassAddition(Input=pdecon.XComponent)  # -> Result, PartialResults
smaller = SmallerThan(FirstNumber=ma.Result, SecondNumber="0")  # -> SmallerThan, OrEqualTo
dispatch_7 = Dispatch(List=geo_9, DispatchPattern=smaller.SmallerThan)  # -> ListA, ListB
rotate = Rotate(Geometry=dispatch_7.ListA, Angle=degrees("180"), Plane=area.Centroid)  # -> Geometry, Transform
index = ItemIndex(List=geo_9, Item=dispatch_7.ListA)
replace = ReplaceItems(List=geo_9, Item=rotate.Geometry, Indices=index, Wrap=False)
geo_10 = Geometry(replace)
rotate_2 = Rotate(Geometry=geo_10, Angle=degrees(multiplication_3), Plane=area.Centroid)  # -> Geometry, Transform
clean_tree = CleanTree(RemoveNulls=True, RemoveInvalid=True, RemoveEmpty=True, Tree=rotate_2.Geometry)  # -> simplify(Tree)
move_7 = Move(Geometry=clean_tree, Motion=negative)  # -> Geometry, Transform
stream_filter = StreamFilter(Gate=ghpython_script, Stream0=move_7.Geometry, Stream1=clean_tree)

rotax_2 = RotateAxis(Geometry=geometry_4, Angle=degrees("-180"), Axis=line)  # -> Geometry, Transform
filter_2 = StreamFilter(Gate=Toggle(False), Stream0=geometry_4, Stream1=rotax_2.Geometry)

# ---- group: FLIPPED FIXTURE
geometry_5 = Geometry(filter_2)

# ---- group: FIXTURE
geo_11 = Geometry(geometry_5)

# ----
geometry_6 = Geometry(stream_filter)

# ---- group: GEOMETRY
geo_12 = Geometry(geometry_6)

# ----
geo_13 = Geometry(geometry_6)
debrep_4 = DeconstructBrep(Brep=geo_13)  # -> Faces, Edges, Vertices
devec_3 = DeconstructVector(Vector=debrep_4.Faces)  # -> XComponent, YComponent, ZComponent
larger_3 = LargerThan(FirstNumber=devec_3.ZComponent, SecondNumber=panel_11)  # -> LargerThan, OrEqualTo
dispatch_8 = Dispatch(List=debrep_4.Faces, DispatchPattern=larger_3.LargerThan)  # -> ListA, ListB
devec_4 = DeconstructVector(Vector=dispatch_8.ListA)  # -> XComponent, YComponent, ZComponent
larger_4 = LargerThan(FirstNumber=devec_4.ZComponent, SecondNumber="0.5")  # -> LargerThan, OrEqualTo
equals_2 = Equality(FirstNumber=devec_4.ZComponent, SecondNumber="1")  # -> Equality, Inequality
and_2 = GateAnd(A=larger_4.LargerThan, B=equals_2.Inequality)
dispatch_9 = Dispatch(List=dispatch_8.ListA, DispatchPattern=and_2)  # -> ListA, ListB
brep = Brep(dispatch_9.ListA)

# ---- group: OPERATION SELECTION / NOTCH SURFACES
brep_2 = Brep(brep)

# ----
brep_3 = Brep(brep)
debrep_5 = DeconstructBrep(Brep=flatten(brep_3))  # -> Faces, Edges, Vertices
evalsrf_2 = EvaluateSurface(Surface=reparameterize(debrep_5.Faces), Point=md_slider)  # -> Point, Normal, UDirection, VDirection, Frame
join_3 = JoinCurves(Curves=debrep_5.Edges, Preserve=False)
offsets = OffsetOnSrf(Curve=join_3, Distance=division_2, Surface=debrep_5.Faces)
explode = Explode(Curve=offsets, Recursive=True)  # -> Segments, Vertices
eval = EvaluateLength(Curve=explode.Segments, Length="0.5", Normalized=True)  # -> simplify(Point), Tangent, Parameter
plcoord = PlaneCoordinates(Point=eval.Point, System=PlaneXY(0, 0, 0))  # -> XCoordinate, YCoordinate, ZCoordinate
sort_5 = SortList(Keys=plcoord.ZCoordinate, ValuesA=explode.Segments)  # -> Keys, ValuesA
item_7 = ListItem(List=sort_5.ValuesA, Index="1", Wrap=True)
item_8 = ListItem(List=sort_5.ValuesA, Index="2", Wrap=True)
flip_4 = FlipCurve(Curve=item_7)  # -> Curve, Flag
len = Length(Curve=flip_4.Curve)
len_2 = Length(Curve=item_8)
division_5 = Division(A=len, B=panel_3)
division_6 = Division(A=len_2, B=panel_4)
divide = DivideCurve(Curve=flip_4.Curve, Count=division_5, Kinks=False)  # -> Points, Tangents, Parameters
divide_2 = DivideCurve(Curve=item_8, Count=division_6, Kinks=False)  # -> Points, Tangents, Parameters
ln_2 = Line(StartPoint=divide.Points, EndPoint=divide_2.Points)
ext_3 = ExtendCurve(Curve=ln_2, Type=0, Start=panel_3, End=panel_3)  # -> simplify(Curve)
dispatch_10 = Dispatch(List=ext_3, DispatchPattern=[True, False])  # -> ListA, ListB
flip_5 = FlipCurve(Curve=dispatch_10.ListB)  # -> Curve, Flag
weave = Weave(Pattern=[0, 1], Stream0=dispatch_10.ListA, Stream1=flip_5.Curve, NullGaps=False)
end = EndPoints(Curve=weave)  # -> Start, End
weave_2 = Weave(Pattern=[0, 1], Stream0=end.Start, Stream1=end.End, NullGaps=False)
pline = PolyLine(Vertices=weave_2, Closed=False)
amp = Amplitude(Vector=evalsrf_2.Normal, Amplitude=series)
move_8 = Move(Geometry=pline, Motion=amp)  # -> Geometry, Transform
dispatch_11 = Dispatch(List=move_8.Geometry, DispatchPattern=[True, False])  # -> ListA, ListB
flip_6 = FlipCurve(Curve=dispatch_11.ListB)  # -> Curve, Flag
weave_3 = Weave(Pattern=[0, 1], Stream0=dispatch_11.ListA, Stream1=flip_6.Curve, NullGaps=False)
end_2 = EndPoints(Curve=weave_3)  # -> Start, End
shift = ShiftList(List=end_2.End, Shift=1, Wrap=True)
ln_3 = Line(StartPoint=end_2.Start, EndPoint=shift)
len_3 = Length(Curve=ln_3)
ma_2 = MassAddition(Input=len_3)  # -> Result, PartialResults
lng_2 = ListLength(List=len_3)
division_7 = Division(A=ma_2.Result, B=lng_2)
smaller_2 = SmallerThan(FirstNumber=len_3, SecondNumber=division_7)  # -> SmallerThan, OrEqualTo
dispatch_12 = Dispatch(List=ln_3, DispatchPattern=smaller_2.SmallerThan)  # -> ListA, ListB
crv = Curve(dispatch_12.ListA)
lng_3 = ListLength(List=crv)
series_3 = Series(Start="1", Step=1, Count=lng_3)
ins = InsertItems(List=weave_3, Item=crv, Indices=series_3, Wrap=True)  # -> simplify(List)
join_4 = JoinCurves(Curves=ins, Preserve=False)
end_3 = EndPoints(Curve=join_4)  # -> Start, End
pdecon_2 = Deconstruct(Point=end_3.Start)  # -> XComponent, YComponent, ZComponent
pdecon_3 = Deconstruct(Point=end_3.End)  # -> XComponent, YComponent, ZComponent
larger_5 = LargerThan(FirstNumber=pdecon_2.YComponent, SecondNumber=pdecon_3.YComponent)  # -> LargerThan, OrEqualTo
dispatch_13 = Dispatch(List=join_4, DispatchPattern=larger_5.LargerThan)  # -> ListA, ListB
flip_7 = FlipCurve(Curve=dispatch_13.ListA)  # -> Curve, Flag
replace_2 = ReplaceItems(List=join_4, Item=flip_7.Curve, Wrap=False)
geometry_7 = Geometry(simplify(replace_2))
explode_2 = Explode(Curve=replace_2, Recursive=True)  # -> Segments, Vertices
pl_2 = PlaneNormal(Origin=explode_2.Vertices, ZAxis=evalsrf_2.Normal)
plane = Plane(pl_2)

# ---- group: GEOMETRY
geo_14 = Geometry(geo_12)

# ----
bbox_2 = BoundingBox(Content=geo_14, Plane=PlaneXY(0, 0, 0), UnionBox=True)  # -> Box, Box_2
debrep_6 = DeconstructBrep(Brep=bbox_2.Box)  # -> simplify(Faces), Edges, Vertices
debrep_7 = DeconstructBrep(Brep=geo_14)  # -> simplify(Faces), Edges, Vertices
item_9 = ListItem(List=debrep_6.Faces, Index=panel_12, Wrap=True)
center_2 = Center(Geometric=item_9)  # -> Center, Dimension
center_3 = Center(Geometric=debrep_7.Faces)  # -> Center, Dimension
cp = ClosestPoint(Point=center_2.Center, Cloud=center_3.Center)  # -> ClosestPoint, CPIndex, Distance
item_10 = ListItem(List=cp.ClosestPoint, Index="1", Wrap=True)
mindex = MemberIndex(Set=center_3.Center, Member=item_10)  # -> simplify(Index), Count
item_11 = ListItem(List=debrep_7.Faces, Index=mindex.Index, Wrap=True)

# ---- group: GEOMETRY
geo_15 = Geometry(geometry_6)

# ---- group: END SURFACES
geo_16 = Geometry(item_11)

# ---- group: SURFACE
geo_17 = Geometry(geo_16)

# ---- group: FINISH PASS / SURFACE
geo_18 = Geometry(geo_17)

# ---- group: SURFACE
# Toolpath Generation (Member Ends)
geo_19 = Geometry(geo_17)

# ---- group: FINISH PASS (continued)
offset = OffsetSurface(Surface=geo_18, Distance=division, Retrim=True)
explode_3 = Explode(Curve=offset, Recursive=True)  # -> Segments, Vertices
eval_2 = EvaluateLength(Curve=explode_3.Segments, Length="0.5", Normalized=True)  # -> simplify(Point), Tangent, Parameter
plcoord_2 = PlaneCoordinates(Point=eval_2.Point, System=PlaneXY(0, 0, 0))  # -> XCoordinate, YCoordinate, ZCoordinate
sort_6 = SortList(Keys=plcoord_2.ZCoordinate, ValuesA=explode_3.Segments)  # -> Keys, ValuesA
item_12 = ListItem(List=sort_6.ValuesA, Index="0", Wrap=True)  # -> simplify(Item)

# ----
offset_2 = OffsetSurface(Surface=geo_19, Distance=addition_3, Retrim=True)
explode_4 = Explode(Curve=offset_2, Recursive=True)  # -> Segments, Vertices
eval_3 = EvaluateLength(Curve=explode_4.Segments, Length="0.5", Normalized=True)  # -> simplify(Point), Tangent, Parameter
plcoord_3 = PlaneCoordinates(Point=eval_3.Point, System=PlaneXY(0, 0, 0))  # -> XCoordinate, YCoordinate, ZCoordinate
sort_7 = SortList(Keys=plcoord_3.ZCoordinate, ValuesA=explode_4.Segments)  # -> Keys, ValuesA
sort_8 = SortList(Keys=plcoord_3.ZCoordinate, ValuesA=explode_4.Segments)  # -> Keys, ValuesA
item_13 = ListItem(List=sort_7.ValuesA, Index="-1", Wrap=True)
item_14 = ListItem(List=sort_8.ValuesA, Index="0", Wrap=True)
midpt_2 = CurveMiddle(Curve=item_13)
midpt_3 = CurveMiddle(Curve=item_14)
vec2pt = Vector2Pt(PointA=midpt_2, PointB=midpt_3, Unitize=False)  # -> simplify(Vector), Length
amp_2 = Amplitude(Vector=vec2pt.Vector, Amplitude=num_13)
contour = Contour(Shape=offset_2, Point=midpt_2, Direction=vec2pt.Vector, Distance=num_20)  # -> simplify(Contours)
move_9 = Move(Geometry=item_14, Motion=amp_2)  # -> simplify(Geometry), Transform
pshift = ShiftPaths(Data=contour, Offset=-1)
ins_2 = InsertItems(List=pshift, Item=move_9.Geometry, Indices=-1, Wrap=True)

# ----
# Combine Passes
ins_3 = InsertItems(List=ins_2, Item=item_12, Indices=-1, Wrap=True)

# ----
# Fixture Generation
large_beam_height = Slider(180, range=0..200)
large_beam_thickness = Slider(60, range=0..200)
num_25 = Number(num_24)
boxdims = BoxDimensions(Box=bbox.Box)  # -> XDimension, YDimension, ZDimension
addition_4 = Addition(A=boxdims.YDimension, B=Slider(800, range=0..1000))
expression = Expression(x=large_beam_height, y=large_beam_thickness, Expression="(x - y) / 2")
expression_2 = Expression(x=large_beam_height, y=num_25, Expression="(((x - y) / 2) - y) / 2 + y")
expression_3 = Expression(x=large_beam_height, y=num_25, Expression="(x - y) / 2")
expression_4 = Expression(x=large_beam_height, y=large_beam_thickness, Expression="(x - y) / 2")
box = CenterBox(
    Base=boxprop.Center,
    X=expr("X / 2", large_beam_height),
    Y=expr("X / 2", boxdims.YDimension),
    Z=expr("X / 2", expression_3))
box_2 = CenterBox(
    Base=boxprop.Center,
    X=expr("X / 2", large_beam_thickness),
    Y=expr("X / 2", addition_4),
    Z=expr("X / 2", large_beam_height))
box_3 = CenterBox(Base=boxprop.Center, X=expr("X / 2", expression), Y=expr("X / 2", boxdims.YDimension), Z=expr("X / 2", expression_3))
Z_3 = UnitZ(Factor=expression_2)
negative_2 = Negative(Value=Z_3)
geo_20 = Geometry(box_2)
move_10 = Move(Geometry=box_3, Motion=negative_2)  # -> Geometry, Transform
bbox_3 = BoundingBox(Content=flatten(geo_7), Plane=PlaneXY(0, 0, 0), UnionBox=False)  # -> Box, Box_2
amp_3 = Amplitude(Vector=deplane_2.XAxis, Amplitude=expression_4)
sdiff = SolidDifference(BrepsA=geo_20, BrepsB=bbox_3.Box)
move_11 = Move(Geometry=box, Motion=Z_3)  # -> Geometry, Transform
volume_2 = Volume(Geometry=move_11.Geometry)  # -> Volume, Centroid
move_12 = Move(Geometry=sdiff, Motion=expr("-x", amp_3))  # -> Geometry, Transform
move_13 = Move(Geometry=sdiff, Motion=amp_3)  # -> Geometry, Transform
deconstruct_brep = DeconstructBrep(Brep=move_12.Geometry)  # -> Faces, Edges, Vertices
scale_5 = Scale(Geometry=move_11.Geometry, Center=volume_2.Centroid, Factor=Slider(1.005, range=1..1.1))  # -> Geometry, Transform
sdiff_2 = SolidDifference(BrepsA=[move_13.Geometry, move_12.Geometry], BrepsB=scale_5.Geometry)
list_item = ListItem(List=deconstruct_brep.Vertices, Index=Slider(1, range=0..100), Wrap=True)

# ---- group: END SURFACES
geo_21 = Geometry(item_11)

# ----
# Generate Frames
ext_4 = ExtendCurve(Curve=ins_3, Type=0, Start=num_21, End=num_21)  # -> simplify(Curve)
neg = Negative(Value=vec2pt.Vector)
cull_i = CullIndex(List=ext_4, Indices="0", Wrap=True)
item_15 = ListItem(List=cull_i, Index=0, Wrap=True)
flip_8 = FlipCurve(Curve=cull_i, Guide=item_15)  # -> Curve, Flag
flip_9 = FlipCurve(Curve=flip_8.Curve)  # -> Curve, Flag
filter_3 = StreamFilter(Gate=flip_tool_entrance_direction, Stream0=flip_8.Curve, Stream1=flip_9.Curve)
panel_15 = Panel("""True
False""")
center_4 = Center(Geometric=geo_21)  # -> Center, Dimension
pl_3 = PlaneNormal(Origin=center_4.Center, ZAxis=neg)
dispatch_14 = Dispatch(List=filter_3, DispatchPattern=panel_15)  # -> ListA, ListB
flip_10 = FlipCurve(Curve=dispatch_14.ListB)  # -> Curve, Flag
weave_4 = Weave(Pattern=[0, 1], Stream0=dispatch_14.ListA, Stream1=flip_10.Curve, NullGaps=False)
disc = Discontinuity(Curve=weave_4, Level=1)  # -> Points, Parameters
pshift_2 = ShiftPaths(Data=disc.Points, Offset=-1)  # -> simplify(Data)
lng_4 = ListLength(List=pshift_2)
dup = DuplicateData(Data=neg, Number=lng_4, Order=True)  # -> simplify(Data)
pl_4 = PlaneNormal(Origin=pshift_2, ZAxis=dup)
polyline = PolyLine(Vertices=pl_4, Closed=False)

# ---- group: END FRAMES
pln_2 = Plane(pl_4)

# ---- group: END TOOLPATHS (INDIVIDUAL)
curve = Curve(polyline)

# ---- group: OPERATION SELECTION / END TOOLPATH
crv_2 = Curve(curve)

# ---- group: END FRAMES FOR LEEDS AND LINKS
plane_2 = Plane(pl_3)

# ---- group: OPERATION SELECTION / END SURFACES (PERPENDICULAR)
brep_4 = Brep(plane_2)

# ---- group: MOUNTING FIXTURE
# Remove Bad Meshes
# Order By Volume
geo_22 = Geometry([sdiff_2, move_11.Geometry, move_10.Geometry])

# ---- group: CORNER OF SETUP
geometry_8 = Geometry(list_item)

pt_7 = Point(geometry_8)

geo_23 = Geometry(pt_7)

# ----
orient_3 = Orient(Geometry=pt_6, Source=geo_23, Target=sframe)  # -> Geometry, Transform
orient_4 = Orient(Geometry=geo_15, Source=geo_23, Target=sframe)  # -> Geometry, Transform
center_5 = Center(Geometric=orient_4.Geometry)  # -> Center, Dimension
box_4 = CenterBox(Base=center_5.Center, X=expr("x / 2", num_16), Y=expr("x / 2", num_17), Z=expr("x / 2", num_18))
orient_5 = Orient(Geometry=geo_11, Source=geo, Target=sframe)  # -> Geometry, Transform

# ---- group: Labels
tag = TextTag(Location=orient_3.Geometry, Text=txt_3)

# ---- group: ORIENTED GEOMETRY
geo_24 = Geometry(orient_4.Geometry)

# ---- group: GEOMETRY
geo_25 = Geometry(geo_24)

geo_26 = Geometry(geo_25)

# ---- group: ORIENTED FIXTURE
geo_27 = Geometry(orient_5.Geometry)

# ---- group: FIXTURE
geo_28 = Geometry(geo_27)

geo_29 = Geometry(geo_28)

# ---- group: ORIENTED STOCK
geo_30 = Geometry(box_4)

# ---- group: STOCK
geo_31 = Geometry(geo_30)

geo_32 = Geometry(geo_31)

# ----
# Geometry
filter_4 = StreamFilter(Gate=show_geometry, Stream1=geo_26)
filter_5 = StreamFilter(Gate=show_fixture, Stream1=geo_29)
filter_6 = StreamFilter(Gate=show_stock, Stream1=geo_32)

# ---- group: STOCK
geo_33 = Geometry(filter_6)

# ---- group: ALL GEOMETRY
geo_34 = Geometry([filter_4, filter_5, filter_6])

# ---- group: FINISHED PARTS
geo_35 = Geometry(filter_4)

# ---- group: FIXTURE
geo_36 = Geometry(filter_5)

# ----
custom_preview_2 = CustomPreview(Geometry=geo_35, Material=ColourSwatch(SwatchColor=RGB(236, 213, 167)))
custom_preview_3 = CustomPreview(Geometry=geo_36, Material=ColourSwatch(SwatchColor=RGB(159, 133, 93)))
custom_preview_4 = CustomPreview(Geometry=geo_33, Material=ColourSwatch(SwatchColor=RGB(236, 213, 167)))

# ---- group: NOTCH FRAMES
# Orient Geometry Long Ways
# Align and Lay Geometry on XY Plane
# Align Geometry By Center
# Leads and Links
plane_3 = Plane(simplify(plane))

# ---- group: NOTCH TOOLPATHS (INDIVIDUAL)
geometry_9 = Geometry(simplify(geometry_7))

# ---- group: OPERATION SELECTION / NOTCH TOOLPATH
crv_3 = Curve(geometry_9)

# ---- group: OPERATION SELECTION
stream_filter_2 = StreamFilter(Gate=toolpath, Stream0=crv_3, Stream1=crv_2)
stream_filter_3 = StreamFilter(Gate=toolpath, Stream0=brep_2, Stream1=brep_4)

# ---- group: UNFLATTENED POLYLINE
crv_4 = Curve(stream_filter_2)

# ---- group: SURFACES
brep_5 = Brep(stream_filter_3)

# Prep Toolpaths
srf = Surface(brep_5)

# ---- group: UNFLATTENED POLYLINE
crv_5 = Curve(crv_4)

# ----
flatten_2 = FlattenTree(Tree=srf, Path="{0}")  # -> simplify(graft(Tree))
_5x_srf_contour = _5XSurfaceContour(Polyline=crv_5, Surface=flatten_2, ClearanceOffset=Slider(165, range=100..500), Base=pln)  # -> Points, Vectors, Feed

# ---- group: POINTS
pt_8 = Point(_5x_srf_contour.Points)

# ---- group: NORMALS
vec_4 = Vector(_5x_srf_contour.Vectors)

# ---- group: FEED LIST
txt_4 = Text(_5x_srf_contour.Feed)

# ---- group: FEEDS
text = Text(txt_4)

# ----
# NC Generation
# Orient and Rotate Frames
plane_normal = PlaneNormal(Origin=pt_8, ZAxis=vec_4)
orient_6 = Orient(Geometry=plane_normal, Source=geo_23, Target=sframe)  # -> Geometry, Transform
lng_5 = ListLength(List=orient_6.Geometry)

deplane_3 = DeconstructPlane(Plane=orient_6.Geometry)  # -> Origin, XAxis, YAxis, ZAxis
avr = Average(Input=deplane_3.Origin)
pdecon_4 = Deconstruct(Point=avr)  # -> XComponent, YComponent, ZComponent
y_threshold = Slider(200, range=-1000..1000)
larger_6 = LargerThan(FirstNumber=pdecon_4.YComponent, SecondNumber=y_threshold)  # -> LargerThan, OrEqualTo
dispatch_15 = Dispatch(List=avr, DispatchPattern=larger_6.LargerThan)  # -> ListA, ListB
lng_6 = ListLength(List=dispatch_15.ListA)
lng_7 = ListLength(List=dispatch_15.ListB)
bnd = Bounds(Numbers=flatten(pdecon_4.XComponent))
bnd_2 = Bounds(Numbers=flatten(pdecon_4.YComponent))
c_script = CSharpScript(D=bnd_2)  # -> out, A
# ---------- c_script: C# ----------
    double t0 = D.T0;
    double t1 = D.T1;
    
    if (Math.Abs(t0) >= Math.Abs(t1)){
      Print("t0 larger or equal than t1");
      t1 = Math.Abs(t0);
    } else {
      Print("t1 larger than t0");
      t0 = Math.Abs(t1);
    }

    A = new Interval(t0, t1);
    //A = D.Mid;
# ---------- end c_script ----------
repeat = RepeatData(Data=Slider(90, range=-90..90), Length=lng_6)
repeat_2 = RepeatData(Data=Slider(-90, range=-90..90), Length=lng_7)
merge = Merge(Data1=repeat, Data2=repeat_2)  # -> simplify(Result)
remap = RemapNumbers(Value=pdecon_4.XComponent, Source=bnd, Target=Domain(1, 0))  # -> Mapped, Clipped
remap_2 = RemapNumbers(Value=pdecon_4.YComponent, Source=c_script.A, Target="-90 to 90")  # -> Mapped, Clipped
remap_3 = RemapNumbers(Value=pdecon_4.YComponent, Source=c_script.A, Target=Domain(0, 1))  # -> Mapped, Clipped
multiplication_5 = Multiplication(A=merge, B=remap.Mapped)
multiplication_6 = Multiplication(A=remap_2.Mapped, B=remap_3.Mapped)
addition_5 = Addition(A=multiplication_5, B=multiplication_6)
filter_7 = StreamFilter(Gate=Slider(2, range=0..2), Stream0=merge, Stream1=remap_2.Mapped, Stream2=addition_5)  # -> simplify(Stream)

dup_2 = DuplicateData(Data=filter_7, Number=lng_5, Order=True)

rad = Radians(Degrees=dup_2)
prot = RotatePlane(Plane=orient_6.Geometry, Angle=rad)

# ---- group: ROTATION VALUES
number = Number(dup_2)

# ----
# Generate NC Code
deplane_4 = DeconstructPlane(Plane=prot)  # -> Origin, XAxis, YAxis, ZAxis
construct_plane = ConstructPlane(Origin=deplane_4.Origin, XAxis=deplane_4.XAxis, YAxis=deplane_4.YAxis)
nc = NCGeneration(Points=deplane_4.Origin, Vectors=deplane_4.ZAxis, Feed=text, Settings=data_2)
nc_r = NCGenerationRobomove(Points=deplane_4.Origin, Vectors=deplane_4.ZAxis, Rotation=number, Feed=text, Settings=data_2)

# ---- group: ORIENTED TOOLPATH FRAMES
plane_4 = Plane(construct_plane)

pln_3 = Plane(plane_4)

# ---- group: FRAMES
geo_37 = Geometry(pln_3)

pln_4 = Plane(pln_3)

# ----
# Toolpath
pline_2 = PolyLine(Vertices=flatten(geo_37), Closed=False)

iframe = InterpolateFrames(Frames=flatten(pln_4), Length=num_7, Step=number_slider_6, Reset=Toggle(True))  # -> Frame, Percent, CurrentIndex

# ---- group: KUKA SIMULATION
robot_ik = RobotInverseKinematics(Robot=kuka_kr_125_2, TargetTCPFrame=iframe.Frame, AxisToggles=[False, False, False], useColorPreview=True)  # -> PoseGeometry, AxisValues, AxisFrames

# ---- group: TOOLPATH (continued)
crv_6 = Curve(pline_2)
preview = CustomPreview(Geometry=crv_6, Material=swatch)
custom_preview_lineweights = CustomPreviewLineweights(Geometry=crv_6, Shader=swatch, Thickness=Slider(1, range=0..5), Absolute=False)

# ---- group: REGULAR NC
txt_5 = Text(flatten(nc))

# ---- group: ROBOMOVE NC
txt_6 = Text(flatten(nc_r))

# ----
nc_file = Panel(txt_6)
