# Grasshopper definition Slime Mold Final_Hildebrandt.gh (Grasshopper 1.0.7)
# plug-ins: Mesh Pipe

# ---- group: Inputs / Food Sources
food_source_radius = Slider(3, range=0..50)
food_source_count = Slider(9, range=0..20)
seed_value = Slider(3.4, range=0..5)

# 2. 3D Network
food_source_count_2 = Slider(12, range=0..20)
seed_value_2 = Slider(5, range=0..5)
food_source_radius_2 = Slider(1, range=0..50)

# ---- group: Inputs
boundary_dimensions = Slider(5, range=0..50)
velocity_factor = Slider(0.2, range=0.01..1)
timer = Timer(Interval=10, TimerInterval=10, Target=python)  # disabled
reset_button = Button()

# ----
# 3. 3D Network - No Global Variables
food_source_count_3 = Slider(12, range=0..20)  # disabled
seed_value_3 = Slider(5, range=0..5)  # disabled
boundary_dimensions_2 = Slider(5, range=0..50)  # disabled
timer_2 = Timer(Interval=10, TimerInterval=10, Target=python_2)  # disabled
reset_button_2 = Button()  # disabled

# ---- group: Inputs / Center of Bounding Box
point = Point(Point(0, 0, 0))

# ----
point_2 = Point(Point(0, 0, 0))  # disabled
center_box = CenterBox(Base=point, X=boundary_dimensions, Y=boundary_dimensions, Z=boundary_dimensions)
center_box_2 = CenterBox(Base=point_2, X=boundary_dimensions_2, Y=boundary_dimensions_2, Z=boundary_dimensions_2)  # disabled
deconstruct_brep = DeconstructBrep(Brep=center_box)  # -> Faces, Edges, Vertices
populate_3d = Populate3D(Region=center_box, Count=food_source_count_2, Seed=seed_value_2)
deconstruct_brep_2 = DeconstructBrep(Brep=center_box_2)  # -> Faces, Edges, Vertices; disabled
populate_3d_2 = Populate3D(Region=center_box_2, Count=food_source_count_3, Seed=seed_value_3)  # disabled
point_3 = Point(deconstruct_brep.Vertices)
point_4 = Point(deconstruct_brep_2.Vertices)  # disabled

# ---- group: Initiating Systems
geometry = Geometry(point_3)

# ---- group: Food Source Inputs
pt = Point(populate_3d)

# ----
geometry_2 = Geometry(point_4)  # disabled
pt_2 = Point(populate_3d_2)  # disabled
filter_length = Slider(5, range=0..30)
filter_length_2 = Slider(3, range=0..30)
filter_length_3 = Slider(10, range=0..30)
filter_length_4 = Slider(10, range=0..30)  # disabled
filter_length_5 = Slider(5, range=0..30)
filter_length_6 = Slider(5, range=0..30)  # disabled
python = GhPythonScript(
    iInitOrigin=flatten(geometry),
    iFoodSource=pt,
    iFoodRad=food_source_radius_2,
    iBoundarySize=boundary_dimensions,
    iVelocityFactor=velocity_factor,
    iReset=reset_button)  # -> out, oPoints, flatten(oGeometry), oLines; inputs iInitOrigin: list of Point3d, iFoodSource: list of Point3d, iReset: Boolean
# ---------- python: Python ----------
import Rhino.Geometry as rg
import random
import math
import System.Drawing as drawing


foodSource = []
initPoint = iInitOrigin
foodSource = iFoodSource

boundarySize = iBoundarySize

class ParticleSystemNetwork:
    #Initiate Particle System
    def __init__(self, foodSource):
        self.FoodSources = foodSource
        self.Length = None
        self.Veins = None
        self.ParticleSystems = []

    def CreateParticleSystem(self, startPoint):
        veinNumber = 5
        particleSystem = ParticleSystem(veinNumber, startPoint)

        #Set properties at ParticleSystem level
        particleSystem.System = self
        particleSystem.FoodSources = self.FoodSources

        #ParticleSystem level
        self.ParticleSystems.append(particleSystem)

    def Update(self):
        self.Veins = []
        for system in self.ParticleSystems:
            #Set properties at particle level
            system.CreateVeins()
            system.FoodSources = self.FoodSources
            
            #ParticleSystem level
            self.Veins.extend(system.Veins)

#Class that starts at food source, branches out looking for other food sources and connects them
class ParticleSystem:
    #Initiate Particle System
    def __init__(self, particleCount, origin):
        self.Origin = origin
        self.Particles = []
        self.Trees = []
        self.FoundTree = []
        self.FoundBranchLevel = []

        #Place "particleCount" particles on food source to start searching
        for i in range(0, particleCount):
            self.Trees.append([[]])
            
            #Spherical boundary
            sphere = rg.Sphere(self.Origin, iFoodRad)
            self.Boundary = sphere
            
            #Randomly spaced
            #longitudeRadiansinterval [0, 2pi]
            alpha = random.uniform(0, 2 * math.pi)
            #latitudeRadians [-pi/2,pi/2]
            rho = random.uniform(-math.pi / 2, math.pi / 2) 

            boundaryPt = self.Boundary.PointAt(alpha, rho)

            particle = Particle(boundaryPt, i, self.Boundary)
            
            #Set properties at particle level
            particle.System = self
            particle.SystemOrigin = self.Origin
            
            #Particle system level
            self.Particles.append(particle)
            
    #Update the searching particle position and create a "vein" to visualize it's search history
    def CreateVeins(self):
        self.Veins = []
        self.Length = []
        
        #random split length
        #splitLength = random.randint(18, 25)
        #set length
        splitLength = 10

        #For every particle in the particle system, do one of the following
        for particle in self.Particles:

            #If the particle has not found food, update it's position and vein
            if particle.FoundFood == False:
                particle.Update()
                vein = rg.Polyline(particle.History)
                #Set properties at particle level
                particle.Vein = vein
                particle.Length = vein.Length

                #Particle system level
                self.Veins.append(vein)
                self.Length.append(vein.Length)
                self.Trees[particle.VeinTree][particle.BranchLevel] = particle.Vein


            #If the particle has found food, let the ParticleSystem know which Tree found the food and at what branch level
            elif particle.FoundFood == True:
                vein = rg.Polyline(particle.History)

                #Set properties at particle level
                particle.Vein = vein
                particle.Length = vein.Length

                #Particle system level 
                self.Veins.append(vein)
                self.Length.append(vein.Length)
                self.Trees[particle.VeinTree][particle.BranchLevel] = particle.Vein
                self.FoundTree.append(particle.FoundTree)
                self.FoundBranchLevel.append(particle.BranchLevel)                
                particle.FoundFood = "skip"
                
            else:
                vein = rg.Polyline(particle.History)

                #Set properties at particle level
                particle.Vein = vein
                particle.Length = vein.Length

                #Particle system level
                self.Veins.append(vein)
                self.Length.append(vein.Length)
                self.Trees[particle.VeinTree][particle.BranchLevel] = particle.Vein

            #If the vein gets long enough, start another vein at that point (remembering which tree it came from and what level it's on)
            if vein.Length > splitLength and vein.Length < splitLength + iVelocityFactor:
                    #Set properties at particle level
                    newParticle = Particle(particle.Position, particle.VeinTree, self.Boundary)
                    newParticle.BranchLevel = particle.BranchLevel + 1
                    newParticle.SystemBoundary = self.Boundary
                    newParticle.SystemOrigin = self.Origin
                    newParticle.FoodSources = self.System.FoodSources
                    newParticle.System = self

                    #Particle system level
                    self.Particles.append(newParticle)
                    self.Trees[particle.VeinTree].append([])

class Particle:
#Initate the 'agent'
#Dont like system boundary as an input, should be inherited from system
    def __init__(self, startPt, veinTree, systemBoundary):
        self.Position = startPt
        self.VeinTree = veinTree
        self.Length = None
        self.FoundFood = False
        self.FoundTree = None
        self.BranchLevel = 0
        self.Transparency = 255
        self.Radius = 0

        #Spherical system boundary
        self.SystemBoundary = systemBoundary

         # Initilize the Velocity to a vector from centroid to insure outward growth
        self.Velocity = rg.Vector3d(self.Position - self.SystemBoundary.Center)
        self.History = [self.Position]

    #Update the 'agent'
    def Update(self):
        #Randomly rotate velocity about the frame's Z Axis
        self.Velocity.Rotate(random.uniform(-0.15, 0.15), rg.Vector3d(random.uniform(-.05,.05), random.uniform(-.1,.1), 1))

        #Call methods to update Velocity based on external factors

        self.ProcessInitBoundary()
        self.ProcessVeinAvoidance()
        self.ProcessAttractor()
        self.ProcessBoundary()
        self.ProcessFoodSource()
        self.ProcessNoFood()

        self.Velocity.Unitize()

        #Transparency values
        if self.Length > 150:
            self.Velocity = rg.Vector3d(0,0,0)

            if self.Transparency < 10:
                self.Transparency = 0
            else:
                self.Transparency -= 5

            if self.Radius < 0.05:
                self.Radius = 0.05
            else:
                self.Radius -= 0.02

        #random deathLength
        #deathLength = random.randint(200, 250)
        #set deathLength
        deathLength = 250

        if self.Length > deathLength:
            self.Velocity = rg.Vector3d(0,0,0)

        #From all above considerations, move the agent
        self.Position += iVelocityFactor * self.Velocity
        self.History.append(self.Position)

    #When all food sources are gone stop growth
    def ProcessNoFood(self):
        if len(self.System.System.FoodSources) < 1:
            self.Veloctiy = rg.Vector3d(0,0,0)

    #When veins find a food source stop growth
    def ProcessFoodSource(self):
        for foodParticle in self.System.System.FoodSources:
            if self.Position.DistanceTo(foodParticle) < iFoodRad:
                #Stop vein growth
                self.Veloctiy = rg.Vector3d(0,0,0)
                self.FoundFood = True #Can maybe get rid of this logic?
                self.FoundTree = self.VeinTree

                #Remove from FoodSource list
                self.System.System.FoodSources.remove(foodParticle)
                #Add new random point to FoodSource list
                newFoodParticle = rg.Point3d(random.uniform(-boundarySize, boundarySize), random.uniform(-boundarySize, boundarySize), random.uniform(-boundarySize, boundarySize))
                self.System.System.FoodSources.append(newFoodParticle)
                allFoodSources.append(newFoodParticle)
                #Create an new Particle System at found food partice location
                self.System.System.CreateParticleSystem(foodParticle)

    #Have the veins avoid eachother
    def ProcessVeinAvoidance(self):
        #Process all the veins in the system and determine the "get away" factor from the distance
        for vein in self.System.Veins:
            closestPoint = vein.ClosestPoint(self.Position)
            getAway = self.Position - closestPoint  
            distance = getAway.Length

            #If the vein starts getting clsoe, gently move it away
            if (vein.Length >= 3 and distance < 20):
                getAway.Unitize()
                getAway *= 0.5 / (distance * distance + 1)
                self.Velocity += getAway

            #If the particles come too close, stop
            elif (distance < 3):
                self.Velocity = rg.Vector3d(0,0,0)

    #Have the veins be drawn to an attractor
    def ProcessAttractor(self):
        for i in range(0, len(self.System.System.FoodSources)): #Maybe a way to more elegantly call FoodSources from System Network level?
            toAttractor = self.System.System.FoodSources[i] - self.Position
            dis = toAttractor.Length
            toAttractor *= 0.1 / (dis * dis +.01)
            self.Velocity += toAttractor
            #tweak first number for attraction strength
            self.Velocity *= 0.1 / self.Velocity.Length

    #Make veins move away from food sources
    def ProcessInitBoundary(self):
        pointOnCurve = self.SystemBoundary.ClosestPoint(self.Position)
        getAway = self.Position - pointOnCurve
        distance = getAway.Length
        getAway.Unitize()
        self.Velocity += 0.1 * getAway / (distance * distance + 1)

    #Bounding box, only needed for 3D applications
    def ProcessBoundary(self):
        if self.Position.X < -boundarySize:
            self.Position.X = -boundarySize
            self.Velocity.X = -self.Velocity.X
        elif self.Position.X > boundarySize:
            self.Position.X = boundarySize
            self.Velocity.X = -self.Velocity.X
        if self.Position.Y < -boundarySize:
            self.Position.Y = -boundarySize
            self.Velocity.Y = -self.Velocity.Y
        elif self.Position.Y > boundarySize:
            self.Position.Y = boundarySize
            self.Velocity.Y = -self.Velocity.Y
        if self.Position.Z < -boundarySize:
            self.Position.Z = -boundarySize
            self.Velocity.Z = -self.Velocity.Z
        elif self.Position.Z > boundarySize:
            self.Position.Z = boundarySize
            self.Velocity.Z = -self.Velocity.Z

def FindPathBack(polylines, branchLevel):
    crvs = []
    startPts = []
    parameters = []

    for i in range(0, branchLevel + 1):
        if i == branchLevel:
            crvs.append(polylines[i])

        else:
            point = polylines[i + 1].PointAt(0)
            crv = polylines[i].ToNurbsCurve()
            parameter = crv.ClosestPoint(point)
            curveSegment = crv.Split(parameter[1])[0]
            startPts.append(point)
            crvs.append(curveSegment)
    return [crvs, startPts]

# Main Script:
if iReset or not("myParticleSystemNetwork" in globals()):
    allFoodSources = []
    allFoodSources.extend(initPoint)
    allFoodSources.extend(foodSource)
    myParticleSystemNetwork = ParticleSystemNetwork(foodSource)
    for i in range(0, len(initPoint)):
        myParticleSystemNetwork.CreateParticleSystem(initPoint[i])    
else:
    myParticleSystemNetwork.Update()

# Output the visualization geometry
oGeometry = myParticleSystemNetwork.Veins

# Sort food connecting lines for mesh
paths = []
startPts = []

for systems in myParticleSystemNetwork.ParticleSystems:
    for i in range(0, len(systems.FoundTree)):
        branchLevel = systems.FoundBranchLevel[i]
        treeNumber = systems.FoundTree[i]
        polylines = systems.Trees[treeNumber]
        
        startPts.append(FindPathBack(polylines, branchLevel)[1])
        paths.append(FindPathBack(polylines, branchLevel)[0])

oLines = paths
oPoints = allFoodSources
oLines = paths

# If controlling color/transparency
transparencies = []
colors = []
radii = []

for systems in myParticleSystemNetwork.ParticleSystems:
    for systemParticle in systems.Particles:
        trans = systemParticle.Transparency
        #transparencies.append(systemParticle.Transparency)
        color = drawing.Color.FromArgb(255, trans, trans, trans)
        colors.append(color)
    
    radii.append(systemParticle.Radius)
# ---------- end python ----------
python_2 = GhPythonScript(iInitOrigin=flatten(geometry_2), iFoodSource=pt_2, iReset=reset_button_2)  # -> out, oPoints, flatten(oGeometry), oLines; inputs iInitOrigin: list of Point3d, iFoodSource: list of Point3d, iReset: Boolean; disabled
# ---------- python_2: Python ----------
import Rhino.Geometry as rg
import random
import math
import System.Drawing as drawing

foodSource = []
initPoint = iInitOrigin
foodSource = iFoodSource

class ParticleSystemNetwork:
    #Initiate Particle System
    def __init__(self, foodSource):
        self.FoodSources = foodSource
        self.Length = None
        self.Veins = None
        self.ParticleSystems = []

    def CreateParticleSystem(self, startPoint):
        veinNumber = 5
        particleSystem = ParticleSystem(veinNumber, startPoint)

        #Set properties at ParticleSystem level
        particleSystem.System = self
        particleSystem.FoodSources = self.FoodSources

        #ParticleSystem level
        self.ParticleSystems.append(particleSystem)

    def Update(self):
        self.Veins = []
        for system in self.ParticleSystems:
            #Set properties at particle level
            system.CreateVeins()
            system.FoodSources = self.FoodSources
            
            #ParticleSystem level
            self.Veins.extend(system.Veins)

#Class that starts at food source, branches out looking for other food sources and connects them
class ParticleSystem:
    #Initiate Particle System
    def __init__(self, particleCount, origin):
        self.Origin = origin
        self.Particles = []
        self.Trees = []
        self.FoundTree = []
        self.FoundBranchLevel = []

        #Place "particleCount" particles on food source to start searching
        for i in range(0, particleCount):
            self.Trees.append([[]])
            
            #Spherical boundary
            sphere = rg.Sphere(self.Origin, 1.0)
            self.Boundary = sphere
            
            #Randomly spaced
            #longitudeRadiansinterval [0, 2pi]
            alpha = random.uniform(0, 2 * math.pi)
            #latitudeRadians [-pi/2,pi/2]
            rho = random.uniform(-math.pi / 2, math.pi / 2) 

            boundaryPt = self.Boundary.PointAt(alpha, rho)

            particle = Particle(boundaryPt, i, self.Boundary)
            
            #Set properties at particle level
            particle.System = self
            particle.SystemOrigin = self.Origin
            
            #Particle system level
            self.Particles.append(particle)
            
    #Update the searching particle position and create a "vein" to visualize it's search history
    def CreateVeins(self):
        self.Veins = []
        self.Length = []
        
        #random split length
        #splitLength = random.randint(18, 25)
        #set length
        splitLength = 10

        #For every particle in the particle system, do one of the following
        for particle in self.Particles:

            #If the particle has not found food, update it's position and vein
            if particle.FoundFood == False:
                particle.Update()
                vein = rg.Polyline(particle.History)
                #Set properties at particle level
                particle.Vein = vein
                particle.Length = vein.Length

                #Particle system level
                self.Veins.append(vein)
                self.Length.append(vein.Length)
                self.Trees[particle.VeinTree][particle.BranchLevel] = particle.Vein


            #If the particle has found food, let the ParticleSystem know which Tree found the food and at what branch level
            elif particle.FoundFood == True:
                vein = rg.Polyline(particle.History)

                #Set properties at particle level
                particle.Vein = vein
                particle.Length = vein.Length

                #Particle system level 
                self.Veins.append(vein)
                self.Length.append(vein.Length)
                self.Trees[particle.VeinTree][particle.BranchLevel] = particle.Vein
                self.FoundTree.append(particle.FoundTree)
                self.FoundBranchLevel.append(particle.BranchLevel)                
                particle.FoundFood = "skip"
                
            else:
                vein = rg.Polyline(particle.History)

                #Set properties at particle level
                particle.Vein = vein
                particle.Length = vein.Length

                #Particle system level
                self.Veins.append(vein)
                self.Length.append(vein.Length)
                self.Trees[particle.VeinTree][particle.BranchLevel] = particle.Vein

            #If the vein gets long enough, start another vein at that point (remembering which tree it came from and what level it's on)
            if vein.Length > splitLength and vein.Length < splitLength + 0.2:
                    #Set properties at particle level
                    newParticle = Particle(particle.Position, particle.VeinTree, self.Boundary)
                    newParticle.BranchLevel = particle.BranchLevel + 1
                    newParticle.SystemBoundary = self.Boundary
                    newParticle.SystemOrigin = self.Origin
                    newParticle.FoodSources = self.System.FoodSources
                    newParticle.System = self

                    #Particle system level
                    self.Particles.append(newParticle)
                    self.Trees[particle.VeinTree].append([])

class Particle:
#Initate the 'agent'
#Dont like system boundary as an input, should be inherited from system
    def __init__(self, startPt, veinTree, systemBoundary):
        self.Position = startPt
        self.VeinTree = veinTree
        self.Length = None
        self.FoundFood = False
        self.FoundTree = None
        self.BranchLevel = 0
        self.Transparency = 255
        self.Radius = 0

        #Spherical system boundary
        self.SystemBoundary = systemBoundary

         # Initilize the Velocity to a vector from centroid to insure outward growth
        self.Velocity = rg.Vector3d(self.Position - self.SystemBoundary.Center)
        self.History = [self.Position]

    #Update the 'agent'
    def Update(self):
        #Randomly rotate velocity about the frame's Z Axis
        self.Velocity.Rotate(random.uniform(-0.15, 0.15), rg.Vector3d(random.uniform(-.05,.05), random.uniform(-.1,.1), 1))

        #Call methods to update Velocity based on external factors

        self.ProcessInitBoundary()
        self.ProcessVeinAvoidance()
        self.ProcessAttractor()
        self.ProcessBoundary()
        self.ProcessFoodSource()
        self.ProcessNoFood()

        self.Velocity.Unitize()

        #Transparency values
        if self.Length > 150:
            self.Velocity = rg.Vector3d(0,0,0)

            if self.Transparency < 10:
                self.Transparency = 0
            else:
                self.Transparency -= 5

            if self.Radius < 0.05:
                self.Radius = 0.05
            else:
                self.Radius -= 0.02

        #random deathLength
        #deathLength = random.randint(200, 250)
        #set deathLength
        deathLength = 250

        if self.Length > deathLength:
            self.Velocity = rg.Vector3d(0,0,0)

        #From all above considerations, move the agent
        self.Position += 0.2 * self.Velocity
        self.History.append(self.Position)

    #When all food sources are gone stop growth
    def ProcessNoFood(self):
        if len(self.System.System.FoodSources) < 1:
            self.Veloctiy = rg.Vector3d(0,0,0)

    #When veins find a food source stop growth
    def ProcessFoodSource(self):
        for foodParticle in self.System.System.FoodSources:
            if self.Position.DistanceTo(foodParticle) < 1.0:
                #Stop vein growth
                self.Veloctiy = rg.Vector3d(0,0,0)
                self.FoundFood = True #Can maybe get rid of this logic?
                self.FoundTree = self.VeinTree

                #Remove from FoodSource list
                self.System.System.FoodSources.remove(foodParticle)
                #Add new random point to FoodSource list
                newFoodParticle = rg.Point3d(random.uniform(-5, 5), random.uniform(-5, 5), random.uniform(-5, 5))
                self.System.System.FoodSources.append(newFoodParticle)
                allFoodSources.append(newFoodParticle)
                #Create an new Particle System at found food partice location
                self.System.System.CreateParticleSystem(foodParticle)

    #Have the veins avoid eachother
    def ProcessVeinAvoidance(self):
        #Process all the veins in the system and determine the "get away" factor from the distance
        for vein in self.System.Veins:
            closestPoint = vein.ClosestPoint(self.Position)
            getAway = self.Position - closestPoint  
            distance = getAway.Length

            #If the vein starts getting clsoe, gently move it away
            if (vein.Length >= 3 and distance < 20):
                getAway.Unitize()
                getAway *= 0.5 / (distance * distance + 1)
                self.Velocity += getAway

            #If the particles come too close, stop
            elif (distance < 3):
                self.Velocity = rg.Vector3d(0,0,0)

    #Have the veins be drawn to an attractor
    def ProcessAttractor(self):
        for i in range(0, len(self.System.System.FoodSources)): #Maybe a way to more elegantly call FoodSources from System Network level?
            toAttractor = self.System.System.FoodSources[i] - self.Position
            dis = toAttractor.Length
            toAttractor *= 0.1 / (dis * dis +.01)
            self.Velocity += toAttractor
            #tweak first number for attraction strength
            self.Velocity *= 0.1 / self.Velocity.Length

    #Make veins move away from food sources
    def ProcessInitBoundary(self):
        pointOnCurve = self.SystemBoundary.ClosestPoint(self.Position)
        getAway = self.Position - pointOnCurve
        distance = getAway.Length
        getAway.Unitize()
        self.Velocity += 0.1 * getAway / (distance * distance + 1)

    #Bounding box, only needed for 3D applications
    def ProcessBoundary(self):
        if self.Position.X < -5:
            self.Position.X = -5
            self.Velocity.X = -self.Velocity.X
        elif self.Position.X > 5:
            self.Position.X = 5
            self.Velocity.X = -self.Velocity.X
        if self.Position.Y < -5:
            self.Position.Y = -5
            self.Velocity.Y = -self.Velocity.Y
        elif self.Position.Y > 5:
            self.Position.Y = 5
            self.Velocity.Y = -self.Velocity.Y
        if self.Position.Z < -5:
            self.Position.Z = -5
            self.Velocity.Z = -self.Velocity.Z
        elif self.Position.Z > 5:
            self.Position.Z = 5
            self.Velocity.Z = -self.Velocity.Z

def FindPathBack(polylines, branchLevel):
    crvs = []
    startPts = []
    parameters = []

    for i in range(0, branchLevel + 1):
        if i == branchLevel:
            crvs.append(polylines[i])

        else:
            point = polylines[i + 1].PointAt(0)
            crv = polylines[i].ToNurbsCurve()
            parameter = crv.ClosestPoint(point)
            curveSegment = crv.Split(parameter[1])[0]
            startPts.append(point)
            crvs.append(curveSegment)
    return [crvs, startPts]

# Main Script:
if iReset or not("myParticleSystemNetwork" in globals()):
    allFoodSources = []
    allFoodSources.extend(initPoint)
    allFoodSources.extend(foodSource)
    myParticleSystemNetwork = ParticleSystemNetwork(foodSource)
    for i in range(0, len(initPoint)):
        myParticleSystemNetwork.CreateParticleSystem(initPoint[i])    
else:
    myParticleSystemNetwork.Update()

# Output the visualization geometry
oGeometry = myParticleSystemNetwork.Veins

# Sort food connecting lines for mesh
paths = []
startPts = []

for systems in myParticleSystemNetwork.ParticleSystems:
    for i in range(0, len(systems.FoundTree)):
        branchLevel = systems.FoundBranchLevel[i]
        treeNumber = systems.FoundTree[i]
        polylines = systems.Trees[treeNumber]
        
        startPts.append(FindPathBack(polylines, branchLevel)[1])
        paths.append(FindPathBack(polylines, branchLevel)[0])

oLines = paths
oPoints = allFoodSources
oLines = paths

# If controlling color/transparency
transparencies = []
colors = []
radii = []

for systems in myParticleSystemNetwork.ParticleSystems:
    for systemParticle in systems.Particles:
        trans = systemParticle.Transparency
        #transparencies.append(systemParticle.Transparency)
        color = drawing.Color.FromArgb(255, trans, trans, trans)
        colors.append(color)
    
    radii.append(systemParticle.Radius)
# ---------- end python_2 ----------
geometry_3 = Geometry(center_box)
geometry_4 = Geometry(center_box_2)  # disabled
number_slider = Slider(100, range=0..250)
ghpython_script = GhPythonScript(x=python_2.oLines)  # -> out, simplify(a); disabled
# ---------- ghpython_script: Python ----------
a = x
# ---------- end ghpython_script ----------
number_slider_2 = Slider(100, range=0..250)
number_slider_3 = Slider(100, range=0..250)  # disabled

# ---- group: All Food Sources
ghpython_script_2 = GhPythonScript(x=python.oPoints)  # -> out, flatten(a); same code as ghpython_script
data_dam = DataDam(DataDataA=ghpython_script_2.a, BufferDelay=10000000, BufferMode=0)

# ---- group: All Veins / Length Filter
ghpython_script_3 = GhPythonScript(x=python.oGeometry, y=filter_length_3)  # -> out, flatten(a); inputs x: list of Polyline
# ---------- ghpython_script_3: Python ----------
list = []
for i in x:
    print i.Length
    if i.Length > y:
        list.append(i)
a = list
# ---------- end ghpython_script_3 ----------

# ----
ghpython_script_4 = GhPythonScript(x=python_2.oPoints)  # -> out, flatten(a); disabled; same code as ghpython_script
ghpython_script_5 = GhPythonScript(x=python_2.oGeometry, y=filter_length_4)  # -> out, flatten(a); inputs x: list of Polyline; disabled; same code as ghpython_script_3
ghpython_script_6 = GhPythonScript(x=ghpython_script.a, y=filter_length_6)  # -> out, simplify(a); inputs x: list of Polyline; disabled
# ---------- ghpython_script_6: Python ----------
list = []
k = 0
for i in x:
    print k
    print type(i)
    if i.Length > y:

        list.append(i)
a = list
# ---------- end ghpython_script_6 ----------
read_outs = Panel(python.out)
read_outs_2 = Panel(python_2.out)  # disabled
curve = Curve(ghpython_script_6.a)  # disabled

# ---- group: All Veins
data_dam_2 = DataDam(DataDataA=ghpython_script_3.a, BufferDelay=10000000, BufferMode=0)
number_slider_4 = Slider(0.1, range=0..1)
rebuild_curve = RebuildCurve(Curve=ghpython_script_3.a, Degree=3, Count=number_slider_2, Tangents=False)

# ----
data_dam_3 = DataDam(DataDataA=ghpython_script_4.a, BufferDelay=10000000, BufferMode=0)  # disabled
data_dam_4 = DataDam(DataDataA=ghpython_script_5.a, BufferDelay=10000000, BufferMode=0)  # disabled
flip_matrix = FlipMatrix(Data=curve)  # disabled
number_slider_5 = Slider(5, range=0..10)
number_slider_6 = Slider(5, range=0..10)
number_slider_7 = Slider(5, range=0..10)  # disabled
number_slider_8 = Slider(0.1, range=0..1)  # disabled
rebuild_curve_2 = RebuildCurve(Curve=ghpython_script_5.a, Degree=3, Count=number_slider_3, Tangents=False)  # disabled
rebuild_curve_3 = RebuildCurve(Curve=flip_matrix, Degree=3, Count=number_slider_3, Tangents=False)  # disabled
tree_statistics = TreeStatistics(Tree=flip_matrix)  # -> Paths, Length, Count; disabled
ghpython_script_7 = GhPythonScript(x=tree_statistics.Count)  # -> out, a; disabled
# ---------- ghpython_script_7: Python ----------
a = []

for i in range(1, x+1):
    a.append(i * 0.1)
# ---------- end ghpython_script_7 ----------
mesh_pipe = MeshPipe(Curve=rebuild_curve_3, Radius=ghpython_script_7.a, Accuracy=0.2, Rotation=0, Segments=number_slider_7, Caps=2)  # -> flatten(Mesh); disabled
mesh_pipe_2 = MeshPipe(Curve=rebuild_curve_2, Radius=number_slider_8, Accuracy=0.2, Rotation=0, Segments=number_slider_7, Caps=2)  # disabled
sphere = Sphere(Base=ghpython_script_4.a, Radius=1)  # disabled

# ---- group: Bounding Box
colour_swatch = ColourSwatch(SwatchColor=RGBA(124, 157, 207, 30))  # disabled
custom_preview = CustomPreview(Geometry=geometry_3, Material=colour_swatch)  # disabled

# ---- group: Colorized Geometr / All Curves
colour_swatch_2 = ColourSwatch(SwatchColor=RGBA(0, 255, 174, 123))  # disabled
custom_preview_2 = CustomPreview(Geometry=python.oGeometry, Material=colour_swatch_2)  # disabled

# ----
colour_swatch_3 = ColourSwatch(SwatchColor=RGBA(124, 157, 207, 30))  # disabled
colour_swatch_4 = ColourSwatch(SwatchColor=RGBA(240, 100, 151, 214))  # disabled
colour_swatch_5 = ColourSwatch(SwatchColor=RGBA(0, 255, 174, 123))  # disabled
colour_swatch_6 = ColourSwatch(SwatchColor=RGB(255, 255, 255))  # disabled
custom_preview_3 = CustomPreview(Geometry=geometry_4, Material=colour_swatch_3)  # disabled
custom_preview_4 = CustomPreview(Geometry=sphere, Material=colour_swatch_4)  # disabled
custom_preview_5 = CustomPreview(Geometry=python_2.oGeometry, Material=colour_swatch_5)  # disabled
custom_preview_6 = CustomPreview(Geometry=mesh_pipe_2, Material=colour_swatch_5)  # disabled
custom_preview_7 = CustomPreview(Geometry=mesh_pipe, Material=colour_swatch_6)  # disabled

# ---- group: Inputs
boundary_dimensions_3 = Slider(5, range=0..50)
velocity_factor_2 = Slider(0.43, range=0.01..1)
timer_3 = Timer(Interval=10, TimerInterval=10, Target=python_3)  # disabled
reset_button_3 = Button()
surface = Surface(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)

# ----
bounding_box = BoundingBox(Content=surface, Plane=PlaneXY(0, 0, 0))  # -> Box, Box_2

# ---- group: Inputs (continued)
# There are 3 versions of this code. For demonstration purposes #1 & 2 use inputs as global variables.
# 
# 1. Projects the slime mold growth to a surface.
# 
# 2. Has the slime mold grow in 3D constrained by a bounding box.
# 
# 3. Is the same has 2 but as no variable inputs. This eliminates the need for global variables within objects as this is bad practice.
# 1. Project to Surface
volume = Volume(Geometry=bounding_box.Box)  # -> Volume, Centroid

# ---- group: Inputs / Center of Bounding Box
point_5 = Point(volume.Centroid)

# ----
populate_3d_3 = Populate3D(Region=bounding_box.Box, Count=food_source_count, Seed=seed_value)

# ---- group: Initiating Systems
geometry_5 = Geometry(point_5)

# ---- group: Food Source Inputs
pt_3 = Point(populate_3d_3)

# ----
python_3 = GhPythonScript(
    iInitOrigin=flatten(geometry_5),
    iFoodSource=pt_3,
    iFoodRad=food_source_radius,
    iBoundarySize=boundary_dimensions_3,
    iVelocityFactor=velocity_factor_2,
    iSurface=surface,
    iReset=reset_button_3)  # -> out, oPoints, flatten(oGeometry), oLines; inputs iInitOrigin: list of Point3d, iFoodSource: list of Point3d, iSurface: Surface, iReset: Boolean
# ---------- python_3: Python ----------
import Rhino.Geometry as rg
import random
import math
import System.Drawing as drawing

#Place Food Source on Surface
foodSource = []

for foodSources in iFoodSource:
    f = iSurface.ClosestPoint(foodSources)
    foodSource.append(iSurface.PointAt(f[1], f[2]))

initPoint = iInitOrigin
class ParticleSystemNetwork:
    #Initiate Particle System
    def __init__(self, foodSource):
        self.FoodSources = foodSource
        self.Length = None
        self.Veins = None
        self.ParticleSystems = []

    def CreateParticleSystem(self, startPoint):
        veinNumber = 2
        particleSystem = ParticleSystem(veinNumber, startPoint)

        #Set properties at ParticleSystem level
        particleSystem.System = self
        particleSystem.FoodSources = self.FoodSources

        #ParticleSystem level
        self.ParticleSystems.append(particleSystem)

    def Update(self):
        self.Veins = []
        for system in self.ParticleSystems:
            #Set properties at particle level
            system.CreateVeins()
            system.FoodSources = self.FoodSources
            
            #ParticleSystem level
            self.Veins.extend(system.Veins)

#Class that starts at food source, branches out looking for other food sources and connects them
class ParticleSystem:
    #Initiate Particle System
    def __init__(self, particleCount, origin):
        self.Origin = origin
        self.Particles = []
        self.Trees = []
        self.FoundTree = []
        self.FoundBranchLevel = []

        #Place "particleCount" particles on food source to start searching
        for i in range(0, particleCount):
            self.Trees.append([[]])

            circle = rg.Circle(self.Origin, iFoodRad)
            self.Boundary = circle.ToNurbsCurve()
            self.Boundary.Domain = rg.Interval(0,1)

            #Randomly spaced
            boundaryPt = self.Boundary.PointAt(random.uniform(0.0, 1.0))
            #Evenly spaced
            #boundaryPt = self.Boundary.PointAt(i * 1/particleCount)

            temp = iSurface.ClosestPoint(boundaryPt)
            srfPt = iSurface.FrameAt(temp[1], temp[2])[1].Origin

            particle = Particle(srfPt, i, self.Boundary)
            
            #Set properties at particle level
            particle.System = self
            particle.SystemOrigin = self.Origin
            
            #Particle system level
            self.Particles.append(particle)
            
    #Update the searching particle position and create a "vein" to visualize it's search history
    def CreateVeins(self):
        self.Veins = []
        self.Length = []
        
        #random split length
        #splitLength = random.randint(18, 25)
        #set length
        splitLength = 10

        #For every particle in the particle system, do one of the following
        for particle in self.Particles:

            #If the particle has not found food, update it's position and vein
            if particle.FoundFood == False:
                particle.Update()
                vein = rg.Polyline(particle.History)
                #Set properties at particle level
                particle.Vein = vein
                particle.Length = vein.Length

                #Particle system level
                self.Veins.append(vein)
                self.Length.append(vein.Length)
                self.Trees[particle.VeinTree][particle.BranchLevel] = particle.Vein


            #If the particle has found food, let the ParticleSystem know which Tree found the food and at what branch level
            elif particle.FoundFood == True:
                vein = rg.Polyline(particle.History)

                #Set properties at particle level
                particle.Vein = vein
                particle.Length = vein.Length

                #Particle system level 
                self.Veins.append(vein)
                self.Length.append(vein.Length)
                self.Trees[particle.VeinTree][particle.BranchLevel] = particle.Vein
                self.FoundTree.append(particle.FoundTree)
                self.FoundBranchLevel.append(particle.BranchLevel)                
                particle.FoundFood = "skip"
                
            else:
                vein = rg.Polyline(particle.History)

                #Set properties at particle level
                particle.Vein = vein
                particle.Length = vein.Length

                #Particle system level
                self.Veins.append(vein)
                self.Length.append(vein.Length)
                self.Trees[particle.VeinTree][particle.BranchLevel] = particle.Vein

            #If the vein gets long enough, start another vein at that point (remembering which tree it came from and what level it's on)
            if vein.Length > splitLength and vein.Length < splitLength + iVelocityFactor:
                    #Set properties at particle level
                    newParticle = Particle(particle.Position, particle.VeinTree, self.Boundary)
                    newParticle.BranchLevel = particle.BranchLevel + 1
                    newParticle.SystemBoundary = self.Boundary
                    newParticle.SystemOrigin = self.Origin
                    newParticle.FoodSources = self.System.FoodSources
                    newParticle.System = self

                    #Particle system level
                    self.Particles.append(newParticle)
                    self.Trees[particle.VeinTree].append([])

class Particle:
#Initate the 'agent'
#Dont like system boundary as an input, should be inherited from system
    def __init__(self, startPt, veinTree, systemBoundary):
        self.Position = startPt
        self.VeinTree = veinTree
        self.Length = None
        self.FoundFood = False
        self.FoundTree = None
        self.BranchLevel = 0
        self.Transparency = 255
        self.Radius = 0

        #Dont like system origin as calculation, should be inherited from system
        self.SystemOrigin = rg.AreaMassProperties.Compute(systemBoundary).Centroid
        self.SystemBoundary = systemBoundary

         # Initilize the Velocity to a vector from centroid to insure outward growth
        self.Velocity = rg.Vector3d(self.Position - self.SystemOrigin)
        self.History = [self.Position]

    #Update the 'agent'
    def Update(self):

        #Ensure that the point stays on the surface
        ptOnSrf = iSurface.ClosestPoint(self.Position)
        frame = iSurface.FrameAt(ptOnSrf[1], ptOnSrf[2])[1]
        self.Position = frame.Origin
        #Randomly rotate velocity about the frame's Z Axis
        self.Velocity.Rotate(random.uniform(-0.15, 0.15), frame.ZAxis)
        #Call methods to update Velocity based on external factors

        self.ProcessInitBoundary()
        self.ProcessVeinAvoidance()
        self.ProcessAttractor()
        self.ProcessFoodSource()
        self.ProcessNoFood()

        self.Velocity.Unitize()

        #Transparency values
        if self.Length > 150:
            self.Velocity = rg.Vector3d(0,0,0)

            if self.Transparency < 10:
                self.Transparency = 0
            else:
                self.Transparency -= 5

            if self.Radius < 0.05:
                self.Radius = 0.05
            else:
                self.Radius -= 0.02

        #random deathLength
        #deathLength = random.randint(200, 250)
        #set deathLength
        deathLength = 250

        if self.Length > deathLength:
            self.Velocity = rg.Vector3d(0,0,0)

        #From all above considerations, move the agent
        self.Position += iVelocityFactor * self.Velocity
        self.History.append(self.Position)

    #When all food sources are gone stop growth
    def ProcessNoFood(self):
        if len(self.System.System.FoodSources) < 1:
            self.Veloctiy = rg.Vector3d(0,0,0)

    #When veins find a food source stop growth
    def ProcessFoodSource(self):
        for foodParticle in self.System.System.FoodSources:
            if self.Position.DistanceTo(foodParticle) < iFoodRad:
                #Stop vein growth
                self.Veloctiy = rg.Vector3d(0,0,0)
                self.FoundFood = True #Can maybe get rid of this logic?
                self.FoundTree = self.VeinTree

                #Remove from FoodSource list
                self.System.System.FoodSources.remove(foodParticle)
                #Add new random point to FoodSource list
                u0 = iSurface.Domain(0).T0
                u1 = iSurface.Domain(0).T1
                v0 = iSurface.Domain(1).T0
                v1 = iSurface.Domain(1).T1
                u = random.uniform(u0, u1)
                v = random.uniform(v0, v1)
                if len(self.System.System.FoodSources) < 1:
                    newFoodParticle = iSurface.PointAt(u, v)
                    allFoodSources.append(newFoodParticle)
                #Create an new Particle System at found food partice location
                self.System.System.CreateParticleSystem(foodParticle)

    #Have the veins avoid eachother
    def ProcessVeinAvoidance(self):
        #Process all the veins in the system and determine the "get away" factor from the distance
        for vein in self.System.Veins:
            closestPoint = vein.ClosestPoint(self.Position)
            getAway = self.Position - closestPoint  
            distance = getAway.Length

            #If the vein starts getting clsoe, gently move it away
            if (vein.Length >= 3 and distance < 20):
                getAway.Unitize()
                getAway *= 0.5 / (distance * distance + 1)
                self.Velocity += getAway

            #If the particles come too close, stop
            elif (distance < 3):
                self.Velocity = rg.Vector3d(0,0,0)

    #Have the veins be drawn to an attractor
    def ProcessAttractor(self):
        for i in range(0, len(self.System.System.FoodSources)): #Maybe a way to more elegantly call FoodSources from System Network level?
            toAttractor = self.System.System.FoodSources[i] - self.Position
            dis = toAttractor.Length
            toAttractor *= 0.1 / (dis * dis +.01)
            self.Velocity += toAttractor
            #tweak first number for attraction strength
            self.Velocity *= 0.1 / self.Velocity.Length

    #Make veins move away from food sources
    def ProcessInitBoundary(self):
        t = self.SystemBoundary.ClosestPoint(self.Position)[1]
        pointOnCurve = self.SystemBoundary.PointAt(t)
        getAway = self.Position - pointOnCurve
        distance = getAway.Length
        getAway.Unitize()
        self.Velocity += 0.1 * getAway / (distance * distance + 1)

def FindPathBack(polylines, branchLevel):
    crvs = []
    startPts = []
    parameters = []

    for i in range(0, branchLevel + 1):
        if i == branchLevel:
            crvs.append(polylines[i])

        else:
            point = polylines[i + 1].PointAt(0)
            crv = polylines[i].ToNurbsCurve()
            parameter = crv.ClosestPoint(point)
            curveSegment = crv.Split(parameter[1])[0]
            startPts.append(point)
            crvs.append(curveSegment)
    return [crvs, startPts]

# Main Script:
if iReset or not("myParticleSystemNetwork" in globals()):
    allFoodSources = []
    allFoodSources.extend(initPoint)
    allFoodSources.extend(foodSource)
    myParticleSystemNetwork = ParticleSystemNetwork(foodSource)
    for i in range(0, len(initPoint)):
        myParticleSystemNetwork.CreateParticleSystem(initPoint[i])    
else:
    myParticleSystemNetwork.Update()

# Output the visualization geometry
oGeometry = myParticleSystemNetwork.Veins

# Sort food connecting lines for mesh
paths = []
startPts = []

for systems in myParticleSystemNetwork.ParticleSystems:
    for i in range(0, len(systems.FoundTree)):
        branchLevel = systems.FoundBranchLevel[i]
        treeNumber = systems.FoundTree[i]
        polylines = systems.Trees[treeNumber]
        
        startPts.append(FindPathBack(polylines, branchLevel)[1])
        paths.append(FindPathBack(polylines, branchLevel)[0])

oLines = paths
oPoints = allFoodSources
oLines = paths

# If controlling color/transparency
transparencies = []
colors = []
radii = []

for systems in myParticleSystemNetwork.ParticleSystems:
    for systemParticle in systems.Particles:
        trans = systemParticle.Transparency
        #transparencies.append(systemParticle.Transparency)
        color = drawing.Color.FromArgb(255, trans, trans, trans)
        colors.append(color)
    
    radii.append(systemParticle.Radius)
# ---------- end python_3 ----------
geometry_6 = Geometry(surface)

# ---- group: All Veins / Length Filter
ghpython_script_8 = GhPythonScript(x=python_3.oGeometry, y=filter_length)  # -> out, flatten(a); inputs x: list of Polyline; same code as ghpython_script_3

# ---- group: All Food Sources
ghpython_script_9 = GhPythonScript(x=python_3.oPoints)  # -> out, flatten(a); same code as ghpython_script
data_dam_5 = DataDam(DataDataA=ghpython_script_9.a, BufferDelay=10000000, BufferMode=0)

# ----
read_outs_3 = Panel(python_3.out)

# ---- group: All Veins
data_dam_6 = DataDam(DataDataA=ghpython_script_8.a, BufferDelay=10000000, BufferMode=0)
number_slider_9 = Slider(0.1, range=0..1)
rebuild_curve_4 = RebuildCurve(Curve=ghpython_script_8.a, Degree=3, Count=number_slider, Tangents=False)

# ---- group: Bounding Box
colour_swatch_7 = ColourSwatch(SwatchColor=RGBA(124, 157, 207, 30))  # disabled
custom_preview_8 = CustomPreview(Geometry=geometry_6, Material=colour_swatch_7)  # disabled

# ---- group: Colorized Geometr / All Curves
colour_swatch_8 = ColourSwatch(SwatchColor=RGBA(0, 255, 174, 123))
custom_preview_9 = CustomPreview(Geometry=python_3.oGeometry, Material=colour_swatch_8)

# ---- group: Food Source Connecting Veins
ghpython_script_10 = GhPythonScript(x=python_3.oLines)  # -> out, simplify(a); same code as ghpython_script

# ---- group: Food Source Connecting Veins / Length Filter
ghpython_script_11 = GhPythonScript(x=ghpython_script_10.a, y=filter_length_2)  # -> out, simplify(a); inputs x: list of Polyline; same code as ghpython_script_6

# ---- group: Food Source Connecting Veins (continued)
curve_2 = Curve(ghpython_script_11.a)
flip_matrix_2 = FlipMatrix(Data=curve_2)
rebuild_curve_5 = RebuildCurve(Curve=flip_matrix_2, Degree=3, Count=number_slider, Tangents=False)
tree_statistics_2 = TreeStatistics(Tree=flip_matrix_2)  # -> Paths, Length, Count
ghpython_script_12 = GhPythonScript(x=tree_statistics_2.Count)  # -> out, a; same code as ghpython_script_7

# ---- group: Final Geometries
mesh_pipe_3 = MeshPipe(Curve=rebuild_curve_5, Radius=ghpython_script_12.a, Accuracy=0.2, Rotation=0, Segments=number_slider_5, Caps=2)  # -> flatten(Mesh)
mesh_pipe_4 = MeshPipe(Curve=rebuild_curve_4, Radius=number_slider_9, Accuracy=0.2, Rotation=0, Segments=number_slider_5, Caps=2)
sphere_2 = Sphere(Base=ghpython_script_9.a, Radius=food_source_radius)

# ---- group: Colorized Geometr / All Spheres
custom_preview_10 = CustomPreview(Geometry=sphere_2, Material=ColourSwatch(SwatchColor=RGBA(240, 100, 151, 214)))

# ---- group: Colorized Geometr / Food Source Connecting Veins
custom_preview_11 = CustomPreview(Geometry=mesh_pipe_3, Material=ColourSwatch(SwatchColor=RGB(255, 255, 255)))

# ---- group: Colorized Geometr / All Veins
custom_preview_12 = CustomPreview(Geometry=mesh_pipe_4, Material=colour_swatch_8)

# ---- group: Food Source Connecting Veins
ghpython_script_13 = GhPythonScript(x=python.oLines)  # -> out, simplify(a); same code as ghpython_script

# ---- group: Food Source Connecting Veins / Length Filter
ghpython_script_14 = GhPythonScript(x=ghpython_script_13.a, y=filter_length_5)  # -> out, simplify(a); inputs x: list of Polyline; same code as ghpython_script_6

# ---- group: Food Source Connecting Veins (continued)
curve_3 = Curve(ghpython_script_14.a)
flip_matrix_3 = FlipMatrix(Data=curve_3)
rebuild_curve_6 = RebuildCurve(Curve=flip_matrix_3, Degree=3, Count=number_slider_2, Tangents=False)
tree_statistics_3 = TreeStatistics(Tree=flip_matrix_3)  # -> Paths, Length, Count
ghpython_script_15 = GhPythonScript(x=tree_statistics_3.Count)  # -> out, a; same code as ghpython_script_7

# ---- group: Final Geometries
mesh_pipe_5 = MeshPipe(Curve=rebuild_curve_6, Radius=ghpython_script_15.a, Accuracy=0.2, Rotation=0, Segments=number_slider_6, Caps=2)  # -> flatten(Mesh)
mesh_pipe_6 = MeshPipe(Curve=rebuild_curve, Radius=number_slider_4, Accuracy=0.2, Rotation=0, Segments=number_slider_6, Caps=2)
sphere_3 = Sphere(Base=ghpython_script_2.a, Radius=food_source_radius_2)

# ---- group: Colorized Geometr / All Spheres
colour_swatch_9 = ColourSwatch(SwatchColor=RGBA(240, 100, 151, 214))  # disabled
custom_preview_13 = CustomPreview(Geometry=sphere_3, Material=colour_swatch_9)  # disabled

# ---- group: Colorized Geometr / Food Source Connecting Veins
colour_swatch_10 = ColourSwatch(SwatchColor=RGB(255, 255, 255))  # disabled
custom_preview_14 = CustomPreview(Geometry=mesh_pipe_5, Material=colour_swatch_10)  # disabled

# ---- group: Colorized Geometr / All Veins
custom_preview_15 = CustomPreview(Geometry=mesh_pipe_6, Material=colour_swatch_2)  # disabled
